# Grasshopper definition Wolfram_001_LIVE.gh (Grasshopper 1.0.7)

# WolframAlpha meets Grasshopper
panel = Panel("5")
negative = Negative(Value=panel)
number_slider = Slider(22, range=0..100)
construct_domain = ConstructDomain(DomainStart=negative, DomainEnd=panel)
pi = Pi(Factor=Slider(7.99, range=0..10))
pi_2 = Pi(Factor=Slider(5.5, range=0..10))
range = Range(Domain=construct_domain, Steps=number_slider)
range_2 = Range(Domain=construct_domain, Steps=number_slider)
multiplication = Multiplication(A=pi_2, B=range)
multiplication_2 = Multiplication(A=pi, B=range_2)
expression = Expression(x=multiplication_2, y=multiplication, Expression="sin(x+y)*cos(x-y)")
range_3 = Range(Domain=construct_domain, Steps=number_slider)
range_4 = Range(Domain=construct_domain, Steps=Slider(9, range=0..30))
construct_point = ConstructPoint(XCoordinate=range_3, YCoordinate=expression, ZCoordinate=0)
unit_y = UnitY(Factor=range_4)
move = Move(Geometry=graft(construct_point), Motion=unit_y)  # -> simplify(Geometry), Transform
flip_matrix = FlipMatrix(Data=move.Geometry)
panel_2 = Panel("{0,2,...}")
split_tree = SplitTree(Data=flip_matrix, Masks=flatten("{1,4,...}"))  # -> Positive, Negative
param_viewer = ParamViewer(flip_matrix)
unit_z = UnitZ(Factor=Slider(1, range=0..1))
point = Point(split_tree.Negative)
point_2 = Point(split_tree.Positive)
move_2 = Move(Geometry=point_2, Motion=unit_z)  # -> Geometry, Transform
interpolate = Interpolate(Vertices=point, Degree=3, Periodic=False, KnotStyle=1)  # -> Curve, Length, Domain
interpolate_2 = Interpolate(Vertices=move_2.Geometry, Degree=3, Periodic=False, KnotStyle=1)  # -> Curve, Length, Domain
merge = Merge(Data1=interpolate.Curve, Data2=interpolate_2.Curve)
loft = Loft(Curves=flatten(merge), Options={Adjust=False, Closed=False, LoftEnds=0, LoftSimp=0, LoftType=0, Rebuild=10, Refit=0.01})
