# Grasshopper definition Wolfram_Geometry_HS_002.gh (Grasshopper 1.0.7)

range = Range(Domain=Slider(13, range=0..100), Steps=Slider(2, range=0..10))
construct_point = ConstructPoint(XCoordinate=range, YCoordinate=0, ZCoordinate=0)
list_item = ListItem(List=construct_point, Index=0, Wrap=True)  # -> Item, Item1, Item2

# ----
# WolframAlpha meets Grasshopper
# Geometry 101
# Cube
number_slider = Slider(1, range=0..1)
# Dodecahedron
number_slider_2 = Slider(1, range=1..3)
rectangle = Rectangle(Plane=list_item.Item, XSize=number_slider, YSize=number_slider, Radius=0)  # -> Rectangle, Length
deconstruct_brep = DeconstructBrep(Brep=rectangle.Rectangle)  # -> Faces, Edges, Vertices
shift_list = ShiftList(List=deconstruct_brep.Vertices, Shift=number_slider_2, Wrap=True)
orient = Orient(Geometry=rectangle.Rectangle, Source=deconstruct_brep.Vertices, Target=shift_list)  # -> Geometry, Transform
list_item_2 = ListItem(List=orient.Geometry, Index=0, Wrap=True)
deconstruct_brep_2 = DeconstructBrep(Brep=list_item_2)  # -> Faces, Edges, Vertices
list_item_3 = ListItem(List=deconstruct_brep_2.Vertices, Index=0, Wrap=True)  # -> Item, Item1, Item2, Item3
orient_2 = Orient(Geometry=list_item_2, Source=list_item_3.Item3, Target=list_item_3.Item2)  # -> Geometry, Transform
merge = Merge(Data1=rectangle.Rectangle, Data2=orient.Geometry, Data3=orient_2.Geometry)
boundary_surfaces = BoundarySurfaces(Edges=merge)

polygon = Polygon(Plane=list_item.Item2, Radius=number_slider_2, Segments="5", FilletRadius=0)  # -> Polygon, Length
deconstruct_brep_3 = DeconstructBrep(Brep=polygon.Polygon)  # -> Faces, Edges, Vertices
shift_list_2 = ShiftList(List=deconstruct_brep_3.Vertices, Shift=1, Wrap=True)
line = Line(StartPoint=deconstruct_brep_3.Vertices, EndPoint=shift_list_2)
unit_z = UnitZ(Factor=1)
construct_plane = ConstructPlane(Origin=deconstruct_brep_3.Vertices, XAxis=line, YAxis=unit_z)
mirror = Mirror(Geometry=polygon.Polygon, Plane=construct_plane)  # -> Geometry, Transform
merge_2 = Merge(Data1=polygon.Polygon, Data2=mirror.Geometry)  # -> flatten(Result)
yz_plane = YZPlane(Origin=Point(0, 0, 0))
mirror_2 = Mirror(Geometry=merge_2, Plane=yz_plane)  # -> Geometry, Transform
deconstruct_brep_4 = DeconstructBrep(Brep=merge_2)  # -> Faces, Edges, Vertices
deconstruct_brep_5 = DeconstructBrep(Brep=mirror_2.Geometry)  # -> Faces, Edges, Vertices
addition = Addition(A="8", B="18")
list_item_4 = ListItem(List=flatten(deconstruct_brep_4.Vertices), Index="8", Wrap=True)
list_item_5 = ListItem(List=flatten(deconstruct_brep_5.Vertices), Index=addition, Wrap=True)
orient_3 = Orient(Geometry=mirror_2.Geometry, Source=list_item_5, Target=list_item_4)  # -> Geometry, Transform
merge_3 = Merge(Data1=merge_2, Data2=orient_3.Geometry)
boundary_surfaces_2 = BoundarySurfaces(Edges=merge_3)

polygon_2 = Polygon(Plane=list_item.Item1, Radius=number_slider_2, Segments="5", FilletRadius=0)  # -> Polygon, Length
deconstruct_brep_6 = DeconstructBrep(Brep=polygon_2.Polygon)  # -> Faces, Edges, Vertices
list_item_6 = ListItem(List=deconstruct_brep_6.Vertices, Index=0, Wrap=True)  # -> Item, Item1, Item2, Item3
unit_z_2 = UnitZ(Factor=1)
line_2 = Line(StartPoint=list_item_6.Item, EndPoint=list_item_6.Item1)
line_3 = Line(StartPoint=list_item_6.Item2, EndPoint=list_item_6.Item3)
construct_plane_2 = ConstructPlane(Origin=list_item_6.Item, XAxis=line_2, YAxis=unit_z_2)
construct_plane_3 = ConstructPlane(Origin=list_item_6.Item2, XAxis=line_3, YAxis=unit_z_2)
mirror_3 = Mirror(Geometry=deconstruct_brep_6.Faces, Plane=construct_plane_3)  # -> Geometry, Transform
mirror_4 = Mirror(Geometry=deconstruct_brep_6.Faces, Plane=construct_plane_2)  # -> Geometry, Transform

boundary_surfaces_3 = BoundarySurfaces(Edges=polygon_2.Polygon)

merge_4 = Merge(Data1=boundary_surfaces_3, Data2=mirror_4.Geometry, Data3=mirror_3.Geometry)
