# Grasshopper definition Wolfram_Geometry_HS_002_Animate.gh (Grasshopper 1.0.7)

number_slider = Slider(4, range=0..10)  # disabled
number_slider_2 = Slider(28, range=0..100)  # disabled
range = Range(Domain=number_slider_2, Steps=number_slider)  # disabled
construct_point = ConstructPoint(XCoordinate=0, YCoordinate=range, ZCoordinate=0)  # disabled
list_item = ListItem(List=construct_point, Index=0, Wrap=True)  # -> Item, Item1, Item2; disabled

# ----
# Wolfram meets Grasshopper
# Geometry 101
# Cube
number_slider_3 = Slider(1, range=0..1)  # disabled
number_slider_4 = Slider(1, range=1..3)  # disabled
rectangle = Rectangle(Plane=list_item.Item2, XSize=number_slider_3, YSize=number_slider_3, Radius=0)  # -> Rectangle, Length; disabled
deconstruct_brep = DeconstructBrep(Brep=rectangle.Rectangle)  # -> Faces, Edges, Vertices; disabled
shift_list = ShiftList(List=deconstruct_brep.Vertices, Shift=number_slider_4, Wrap=True)  # disabled
orient = Orient(Geometry=rectangle.Rectangle, Source=deconstruct_brep.Vertices, Target=shift_list)  # -> Geometry, Transform; disabled
list_item_2 = ListItem(List=orient.Geometry, Index=0, Wrap=True)  # disabled
deconstruct_brep_2 = DeconstructBrep(Brep=list_item_2)  # -> Faces, Edges, Vertices; disabled
list_item_3 = ListItem(List=deconstruct_brep_2.Vertices, Index=0, Wrap=True)  # -> Item, Item1, Item2, Item3; disabled
orient_2 = Orient(Geometry=list_item_2, Source=list_item_3.Item3, Target=list_item_3.Item2)  # -> Geometry, Transform; disabled
merge = Merge(Data1=rectangle.Rectangle, Data2=orient.Geometry, Data3=orient_2.Geometry)  # -> flatten(Result); disabled
boundary_surfaces = BoundarySurfaces(Edges=merge)  # disabled

# ----
# Dodecahedron
panel = Panel("5")  # disabled
polygon = Polygon(Plane=list_item.Item1, Radius=number_slider_3, Segments=panel, FilletRadius=0)  # -> Polygon, Length; disabled
deconstruct_brep_3 = DeconstructBrep(Brep=polygon.Polygon)  # -> Faces, Edges, Vertices; disabled
list_item_4 = ListItem(List=deconstruct_brep_3.Vertices, Index=0, Wrap=True)  # -> Item, Item1, Item2, Item3, Item4; disabled
unit_z = UnitZ(Factor=1)  # disabled
line = Line(StartPoint=list_item_4.Item, EndPoint=list_item_4.Item1)  # disabled
line_2 = Line(StartPoint=list_item_4.Item2, EndPoint=list_item_4.Item3)  # disabled
construct_plane = ConstructPlane(Origin=list_item_4.Item, XAxis=line, YAxis=unit_z)  # disabled
construct_plane_2 = ConstructPlane(Origin=list_item_4.Item2, XAxis=line_2, YAxis=unit_z)  # disabled
mirror = Mirror(Geometry=deconstruct_brep_3.Faces, Plane=construct_plane)  # -> Geometry, Transform; disabled
mirror_2 = Mirror(Geometry=deconstruct_brep_3.Faces, Plane=construct_plane_2)  # -> Geometry, Transform; disabled
boundary_surfaces_2 = BoundarySurfaces(Edges=polygon.Polygon)  # disabled
merge_2 = Merge(Data1=mirror.Geometry, Data2=mirror_2.Geometry, Data3=boundary_surfaces_2)  # disabled

polygon_2 = Polygon(Plane=list_item.Item, Radius=number_slider_3, Segments=panel, FilletRadius=0)  # -> Polygon, Length; disabled
deconstruct_brep_4 = DeconstructBrep(Brep=polygon_2.Polygon)  # -> Faces, Edges, Vertices; disabled
unit_z_2 = UnitZ(Factor=1)  # disabled
shift_list_2 = ShiftList(List=deconstruct_brep_4.Vertices, Shift=1, Wrap=True)  # disabled
line_3 = Line(StartPoint=deconstruct_brep_4.Vertices, EndPoint=shift_list_2)  # disabled
curve = Curve(deconstruct_brep_4.Edges)  # disabled
construct_plane_3 = ConstructPlane(Origin=deconstruct_brep_4.Vertices, XAxis=line_3, YAxis=unit_z_2)  # disabled
mirror_3 = Mirror(Geometry=polygon_2.Polygon, Plane=construct_plane_3)  # -> Geometry, Transform; disabled
yz_plane = YZPlane(Origin=Point(0, 0, 0))  # disabled
merge_3 = Merge(Data1=polygon_2.Polygon, Data2=mirror_3.Geometry)  # -> flatten(Result); disabled
mirror_4 = Mirror(Geometry=merge_3, Plane=yz_plane)  # -> Geometry, Transform; disabled
panel_2 = Panel("18")  # disabled
panel_3 = Panel("8")  # disabled
addition = Addition(A=panel_3, B=panel_2)  # disabled
deconstruct_brep_5 = DeconstructBrep(Brep=mirror_4.Geometry)  # -> Faces, Edges, Vertices; disabled
deconstruct_brep_6 = DeconstructBrep(Brep=merge_3)  # -> Faces, Edges, Vertices; disabled
list_item_5 = ListItem(List=flatten(deconstruct_brep_6.Vertices), Index=panel_3, Wrap=True)  # disabled
list_item_6 = ListItem(List=flatten(deconstruct_brep_5.Vertices), Index=addition, Wrap=True)  # disabled
orient_3 = Orient(Geometry=mirror_4.Geometry, Source=list_item_6, Target=list_item_5)  # -> Geometry, Transform; disabled
merge_4 = Merge(Data1=merge_3, Data2=orient_3.Geometry)  # -> flatten(Result); disabled
boundary_surfaces_3 = BoundarySurfaces(Edges=merge_4)  # disabled

# ----
# Cube Animated
number_slider_5 = Slider(1, range=0..1)
number_slider_6 = Slider(1, range=1..3)
rectangle_2 = Rectangle(Plane=PlaneXY(0, 0, 0), XSize=number_slider_5, YSize=number_slider_5, Radius=0)  # -> Rectangle, Length
deconstruct_brep_7 = DeconstructBrep(Brep=rectangle_2.Rectangle)  # -> Faces, Edges, Vertices
shift_list_3 = ShiftList(List=deconstruct_brep_7.Vertices, Shift=number_slider_6, Wrap=True)
shift_list_4 = ShiftList(List=deconstruct_brep_7.Edges, Shift=number_slider_6, Wrap=True)
orient_4 = Orient(Geometry=rectangle_2.Rectangle, Source=deconstruct_brep_7.Vertices, Target=shift_list_3)  # -> Geometry, Transform
geometry = Geometry(shift_list_4)
pi = Pi(Factor=Slider(0.32, range=0..0.5))
curve_middle = CurveMiddle(Curve=geometry)
negative = Negative(Value=pi)
list_item_7 = ListItem(List=orient_4.Geometry, Index=0, Wrap=True)  # -> Item, Item1, Item2, Item3
rotate_3d = Rotate3D(Geometry=graft(orient_4.Geometry), Angle=negative, Center=graft(curve_middle), Axis=graft(geometry))  # -> Geometry, Transform
deconstruct_brep_8 = DeconstructBrep(Brep=list_item_7.Item)  # -> Faces, Edges, Vertices
list_item_8 = ListItem(List=deconstruct_brep_8.Vertices, Index=0, Wrap=True)  # -> Item, Item1, Item2, Item3
orient_5 = Orient(Geometry=list_item_7.Item, Source=list_item_8.Item3, Target=list_item_8.Item2)  # -> Geometry, Transform
merge_5 = Merge(Data1=rectangle_2.Rectangle, Data2=orient_4.Geometry, Data3=orient_5.Geometry)  # -> flatten(Result)
boundary_surfaces_4 = BoundarySurfaces(Edges=merge_5)
