# Grasshopper definition Wolfram_Geometry_HS_002_LIVE.gh (Grasshopper 1.0.7)
# plug-ins: Bifocals

number_slider = Slider(2, range=0..10)  # disabled
number_slider_2 = Slider(13, range=0..100)  # disabled
range = Range(Domain=number_slider_2, Steps=number_slider)  # disabled
construct_point = ConstructPoint(XCoordinate=range, YCoordinate=0, ZCoordinate=0)  # disabled
list_item = ListItem(List=construct_point, Index=0, Wrap=True)  # -> Item, Item1, Item2; disabled

# ----
# WolframAlpha meets Grasshopper
# Geometry 101
# Cube
number_slider_3 = Slider(1, range=0..1)  # disabled
# Dodecahedron
number_slider_4 = Slider(1, range=1..3)  # disabled
rectangle = Rectangle(Plane=list_item.Item, XSize=number_slider_3, YSize=number_slider_3, Radius=0)  # -> Rectangle, Length; disabled
deconstruct_brep = DeconstructBrep(Brep=rectangle.Rectangle)  # -> Faces, Edges, Vertices; disabled
shift_list = ShiftList(List=deconstruct_brep.Vertices, Shift=number_slider_4, Wrap=True)  # disabled
orient = Orient(Geometry=rectangle.Rectangle, Source=deconstruct_brep.Vertices, Target=shift_list)  # -> Geometry, Transform; disabled
list_item_2 = ListItem(List=orient.Geometry, Index=0, Wrap=True)  # disabled
deconstruct_brep_2 = DeconstructBrep(Brep=list_item_2)  # -> Faces, Edges, Vertices; disabled
list_item_3 = ListItem(List=deconstruct_brep_2.Vertices, Index=0, Wrap=True)  # -> Item, Item1, Item2, Item3; disabled
orient_2 = Orient(Geometry=list_item_2, Source=list_item_3.Item3, Target=list_item_3.Item2)  # -> Geometry, Transform; disabled
merge = Merge(Data1=rectangle.Rectangle, Data2=orient.Geometry, Data3=orient_2.Geometry)  # disabled
boundary_surfaces = BoundarySurfaces(Edges=merge)  # disabled

panel = Panel("5")  # disabled
polygon = Polygon(Plane=list_item.Item2, Radius=number_slider_4, Segments=panel, FilletRadius=0)  # -> Polygon, Length; disabled
deconstruct_brep_3 = DeconstructBrep(Brep=polygon.Polygon)  # -> Faces, Edges, Vertices; disabled
shift_list_2 = ShiftList(List=deconstruct_brep_3.Vertices, Shift=1, Wrap=True)  # disabled
line = Line(StartPoint=deconstruct_brep_3.Vertices, EndPoint=shift_list_2)  # disabled
unit_z = UnitZ(Factor=1)  # disabled
construct_plane = ConstructPlane(Origin=deconstruct_brep_3.Vertices, XAxis=line, YAxis=unit_z)  # disabled
mirror = Mirror(Geometry=polygon.Polygon, Plane=construct_plane)  # -> Geometry, Transform; disabled
merge_2 = Merge(Data1=polygon.Polygon, Data2=mirror.Geometry)  # -> flatten(Result); disabled
yz_plane = YZPlane(Origin=Point(0, 0, 0))  # disabled
mirror_2 = Mirror(Geometry=merge_2, Plane=yz_plane)  # -> Geometry, Transform; disabled
panel_2 = Panel("18")  # disabled
panel_3 = Panel("8")  # disabled
deconstruct_brep_4 = DeconstructBrep(Brep=merge_2)  # -> Faces, Edges, Vertices; disabled
deconstruct_brep_5 = DeconstructBrep(Brep=mirror_2.Geometry)  # -> Faces, Edges, Vertices; disabled
addition = Addition(A=panel_3, B=panel_2)  # disabled
list_item_4 = ListItem(List=flatten(deconstruct_brep_4.Vertices), Index=panel_3, Wrap=True)  # disabled
list_item_5 = ListItem(List=flatten(deconstruct_brep_5.Vertices), Index=addition, Wrap=True)  # disabled
orient_3 = Orient(Geometry=mirror_2.Geometry, Source=list_item_5, Target=list_item_4)  # -> Geometry, Transform; disabled
merge_3 = Merge(Data1=merge_2, Data2=orient_3.Geometry)  # disabled
boundary_surfaces_2 = BoundarySurfaces(Edges=merge_3)  # disabled

# ----
# Cube Animated
number_slider_5 = Slider(1, range=0..1)
number_slider_6 = Slider(1, range=0..1)
rectangle_2 = Rectangle(Plane=PlaneXY(0, 0, 0), XSize=number_slider_5, YSize=number_slider_5, Radius=0)  # -> Rectangle, Length
trigger = Trigger(Interval=20, TimerInterval=20, Target=data_recorder)
deconstruct_brep_6 = DeconstructBrep(Brep=rectangle_2.Rectangle)  # -> Faces, Edges, Vertices
data_recorder = DataRecorder("1", DataLimit=10000, RecordData=True)
shift_list_3 = ShiftList(List=deconstruct_brep_6.Vertices, Shift=number_slider_6, Wrap=True)
shift_list_4 = ShiftList(List=deconstruct_brep_6.Edges, Shift=number_slider_6, Wrap=True)
curve = Curve(shift_list_4)
list_length = ListLength(List=data_recorder)
orient_4 = Orient(Geometry=rectangle_2.Rectangle, Source=deconstruct_brep_6.Vertices, Target=shift_list_3)  # -> Geometry, Transform
curve_middle = CurveMiddle(Curve=curve)
division = Division(A=list_length, B=Slider(26.45, range=0..100))
cosine = Cosine(Value=division)
sine = Sine(Value=division)
multiplication = Multiplication(A=Slider(0.5, range=0..0.5), B=cosine)
multiplication_2 = Multiplication(A=Slider(0.5, range=0..0.5), B=sine)
pi = Pi(Factor=multiplication)
pi_2 = Pi(Factor=multiplication_2)
negative = Negative(Value=pi_2)
rotate_3d = Rotate3D(Geometry=graft(orient_4.Geometry), Angle=negative, Center=graft(curve_middle), Axis=graft(curve))  # -> Geometry, Transform
list_item_6 = ListItem(List=rotate_3d.Geometry, Index=0, Wrap=True)  # -> Item, Item1, Item2, Item3
deconstruct_brep_7 = DeconstructBrep(Brep=list_item_6.Item)  # -> Faces, Edges, Vertices
list_item_7 = ListItem(List=deconstruct_brep_7.Vertices, Index=0, Wrap=True)  # -> Item, Item1, Item2, Item3
orient_5 = Orient(Geometry=list_item_6.Item, Source=list_item_7.Item2, Target=list_item_7.Item3)  # -> Geometry, Transform
list_item_8 = ListItem(List=flatten(orient_5.Geometry), Index=0, Wrap=True)  # -> Item, Item1, Item2, Item3
curve_2 = Curve(list_item_8.Item2)
explode = Explode(Curve=curve_2, Recursive=True)  # -> Segments, Vertices
list_item_9 = ListItem(List=flatten(explode.Segments), Index=number_slider_6, Wrap=True)
shift_list_5 = ShiftList(List=list_item_9, Shift=1, Wrap=True)
curve_3 = Curve(shift_list_5)
curve_middle_2 = CurveMiddle(Curve=curve_3)
rotate_3d_2 = Rotate3D(Geometry=graft(curve_2), Angle=pi, Center=graft(curve_middle_2), Axis=graft(curve_3))  # -> Geometry, Transform
merge_4 = Merge(Data1=rectangle_2.Rectangle, Data2=rotate_3d_2.Geometry, Data3=deconstruct_brep_7.Faces)
boundary_surfaces_3 = BoundarySurfaces(Edges=merge_4)

panel_4 = Panel("5")  # disabled
polygon_2 = Polygon(Plane=list_item.Item1, Radius=number_slider_4, Segments=panel_4, FilletRadius=0)  # -> Polygon, Length; disabled
deconstruct_brep_8 = DeconstructBrep(Brep=polygon_2.Polygon)  # -> Faces, Edges, Vertices; disabled
list_item_10 = ListItem(List=deconstruct_brep_8.Vertices, Index=0, Wrap=True)  # -> Item, Item1, Item2, Item3; disabled
unit_z_2 = UnitZ(Factor=1)  # disabled
line_2 = Line(StartPoint=list_item_10.Item, EndPoint=list_item_10.Item1)  # disabled
line_3 = Line(StartPoint=list_item_10.Item2, EndPoint=list_item_10.Item3)  # disabled
construct_plane_2 = ConstructPlane(Origin=list_item_10.Item, XAxis=line_2, YAxis=unit_z_2)  # disabled
construct_plane_3 = ConstructPlane(Origin=list_item_10.Item2, XAxis=line_3, YAxis=unit_z_2)  # disabled
mirror_3 = Mirror(Geometry=deconstruct_brep_8.Faces, Plane=construct_plane_3)  # -> Geometry, Transform; disabled
mirror_4 = Mirror(Geometry=deconstruct_brep_8.Faces, Plane=construct_plane_2)  # -> Geometry, Transform; disabled

boundary_surfaces_4 = BoundarySurfaces(Edges=polygon_2.Polygon)  # disabled

merge_5 = Merge(Data1=boundary_surfaces_4, Data2=mirror_4.Geometry, Data3=mirror_3.Geometry)  # disabled
