# Grasshopper definition Wolfram_Geometry_HS_003_Animate.gh (Grasshopper 1.0.7)
# plug-ins: Bifocals

number_slider = Slider(2, range=0..10)  # disabled
number_slider_2 = Slider(13, range=0..100)  # disabled
range = Range(Domain=number_slider_2, Steps=number_slider)  # disabled
construct_point = ConstructPoint(XCoordinate=range, YCoordinate=0, ZCoordinate=0)  # disabled
list_item = ListItem(List=construct_point, Index=0, Wrap=True)  # -> Item, Item1, Item2; disabled

# ----
# WolframAlpha meets Grasshopper
# Geometry 101
# Cube
number_slider_3 = Slider(1, range=0..1)  # disabled
# Dodecahedron
number_slider_4 = Slider(1, range=1..3)  # disabled
rectangle = Rectangle(Plane=list_item.Item, XSize=number_slider_3, YSize=number_slider_3, Radius=0)  # -> Rectangle, Length; disabled
deconstruct_brep = DeconstructBrep(Brep=rectangle.Rectangle)  # -> Faces, Edges, Vertices; disabled
shift_list = ShiftList(List=deconstruct_brep.Vertices, Shift=number_slider_4, Wrap=True)  # disabled
orient = Orient(Geometry=rectangle.Rectangle, Source=deconstruct_brep.Vertices, Target=shift_list)  # -> Geometry, Transform; disabled
list_item_2 = ListItem(List=orient.Geometry, Index=0, Wrap=True)  # disabled
deconstruct_brep_2 = DeconstructBrep(Brep=list_item_2)  # -> Faces, Edges, Vertices; disabled
list_item_3 = ListItem(List=deconstruct_brep_2.Vertices, Index=0, Wrap=True)  # -> Item, Item1, Item2, Item3; disabled
orient_2 = Orient(Geometry=list_item_2, Source=list_item_3.Item3, Target=list_item_3.Item2)  # -> Geometry, Transform; disabled
merge = Merge(Data1=rectangle.Rectangle, Data2=orient.Geometry, Data3=orient_2.Geometry)  # disabled
boundary_surfaces = BoundarySurfaces(Edges=merge)  # disabled

panel = Panel("5")  # disabled
polygon = Polygon(Plane=list_item.Item2, Radius=number_slider_4, Segments=panel, FilletRadius=0)  # -> Polygon, Length; disabled
deconstruct_brep_3 = DeconstructBrep(Brep=polygon.Polygon)  # -> Faces, Edges, Vertices; disabled
shift_list_2 = ShiftList(List=deconstruct_brep_3.Vertices, Shift=1, Wrap=True)  # disabled
line = Line(StartPoint=deconstruct_brep_3.Vertices, EndPoint=shift_list_2)  # disabled
unit_z = UnitZ(Factor=1)  # disabled
construct_plane = ConstructPlane(Origin=deconstruct_brep_3.Vertices, XAxis=line, YAxis=unit_z)  # disabled
mirror = Mirror(Geometry=polygon.Polygon, Plane=construct_plane)  # -> Geometry, Transform; disabled
merge_2 = Merge(Data1=polygon.Polygon, Data2=mirror.Geometry)  # -> flatten(Result); disabled
yz_plane = YZPlane(Origin=Point(0, 0, 0))  # disabled
mirror_2 = Mirror(Geometry=merge_2, Plane=yz_plane)  # -> Geometry, Transform; disabled
panel_2 = Panel("18")  # disabled
panel_3 = Panel("8")  # disabled
deconstruct_brep_4 = DeconstructBrep(Brep=merge_2)  # -> Faces, Edges, Vertices; disabled
deconstruct_brep_5 = DeconstructBrep(Brep=mirror_2.Geometry)  # -> Faces, Edges, Vertices; disabled
addition = Addition(A=panel_3, B=panel_2)  # disabled
list_item_4 = ListItem(List=flatten(deconstruct_brep_4.Vertices), Index=panel_3, Wrap=True)  # disabled
list_item_5 = ListItem(List=flatten(deconstruct_brep_5.Vertices), Index=addition, Wrap=True)  # disabled
orient_3 = Orient(Geometry=mirror_2.Geometry, Source=list_item_5, Target=list_item_4)  # -> Geometry, Transform; disabled
merge_3 = Merge(Data1=merge_2, Data2=orient_3.Geometry)  # disabled
boundary_surfaces_2 = BoundarySurfaces(Edges=merge_3)  # disabled

# ----
# Cube Animated
number_slider_5 = Slider(1, range=0..1)  # disabled
number_slider_6 = Slider(1, range=0..1)  # disabled
rectangle_2 = Rectangle(Plane=PlaneXY(0, 0, 0), XSize=number_slider_5, YSize=number_slider_5, Radius=0)  # -> Rectangle, Length; disabled
trigger = Trigger(Interval=20, TimerInterval=20, Target=data_recorder)  # disabled
deconstruct_brep_6 = DeconstructBrep(Brep=rectangle_2.Rectangle)  # -> Faces, Edges, Vertices; disabled
panel_4 = Panel("1")  # disabled
data_recorder = DataRecorder(panel_4, DataLimit=10000, RecordData=False)  # disabled
shift_list_3 = ShiftList(List=deconstruct_brep_6.Vertices, Shift=number_slider_6, Wrap=True)  # disabled
shift_list_4 = ShiftList(List=deconstruct_brep_6.Edges, Shift=number_slider_6, Wrap=True)  # disabled
number_slider_7 = Slider(26.45, range=0..100)  # disabled
curve = Curve(shift_list_4)  # disabled
list_length = ListLength(List=data_recorder)  # disabled
orient_4 = Orient(Geometry=rectangle_2.Rectangle, Source=deconstruct_brep_6.Vertices, Target=shift_list_3)  # -> Geometry, Transform; disabled
curve_middle = CurveMiddle(Curve=curve)  # disabled
number_slider_8 = Slider(0.5, range=0..0.5)  # disabled
number_slider_9 = Slider(0.5, range=0..0.5)  # disabled
division = Division(A=list_length, B=number_slider_7)  # disabled
cosine = Cosine(Value=division)  # disabled
sine = Sine(Value=division)  # disabled
multiplication = Multiplication(A=number_slider_8, B=cosine)  # disabled
multiplication_2 = Multiplication(A=number_slider_9, B=sine)  # disabled
pi = Pi(Factor=multiplication)  # disabled
pi_2 = Pi(Factor=multiplication_2)  # disabled
negative = Negative(Value=pi_2)  # disabled
rotate_3d = Rotate3D(Geometry=graft(orient_4.Geometry), Angle=negative, Center=graft(curve_middle), Axis=graft(curve))  # -> Geometry, Transform; disabled
list_item_6 = ListItem(List=rotate_3d.Geometry, Index=0, Wrap=True)  # -> Item, Item1, Item2, Item3; disabled
deconstruct_brep_7 = DeconstructBrep(Brep=list_item_6.Item)  # -> Faces, Edges, Vertices; disabled
list_item_7 = ListItem(List=deconstruct_brep_7.Vertices, Index=0, Wrap=True)  # -> Item, Item1, Item2, Item3; disabled
orient_5 = Orient(Geometry=list_item_6.Item, Source=list_item_7.Item2, Target=list_item_7.Item3)  # -> Geometry, Transform; disabled
list_item_8 = ListItem(List=flatten(orient_5.Geometry), Index=0, Wrap=True)  # -> Item, Item1, Item2, Item3; disabled
curve_2 = Curve(list_item_8.Item2)  # disabled
explode = Explode(Curve=curve_2, Recursive=True)  # -> Segments, Vertices; disabled
list_item_9 = ListItem(List=flatten(explode.Segments), Index=number_slider_6, Wrap=True)  # disabled
shift_list_5 = ShiftList(List=list_item_9, Shift=1, Wrap=True)  # disabled
curve_3 = Curve(shift_list_5)  # disabled
curve_middle_2 = CurveMiddle(Curve=curve_3)  # disabled
rotate_3d_2 = Rotate3D(Geometry=graft(curve_2), Angle=pi, Center=graft(curve_middle_2), Axis=graft(curve_3))  # -> Geometry, Transform; disabled
merge_4 = Merge(Data1=rectangle_2.Rectangle, Data2=rotate_3d_2.Geometry, Data3=deconstruct_brep_7.Faces)  # disabled
boundary_surfaces_3 = BoundarySurfaces(Edges=merge_4)  # disabled

# ----
# Dodecahedron Animated
number_slider_10 = Slider(1, range=0..1)
polygon_2 = Polygon(Plane=PlaneXY(0, 0, 0), Radius=number_slider_10, Segments="5", FilletRadius=0)  # -> Polygon, Length
deconstruct_brep_8 = DeconstructBrep(Brep=polygon_2.Polygon)  # -> Faces, Edges, Vertices
shift_list_6 = ShiftList(List=deconstruct_brep_8.Vertices, Shift=1, Wrap=True)

panel_5 = Panel("arccos15–√≈63∘26′06′′≈1.107148718radians")
acos_1_sqrt_5 = GhPythonScript()  # -> out, a
# ---------- acos_1_sqrt_5: Python ----------
import math

a = math.acos(1/math.sqrt(5))
# ---------- end acos_1_sqrt_5 ----------
panel_6 = Panel(acos_1_sqrt_5.a)

line_2 = Line(StartPoint=deconstruct_brep_8.Vertices, EndPoint=shift_list_6)
unit_z_2 = UnitZ(Factor=1)
curve_middle_3 = CurveMiddle(Curve=line_2)
construct_plane_2 = ConstructPlane(Origin=deconstruct_brep_8.Vertices, XAxis=line_2, YAxis=unit_z_2)
negative_2 = Negative(Value="1.107148718")
mirror_3 = Mirror(Geometry=polygon_2.Polygon, Plane=construct_plane_2)  # -> Geometry, Transform
rotate_3d_3 = Rotate3D(Geometry=graft(mirror_3.Geometry), Angle=negative_2, Center=graft(curve_middle_3), Axis=graft(line_2))  # -> Geometry, Transform
deconstruct_brep_9 = DeconstructBrep(Brep=rotate_3d_3.Geometry)  # -> Faces, Edges, Vertices
merge_5 = Merge(Data1=polygon_2.Polygon, Data2=mirror_3.Geometry)  # -> flatten(Result)
yz_plane_2 = YZPlane(Origin=Point(0, 0, 0))
list_item_10 = ListItem(List=flatten(deconstruct_brep_9.Edges), Index="3", Wrap=True)
mirror_4 = Mirror(Geometry=merge_5, Plane=yz_plane_2)  # -> Geometry, Transform
curve_middle_4 = CurveMiddle(Curve=list_item_10)
construct_plane_3 = ConstructPlane(Origin=curve_middle_4, XAxis=Vector(1, 0, 0), YAxis=list_item_10)
deconstruct_brep_10 = DeconstructBrep(Brep=merge_5)  # -> Faces, Edges, Vertices
deconstruct_brep_11 = DeconstructBrep(Brep=mirror_4.Geometry)  # -> Faces, Edges, Vertices
addition_2 = Addition(A="8", B="18")
align_plane = AlignPlane(Plane=construct_plane_3, Direction=list_item_10)  # -> Plane, Angle
list_item_11 = ListItem(List=flatten(deconstruct_brep_10.Vertices), Index="8", Wrap=True)
list_item_12 = ListItem(List=flatten(deconstruct_brep_11.Vertices), Index=addition_2, Wrap=True)
orient_6 = Orient(Geometry=mirror_4.Geometry, Source=list_item_12, Target=list_item_11)  # -> Geometry, Transform
deconstruct_brep_12 = DeconstructBrep(Brep=orient_6.Geometry)  # -> Faces, Edges, Vertices
list_item_13 = ListItem(List=flatten(deconstruct_brep_12.Edges), Index=Slider(20, range=0..100), Wrap=True)
curve_middle_5 = CurveMiddle(Curve=list_item_13)
construct_plane_4 = ConstructPlane(Origin=curve_middle_5, XAxis=list_item_13, YAxis=Vector(0, 1, 0))
orient_7 = Orient(Geometry=orient_6.Geometry, Source=construct_plane_4, Target=align_plane.Plane)  # -> Geometry, Transform
rotate_3d_4 = Rotate3D(Geometry=graft(orient_7.Geometry), Angle=negative_2, Center=graft(construct_plane_3), Axis=graft(list_item_10))  # -> Geometry, Transform
list_item_14 = ListItem(List=flatten(rotate_3d_4.Geometry), Index=0, Wrap=True)  # -> Item, Item1, Item2, Item3, Item4, Item5
negative_3 = Negative(Value=negative_2)
curve_4 = Curve(list_item_14.Item)
explode_2 = Explode(Curve=curve_4, Recursive=True)  # -> Segments, Vertices
curve_5 = Curve([list_item_14.Item1, list_item_14.Item2, list_item_14.Item3, list_item_14.Item4, list_item_14.Item5])
merge_6 = Merge(Data1=rotate_3d_3.Geometry, Data2=orient_6.Geometry)
rotate_3d_5 = Rotate3D(Geometry=graft(curve_5), Angle=negative_3, Center=graft(explode_2.Vertices), Axis=graft(explode_2.Segments))  # -> Geometry, Transform
boundary_surfaces_4 = BoundarySurfaces(Edges=merge_6)

panel_7 = Panel("5")  # disabled
polygon_3 = Polygon(Plane=list_item.Item1, Radius=number_slider_4, Segments=panel_7, FilletRadius=0)  # -> Polygon, Length; disabled
deconstruct_brep_13 = DeconstructBrep(Brep=polygon_3.Polygon)  # -> Faces, Edges, Vertices; disabled
list_item_15 = ListItem(List=deconstruct_brep_13.Vertices, Index=0, Wrap=True)  # -> Item, Item1, Item2, Item3; disabled
unit_z_3 = UnitZ(Factor=1)  # disabled
line_3 = Line(StartPoint=list_item_15.Item, EndPoint=list_item_15.Item1)  # disabled
line_4 = Line(StartPoint=list_item_15.Item2, EndPoint=list_item_15.Item3)  # disabled
construct_plane_5 = ConstructPlane(Origin=list_item_15.Item, XAxis=line_3, YAxis=unit_z_3)  # disabled
construct_plane_6 = ConstructPlane(Origin=list_item_15.Item2, XAxis=line_4, YAxis=unit_z_3)  # disabled
mirror_5 = Mirror(Geometry=deconstruct_brep_13.Faces, Plane=construct_plane_6)  # -> Geometry, Transform; disabled
mirror_6 = Mirror(Geometry=deconstruct_brep_13.Faces, Plane=construct_plane_5)  # -> Geometry, Transform; disabled

boundary_surfaces_5 = BoundarySurfaces(Edges=polygon_3.Polygon)  # disabled

merge_7 = Merge(Data1=boundary_surfaces_5, Data2=mirror_6.Geometry, Data3=mirror_5.Geometry)  # disabled
