# Grasshopper definition Wolfram_Geometry_HS_003_Animateb.gh (Grasshopper 1.0.7)
# plug-ins: Bifocals

range = Range(Domain=Slider(13, range=0..100), Steps=Slider(2, range=0..10))
construct_point = ConstructPoint(XCoordinate=range, YCoordinate=0, ZCoordinate=0)
list_item = ListItem(List=construct_point, Index=0, Wrap=True)  # -> Item, Item1, Item2

# ----
# WolframAlpha meets Grasshopper
# Geometry 101
# Cube
number_slider = Slider(1, range=0..1)
# Dodecahedron
number_slider_2 = Slider(1, range=1..3)
rectangle = Rectangle(Plane=list_item.Item, XSize=number_slider, YSize=number_slider, Radius=0)  # -> Rectangle, Length
deconstruct_brep = DeconstructBrep(Brep=rectangle.Rectangle)  # -> Faces, Edges, Vertices
shift_list = ShiftList(List=deconstruct_brep.Vertices, Shift=number_slider_2, Wrap=True)
orient = Orient(Geometry=rectangle.Rectangle, Source=deconstruct_brep.Vertices, Target=shift_list)  # -> Geometry, Transform
list_item_2 = ListItem(List=orient.Geometry, Index=0, Wrap=True)
deconstruct_brep_2 = DeconstructBrep(Brep=list_item_2)  # -> Faces, Edges, Vertices
list_item_3 = ListItem(List=deconstruct_brep_2.Vertices, Index=0, Wrap=True)  # -> Item, Item1, Item2, Item3
orient_2 = Orient(Geometry=list_item_2, Source=list_item_3.Item3, Target=list_item_3.Item2)  # -> Geometry, Transform
merge = Merge(Data1=rectangle.Rectangle, Data2=orient.Geometry, Data3=orient_2.Geometry)
boundary_surfaces = BoundarySurfaces(Edges=merge)

polygon = Polygon(Plane=list_item.Item2, Radius=number_slider_2, Segments="5", FilletRadius=0)  # -> Polygon, Length
deconstruct_brep_3 = DeconstructBrep(Brep=polygon.Polygon)  # -> Faces, Edges, Vertices
shift_list_2 = ShiftList(List=deconstruct_brep_3.Vertices, Shift=1, Wrap=True)
line = Line(StartPoint=deconstruct_brep_3.Vertices, EndPoint=shift_list_2)
unit_z = UnitZ(Factor=1)
construct_plane = ConstructPlane(Origin=deconstruct_brep_3.Vertices, XAxis=line, YAxis=unit_z)
mirror = Mirror(Geometry=polygon.Polygon, Plane=construct_plane)  # -> Geometry, Transform
merge_2 = Merge(Data1=polygon.Polygon, Data2=mirror.Geometry)  # -> flatten(Result)
yz_plane = YZPlane(Origin=Point(0, 0, 0))
mirror_2 = Mirror(Geometry=merge_2, Plane=yz_plane)  # -> Geometry, Transform
deconstruct_brep_4 = DeconstructBrep(Brep=merge_2)  # -> Faces, Edges, Vertices
deconstruct_brep_5 = DeconstructBrep(Brep=mirror_2.Geometry)  # -> Faces, Edges, Vertices
addition = Addition(A="8", B="18")
list_item_4 = ListItem(List=flatten(deconstruct_brep_4.Vertices), Index="8", Wrap=True)
list_item_5 = ListItem(List=flatten(deconstruct_brep_5.Vertices), Index=addition, Wrap=True)
orient_3 = Orient(Geometry=mirror_2.Geometry, Source=list_item_5, Target=list_item_4)  # -> Geometry, Transform
merge_3 = Merge(Data1=merge_2, Data2=orient_3.Geometry)
boundary_surfaces_2 = BoundarySurfaces(Edges=merge_3)

# ----
# Dodecahedron Animated
number_slider_3 = Slider(1, range=0..1)
trigger = Trigger(Interval=20, TimerInterval=20, Target=data_recorder_2)

# ----
# Cube Animated
number_slider_4 = Slider(1, range=0..1)  # disabled
number_slider_5 = Slider(1, range=0..1)  # disabled
rectangle_2 = Rectangle(Plane=PlaneXY(0, 0, 0), XSize=number_slider_4, YSize=number_slider_4, Radius=0)  # -> Rectangle, Length; disabled
trigger_2 = Trigger(Interval=20, TimerInterval=20, Target=data_recorder)  # disabled
deconstruct_brep_6 = DeconstructBrep(Brep=rectangle_2.Rectangle)  # -> Faces, Edges, Vertices; disabled
panel = Panel("1")  # disabled
data_recorder = DataRecorder(panel, DataLimit=10000, RecordData=False)  # disabled
shift_list_3 = ShiftList(List=deconstruct_brep_6.Vertices, Shift=number_slider_5, Wrap=True)  # disabled
shift_list_4 = ShiftList(List=deconstruct_brep_6.Edges, Shift=number_slider_5, Wrap=True)  # disabled
number_slider_6 = Slider(26.45, range=0..100)  # disabled
curve = Curve(shift_list_4)  # disabled
list_length = ListLength(List=data_recorder)  # disabled
orient_4 = Orient(Geometry=rectangle_2.Rectangle, Source=deconstruct_brep_6.Vertices, Target=shift_list_3)  # -> Geometry, Transform; disabled
curve_middle = CurveMiddle(Curve=curve)  # disabled
number_slider_7 = Slider(0.5, range=0..0.5)  # disabled
number_slider_8 = Slider(0.5, range=0..0.5)  # disabled
division = Division(A=list_length, B=number_slider_6)  # disabled
cosine = Cosine(Value=division)  # disabled
sine = Sine(Value=division)  # disabled
multiplication = Multiplication(A=number_slider_7, B=cosine)  # disabled
multiplication_2 = Multiplication(A=number_slider_8, B=sine)  # disabled
pi = Pi(Factor=multiplication)  # disabled
pi_2 = Pi(Factor=multiplication_2)  # disabled
negative = Negative(Value=pi_2)  # disabled
rotate_3d = Rotate3D(Geometry=graft(orient_4.Geometry), Angle=negative, Center=graft(curve_middle), Axis=graft(curve))  # -> Geometry, Transform; disabled
list_item_6 = ListItem(List=rotate_3d.Geometry, Index=0, Wrap=True)  # -> Item, Item1, Item2, Item3; disabled
deconstruct_brep_7 = DeconstructBrep(Brep=list_item_6.Item)  # -> Faces, Edges, Vertices; disabled
list_item_7 = ListItem(List=deconstruct_brep_7.Vertices, Index=0, Wrap=True)  # -> Item, Item1, Item2, Item3; disabled
orient_5 = Orient(Geometry=list_item_6.Item, Source=list_item_7.Item2, Target=list_item_7.Item3)  # -> Geometry, Transform; disabled
list_item_8 = ListItem(List=flatten(orient_5.Geometry), Index=0, Wrap=True)  # -> Item, Item1, Item2, Item3; disabled
curve_2 = Curve(list_item_8.Item2)  # disabled
explode = Explode(Curve=curve_2, Recursive=True)  # -> Segments, Vertices; disabled
list_item_9 = ListItem(List=flatten(explode.Segments), Index=number_slider_5, Wrap=True)  # disabled
shift_list_5 = ShiftList(List=list_item_9, Shift=1, Wrap=True)  # disabled
curve_3 = Curve(shift_list_5)  # disabled
curve_middle_2 = CurveMiddle(Curve=curve_3)  # disabled
rotate_3d_2 = Rotate3D(Geometry=graft(curve_2), Angle=pi, Center=graft(curve_middle_2), Axis=graft(curve_3))  # -> Geometry, Transform; disabled
merge_4 = Merge(Data1=rectangle_2.Rectangle, Data2=rotate_3d_2.Geometry, Data3=deconstruct_brep_7.Faces)  # disabled
boundary_surfaces_3 = BoundarySurfaces(Edges=merge_4)  # disabled

data_recorder_2 = DataRecorder("1", DataLimit=10000, RecordData=True)
polygon_2 = Polygon(Plane=PlaneXY(0, 0, 0), Radius=number_slider_3, Segments="5", FilletRadius=0)  # -> Polygon, Length
list_length_2 = ListLength(List=data_recorder_2)
division_2 = Division(A=list_length_2, B=Slider(27.858, range=0..100))

panel_2 = Panel("arccos15–√≈63∘26′06′′≈1.107148718radians")
acos_1_sqrt_5 = GhPythonScript()  # -> out, a
# ---------- acos_1_sqrt_5: Python ----------
import math

a = math.acos(1/math.sqrt(5))
# ---------- end acos_1_sqrt_5 ----------
panel_3 = Panel(acos_1_sqrt_5.a)

deconstruct_brep_8 = DeconstructBrep(Brep=polygon_2.Polygon)  # -> Faces, Edges, Vertices
cosine_2 = Cosine(Value=division_2)
sine_2 = Sine(Value=division_2)
number_slider_9 = Slider(1.11, range=0..1.11)
shift_list_6 = ShiftList(List=deconstruct_brep_8.Vertices, Shift=1, Wrap=True)
absolute = Absolute(Value=cosine_2)
absolute_2 = Absolute(Value=sine_2)
line_2 = Line(StartPoint=deconstruct_brep_8.Vertices, EndPoint=shift_list_6)
curve_middle_3 = CurveMiddle(Curve=line_2)
unit_z_2 = UnitZ(Factor=1)
multiplication_3 = Multiplication(A="1.107148718", B=absolute_2)
multiplication_4 = Multiplication(A="1.107148718", B=absolute_2)
negative_2 = Negative(Value=multiplication_3)
multiplication_5 = Multiplication(A=multiplication_4, B=absolute)
negative_3 = Negative(Value=multiplication_3)
construct_plane_2 = ConstructPlane(Origin=deconstruct_brep_8.Vertices, XAxis=line_2, YAxis=unit_z_2)
addition_2 = Addition(A=multiplication_4, B=multiplication_5)
panel_4 = Panel(addition_2)
mirror_3 = Mirror(Geometry=polygon_2.Polygon, Plane=construct_plane_2)  # -> Geometry, Transform
rotate_3d_3 = Rotate3D(Geometry=graft(mirror_3.Geometry), Angle=negative_2, Center=graft(curve_middle_3), Axis=graft(line_2))  # -> Geometry, Transform
deconstruct_brep_9 = DeconstructBrep(Brep=rotate_3d_3.Geometry)  # -> Faces, Edges, Vertices
merge_5 = Merge(Data1=polygon_2.Polygon, Data2=mirror_3.Geometry)  # -> flatten(Result)
yz_plane_2 = YZPlane(Origin=Point(0, 0, 0))
mirror_4 = Mirror(Geometry=merge_5, Plane=yz_plane_2)  # -> Geometry, Transform
deconstruct_brep_10 = DeconstructBrep(Brep=merge_5)  # -> Faces, Edges, Vertices
deconstruct_brep_11 = DeconstructBrep(Brep=mirror_4.Geometry)  # -> Faces, Edges, Vertices
list_item_10 = ListItem(List=flatten(deconstruct_brep_9.Edges), Index="3", Wrap=True)
addition_3 = Addition(A="8", B="18")
list_item_11 = ListItem(List=flatten(deconstruct_brep_10.Vertices), Index="8", Wrap=True)
list_item_12 = ListItem(List=flatten(deconstruct_brep_11.Vertices), Index=addition_3, Wrap=True)
curve_middle_4 = CurveMiddle(Curve=list_item_10)
orient_6 = Orient(Geometry=mirror_4.Geometry, Source=list_item_12, Target=list_item_11)  # -> Geometry, Transform
construct_plane_3 = ConstructPlane(Origin=curve_middle_4, XAxis=Vector(1, 0, 0), YAxis=list_item_10)
list_item_13 = ListItem(List=orient_6.Geometry, Index=0, Wrap=True)
deconstruct_brep_12 = DeconstructBrep(Brep=list_item_13)  # -> Faces, Edges, Vertices
shift_list_7 = ShiftList(List=deconstruct_brep_12.Vertices, Shift=1, Wrap=True)
line_3 = Line(StartPoint=deconstruct_brep_12.Vertices, EndPoint=shift_list_7)
unit_z_3 = UnitZ(Factor=1)
curve_middle_5 = CurveMiddle(Curve=line_3)
align_plane = AlignPlane(Plane=construct_plane_3, Direction=list_item_10)  # -> Plane, Angle
construct_plane_4 = ConstructPlane(Origin=deconstruct_brep_12.Vertices, XAxis=line_3, YAxis=unit_z_3)
unit_z_4 = UnitZ(Factor=1)
negative_4 = Negative(Value=negative_3)
mirror_5 = Mirror(Geometry=list_item_13, Plane=construct_plane_4)  # -> Geometry, Transform
negative_5 = Negative(Value=negative_3)
pi_3 = Pi(Factor=panel_4)
deconstruct_plane = DeconstructPlane(Plane=align_plane.Plane)  # -> Origin, XAxis, YAxis, ZAxis
rotate_3d_4 = Rotate3D(Geometry=graft(mirror_5.Geometry), Angle=negative_4, Center=graft(curve_middle_5), Axis=graft(line_3))  # -> Geometry, Transform
deconstruct_brep_13 = DeconstructBrep(Brep=rotate_3d_4.Geometry)  # -> Faces, Edges, Vertices
list_item_14 = ListItem(List=flatten(deconstruct_brep_13.Edges), Index=Slider(21, range=0..100), Wrap=True)
curve_middle_6 = CurveMiddle(Curve=list_item_14)
construct_plane_5 = ConstructPlane(Origin=curve_middle_6, XAxis=list_item_14, YAxis=align_plane.Plane)
orient_7 = Orient(Geometry=deconstruct_brep_13.Edges, Source=construct_plane_5, Target=align_plane.Plane)  # -> Geometry, Transform
rotate_3d_5 = Rotate3D(Geometry=orient_7.Geometry, Angle=pi_3, Center=deconstruct_plane.Origin, Axis=deconstruct_plane.XAxis)  # -> Geometry, Transform
merge_6 = Merge(Data1=rotate_3d_5.Geometry, Data2=deconstruct_brep_9.Edges, Data3=polygon_2.Polygon)
boundary_surfaces_4 = BoundarySurfaces(Edges=merge_6)  # -> flatten(Surfaces)
list_item_15 = ListItem(List=flatten(deconstruct_brep_9.Edges), Index=Slider(3, range=0..10), Wrap=True)
list_item_16 = ListItem(List=boundary_surfaces_4, Index=Slider(9, range=0..10), Wrap=True)
list_item_17 = ListItem(List=boundary_surfaces_4, Index=Slider(2, range=0..10), Wrap=True)
deconstruct_brep_14 = DeconstructBrep(Brep=list_item_16)  # -> Faces, Edges, Vertices
deconstruct_brep_15 = DeconstructBrep(Brep=list_item_17)  # -> Faces, Edges, Vertices
curve_4 = Curve(list_item_15)
curve_middle_7 = CurveMiddle(Curve=curve_4)
list_item_18 = ListItem(List=deconstruct_brep_14.Vertices, Index=Slider(5, range=0..10), Wrap=True)
list_item_19 = ListItem(List=deconstruct_brep_15.Vertices, Index=Slider(6, range=0..10), Wrap=True)
point = Point(list_item_18)
point_2 = Point(list_item_19)
line_4 = Line(StartPoint=curve_middle_7, EndPoint=point_2)
vector_2pt = Vector2Pt(PointA=curve_middle_7, PointB=point, Unitize=False)  # -> Vector, Length
vector_2pt_2 = Vector2Pt(PointA=curve_middle_7, PointB=point_2, Unitize=False)  # -> Vector, Length
line_5 = Line(StartPoint=curve_middle_7, EndPoint=point)
angle = Angle(VectorA=vector_2pt.Vector, VectorB=vector_2pt_2.Vector)  # -> Angle, Reflex
panel_5 = Panel(angle.Angle)

polygon_3 = Polygon(Plane=list_item.Item1, Radius=number_slider_2, Segments="5", FilletRadius=0)  # -> Polygon, Length
deconstruct_brep_16 = DeconstructBrep(Brep=polygon_3.Polygon)  # -> Faces, Edges, Vertices
list_item_20 = ListItem(List=deconstruct_brep_16.Vertices, Index=0, Wrap=True)  # -> Item, Item1, Item2, Item3
unit_z_5 = UnitZ(Factor=1)
line_6 = Line(StartPoint=list_item_20.Item, EndPoint=list_item_20.Item1)
line_7 = Line(StartPoint=list_item_20.Item2, EndPoint=list_item_20.Item3)
construct_plane_6 = ConstructPlane(Origin=list_item_20.Item, XAxis=line_6, YAxis=unit_z_5)
construct_plane_7 = ConstructPlane(Origin=list_item_20.Item2, XAxis=line_7, YAxis=unit_z_5)
mirror_6 = Mirror(Geometry=deconstruct_brep_16.Faces, Plane=construct_plane_7)  # -> Geometry, Transform
mirror_7 = Mirror(Geometry=deconstruct_brep_16.Faces, Plane=construct_plane_6)  # -> Geometry, Transform

boundary_surfaces_5 = BoundarySurfaces(Edges=polygon_3.Polygon)

merge_7 = Merge(Data1=boundary_surfaces_5, Data2=mirror_7.Geometry, Data3=mirror_6.Geometry)
