# Grasshopper definition Wolfram_Geometry_HS_003_Animateb_LIVE.gh (Grasshopper 1.0.7)
# plug-ins: Bifocals

trigger = Trigger(Interval=20, TimerInterval=20, Target=data_recorder)
data_recorder = DataRecorder("1", DataLimit=10000, RecordData=True)
list_length = ListLength(List=data_recorder)
division = Division(A=list_length, B=Slider(64.424, range=0..100))
cosine = Cosine(Value=division)
sine = Sine(Value=division)
absolute = Absolute(Value=cosine)
absolute_2 = Absolute(Value=sine)
multiplication = Multiplication(B=absolute_2)
multiplication_2 = Multiplication(B=absolute_2)
multiplication_3 = Multiplication(A=multiplication_2, B=absolute)
addition = Addition(A=multiplication_2, B=multiplication_3)
panel = Panel(addition)

# ----
# Dodecahedron Animated
number_slider = Slider(1, range=0..1)
polygon = Polygon(Plane=PlaneXY(0, 0, 0), Radius=number_slider, Segments="5", FilletRadius=0)  # -> Polygon, Length
deconstruct_brep = DeconstructBrep(Brep=polygon.Polygon)  # -> Faces, Edges, Vertices
shift_list = ShiftList(List=deconstruct_brep.Vertices, Shift=1, Wrap=True)
line = Line(StartPoint=deconstruct_brep.Vertices, EndPoint=shift_list)
unit_z = UnitZ(Factor=1)
curve_middle = CurveMiddle(Curve=line)
construct_plane = ConstructPlane(Origin=deconstruct_brep.Vertices, XAxis=line, YAxis=unit_z)
mirror = Mirror(Geometry=polygon.Polygon, Plane=construct_plane)  # -> Geometry, Transform
negative = Negative(Value=multiplication)
rotate_3d = Rotate3D(Geometry=graft(mirror.Geometry), Angle=negative, Center=graft(curve_middle), Axis=graft(line))  # -> Geometry, Transform

panel_2 = Panel("arccos15–√≈63∘26′06′′≈1.107148718radians")
arccos_1_sqrt_5 = GhPythonScript()  # -> out, a
# ---------- arccos_1_sqrt_5: Python ----------
import math

a = math.acos(1/math.sqrt(5))
# ---------- end arccos_1_sqrt_5 ----------
number_slider_2 = Slider(1.11, range=0..2)
number_slider_3 = Slider(0, range=0..1.107149)
panel_3 = Panel(arccos_1_sqrt_5.a)
panel_4 = Panel("1.107148718")

number_slider_4 = Slider(0.5, range=0.5..1.5)

merge = Merge(Data1=rotate_3d.Geometry, Data2=polygon.Polygon)  # -> flatten(Result)
yz_plane = YZPlane(Origin=Point(0, 0, 0))
mirror_2 = Mirror(Geometry=merge, Plane=yz_plane)  # -> Geometry, Transform
deconstruct_brep_2 = DeconstructBrep(Brep=merge)  # -> Faces, Edges, flatten(Vertices)
deconstruct_brep_3 = DeconstructBrep(Brep=mirror_2.Geometry)  # -> Faces, Edges, flatten(Vertices)
addition_2 = Addition(A="8", B="18")
list_item = ListItem(List=deconstruct_brep_2.Vertices, Index="8", Wrap=True)
list_item_2 = ListItem(List=deconstruct_brep_3.Vertices, Index=addition_2, Wrap=True)
orient = Orient(Geometry=mirror_2.Geometry, Source=list_item_2, Target=list_item)  # -> Geometry, Transform
list_item_3 = ListItem(List=orient.Geometry, Index=0, Wrap=True)
deconstruct_brep_4 = DeconstructBrep(Brep=list_item_3)  # -> Faces, Edges, Vertices
shift_list_2 = ShiftList(List=deconstruct_brep_4.Vertices, Shift=1, Wrap=True)
unit_z_2 = UnitZ(Factor=1)
line_2 = Line(StartPoint=deconstruct_brep_4.Vertices, EndPoint=shift_list_2)
curve_middle_2 = CurveMiddle(Curve=line_2)
construct_plane_2 = ConstructPlane(Origin=deconstruct_brep_4.Vertices, XAxis=line_2, YAxis=unit_z_2)
mirror_3 = Mirror(Geometry=list_item_3, Plane=construct_plane_2)  # -> Geometry, Transform
rotate_3d_2 = Rotate3D(Geometry=graft(mirror_3.Geometry), Angle=multiplication, Center=graft(curve_middle_2), Axis=graft(line_2))  # -> Geometry, Transform

deconstruct_brep_5 = DeconstructBrep(Brep=rotate_3d.Geometry)  # -> Faces, Edges, Vertices
list_item_4 = ListItem(List=flatten(deconstruct_brep_5.Edges), Index="3", Wrap=True)
curve_middle_3 = CurveMiddle(Curve=list_item_4)
construct_plane_3 = ConstructPlane(Origin=curve_middle_3, XAxis=Vector(1, 0, 0), YAxis=list_item_4)
align_plane = AlignPlane(Plane=construct_plane_3, Direction=list_item_4)  # -> Plane, Angle
deconstruct_brep_6 = DeconstructBrep(Brep=rotate_3d_2.Geometry)  # -> Faces, Edges, Vertices
list_item_5 = ListItem(List=flatten(deconstruct_brep_6.Edges), Index="21", Wrap=True)
curve_middle_4 = CurveMiddle(Curve=list_item_5)
construct_plane_4 = ConstructPlane(Origin=curve_middle_4, XAxis=list_item_5, YAxis=align_plane.Plane)
pi = Pi(Factor=panel)
deconstruct_plane = DeconstructPlane(Plane=align_plane.Plane)  # -> Origin, XAxis, YAxis, ZAxis
orient_2 = Orient(Geometry=deconstruct_brep_6.Edges, Source=construct_plane_4, Target=align_plane.Plane)  # -> Geometry, Transform
rotate_3d_3 = Rotate3D(Geometry=orient_2.Geometry, Angle=pi, Center=deconstruct_plane.Origin, Axis=deconstruct_plane.XAxis)  # -> Geometry, Transform
merge_2 = Merge(Data1=rotate_3d_3.Geometry, Data2=deconstruct_brep_5.Edges)
boundary_surfaces = BoundarySurfaces(Edges=merge_2)  # -> flatten(Surfaces)

list_item_6 = ListItem(List=flatten(deconstruct_brep_5.Edges), Index=Slider(3, range=0..10), Wrap=True)
list_item_7 = ListItem(List=boundary_surfaces, Index=Slider(8, range=0..10), Wrap=True)
list_item_8 = ListItem(List=boundary_surfaces, Index=Slider(3, range=0..10), Wrap=True)
deconstruct_brep_7 = DeconstructBrep(Brep=list_item_7)  # -> Faces, Edges, Vertices
deconstruct_brep_8 = DeconstructBrep(Brep=list_item_8)  # -> Faces, Edges, Vertices
curve = Curve(list_item_6)
curve_middle_5 = CurveMiddle(Curve=curve)
list_item_9 = ListItem(List=deconstruct_brep_7.Vertices, Index=Slider(5, range=0..10), Wrap=True)
list_item_10 = ListItem(List=deconstruct_brep_8.Vertices, Index=Slider(6, range=0..10), Wrap=True)
point = Point(list_item_9)
point_2 = Point(list_item_10)
line_3 = Line(StartPoint=curve_middle_5, EndPoint=point_2)
vector_2pt = Vector2Pt(PointA=curve_middle_5, PointB=point, Unitize=False)  # -> Vector, Length
vector_2pt_2 = Vector2Pt(PointA=curve_middle_5, PointB=point_2, Unitize=False)  # -> Vector, Length
line_4 = Line(StartPoint=curve_middle_5, EndPoint=point)
angle = Angle(VectorA=vector_2pt.Vector, VectorB=vector_2pt_2.Vector)  # -> Angle, Reflex
vector_display = VectorDisplay(Anchor=curve_middle_5, Vector=vector_2pt_2.Vector)
vector_display_2 = VectorDisplay(Anchor=curve_middle_5, Vector=vector_2pt.Vector)
degrees = Degrees(Radians=angle.Angle)
panel_5 = Panel([angle.Angle, degrees])
