# Grasshopper definition Wolfram_Geometry_HS_004.gh (Grasshopper 1.0.7)

number_slider = Slider(8, range=0..20)
division = Division(A=number_slider, B="2")
integer = Integer(division)
range = Range(Domain=number_slider, Steps=integer)
construct_point = ConstructPoint(XCoordinate=range, YCoordinate=0, ZCoordinate=0)
multiplication = Multiplication(A="1", B="2")
point = Point(construct_point)
circle = Circle(Plane=flatten(point), Radius=multiplication)
dispatch = Dispatch(List=flatten(circle), DispatchPattern=[True, False])  # -> ListA, ListB
dispatch_2 = Dispatch(List=point, DispatchPattern=[True, False])  # -> ListA, ListB
shift_list = ShiftList(List=dispatch.ListA, Shift=1, Wrap=True)
shift_list_2 = ShiftList(List=dispatch.ListB, Shift=1, Wrap=True)
curve_curve = CurveCurve(CurveA=dispatch.ListA, CurveB=dispatch.ListB)  # -> flatten(Points), ParamsA, ParamsB
curve_curve_2 = CurveCurve(CurveA=shift_list, CurveB=dispatch.ListB)  # -> Points, ParamsA, ParamsB
list_item = ListItem(List=flatten(curve_curve.Points), Index=0, Wrap=True)
list_item_2 = ListItem(List=flatten(dispatch_2.ListB), Index=0, Wrap=True)
list_item_3 = ListItem(List=flatten(dispatch_2.ListA), Index=0, Wrap=True)
polyline = PolyLine(Vertices=[list_item, list_item_3, list_item_2], Closed=True)
orient = Orient(Geometry=polyline, Source=list_item, Target=point)  # -> Geometry, Transform
deconstruct_brep = DeconstructBrep(Brep=orient.Geometry)  # -> Faces, Edges, Vertices
list_item_4 = ListItem(List=deconstruct_brep.Vertices, Index=0, Wrap=True)
list_item_5 = ListItem(List=deconstruct_brep.Vertices, Index="1", Wrap=True)
explode = Explode(Curve=orient.Geometry, Recursive=True)  # -> Segments, Vertices
orient_2 = Orient(Geometry=orient.Geometry, Source=list_item_5, Target=list_item_4)  # -> Geometry, Transform
merge = Merge(Data1=explode.Segments, Data2=orient_2.Geometry)
boundary_surfaces = BoundarySurfaces(Edges=merge)
xz_plane = XZPlane(Origin=Point(0, 0, 0))
mirror = Mirror(Geometry=boundary_surfaces, Plane=PlaneYZ(0, 0, 0))  # -> Geometry, Transform
mirror_2 = Mirror(Geometry=mirror.Geometry, Plane=xz_plane)  # -> Geometry, Transform
deconstruct_brep_2 = DeconstructBrep(Brep=mirror_2.Geometry)  # -> Faces, Edges, Vertices
list_item_6 = ListItem(List=flatten(deconstruct_brep_2.Vertices), Index=Slider(74, range=0..100), Wrap=True)
list_item_7 = ListItem(List=flatten(deconstruct_brep_2.Vertices), Index=Slider(0, range=0..100), Wrap=True)
orient_3 = Orient(Geometry=mirror_2.Geometry, Source=list_item_6, Target=list_item_7)  # -> Geometry, Transform

triangular = Triangular(Plane=PlaneXY(0, 0, 0), Size=1, ExtentX="10", ExtentY="3")  # -> simplify(Cells), Points
param_viewer = ParamViewer(triangular.Cells)
split_tree = SplitTree(Data=triangular.Cells, Masks=flatten("{*}[1]"))  # -> Positive, Negative
boolean_toggle = BooleanToggle(True)
clean_tree = CleanTree(RemoveNulls=True, RemoveInvalid=True, RemoveEmpty=boolean_toggle, Tree=split_tree.Positive)
split_tree_2 = SplitTree(Data=triangular.Cells, Masks=flatten("{1,3,...}[0]"))  # -> Positive, Negative
split_tree_3 = SplitTree(Data=triangular.Cells, Masks=flatten("{0,2,...}[2]"))  # -> Positive, Negative
curve = Curve(clean_tree)
split_tree_4 = SplitTree(Data=flatten(curve), Masks=flatten("{*}[0,2,...]"))  # -> Positive, Negative
clean_tree_2 = CleanTree(RemoveNulls=True, RemoveInvalid=True, RemoveEmpty=boolean_toggle, Tree=split_tree_2.Positive)
clean_tree_3 = CleanTree(RemoveNulls=True, RemoveInvalid=True, RemoveEmpty=boolean_toggle, Tree=split_tree_3.Positive)
curve_2 = Curve(clean_tree_2)
curve_3 = Curve(clean_tree_3)
clean_tree_4 = CleanTree(RemoveNulls=True, RemoveInvalid=True, RemoveEmpty=boolean_toggle, Tree=split_tree_4.Negative)
clean_tree_5 = CleanTree(RemoveNulls=True, RemoveInvalid=True, RemoveEmpty=boolean_toggle, Tree=split_tree_4.Positive)
explode_2 = Explode(Curve=curve_2, Recursive=True)  # -> Segments, Vertices
curve_4 = Curve(clean_tree_4)
curve_5 = Curve(clean_tree_5)
list_item_8 = ListItem(List=explode_2.Segments, Index=Slider(1, range=0..2), Wrap=True)
explode_3 = Explode(Curve=curve_4, Recursive=True)  # -> Segments, Vertices
list_item_9 = ListItem(List=curve_4, Index=Slider(0, range=0..10), Wrap=True)
list_item_10 = ListItem(List=flatten(explode_3.Segments), Index=Slider(2, range=0..2), Wrap=True)
pi = Pi(Factor=Slider(0.208254, range=0..0.24))
rotate_3d = Rotate3D(Geometry=list_item_9, Angle=pi, Center=Point(0, 0, 0), Axis=list_item_10)  # -> Geometry, Transform
list_item_11 = ListItem(List=curve_5, Index=Slider(1, range=0..10), Wrap=True)
explode_4 = Explode(Curve=rotate_3d.Geometry, Recursive=True)  # -> Segments, Vertices
explode_5 = Explode(Curve=list_item_11, Recursive=True)  # -> Segments, Vertices
list_item_12 = ListItem(List=explode_5.Vertices, Index=Slider(1, range=0..2), Wrap=True)
list_item_13 = ListItem(List=explode_4.Segments, Index=Slider(1, range=0..2), Wrap=True)
list_item_14 = ListItem(List=explode_5.Segments, Index=Slider(2, range=0..2), Wrap=True)
horizontal_frame = HorizontalFrame(Curve=reparameterize(list_item_13), Parameter=".5")
end_points = EndPoints(Curve=list_item_13)  # -> Start, End
curve_middle = CurveMiddle(Curve=list_item_14)
vector_2pt = Vector2Pt(PointA=end_points.Start, PointB=end_points.End, Unitize=False)  # -> Vector, Length
plane_normal = PlaneNormal(Origin=horizontal_frame, ZAxis=list_item_13)
vector_2pt_2 = Vector2Pt(PointA=curve_middle, PointB=list_item_12, Unitize=False)  # -> Vector, Length
pi_2 = Pi(Factor=".5")
construct_plane = ConstructPlane(Origin=plane_normal, XAxis=vector_2pt.Vector, YAxis=Vector(0, 1, 0))
construct_plane_2 = ConstructPlane(Origin=curve_middle, XAxis=vector_2pt_2.Vector, YAxis=Vector(0, 1, 0))
rotate_plane = RotatePlane(Plane=construct_plane, Angle=pi_2)
geometry = Geometry(list_item_11)
negative = Negative(Value=pi)
orient_4 = Orient(Geometry=geometry, Source=construct_plane_2, Target=rotate_plane)  # -> Geometry, Transform
division_2 = Division(A=negative, B="2")
rotate_3d_2 = Rotate3D(Geometry=orient_4.Geometry, Angle=division_2, Center=rotate_plane, Axis=list_item_13)  # -> Geometry, Transform
list_item_15 = ListItem(List=curve_4, Index=Slider(1, range=0..10), Wrap=True)
explode_6 = Explode(Curve=rotate_3d_2.Geometry, Recursive=True)  # -> Segments, Vertices
explode_7 = Explode(Curve=list_item_15, Recursive=True)  # -> Segments, Vertices
list_item_16 = ListItem(List=explode_7.Vertices, Index=Slider(1, range=0..2), Wrap=True)
list_item_17 = ListItem(List=explode_6.Segments, Index=Slider(1, range=0..2), Wrap=True)
list_item_18 = ListItem(List=explode_7.Segments, Index=Slider(2, range=0..2), Wrap=True)
horizontal_frame_2 = HorizontalFrame(Curve=reparameterize(list_item_17), Parameter=".5")
end_points_2 = EndPoints(Curve=list_item_17)  # -> Start, End
curve_middle_2 = CurveMiddle(Curve=list_item_18)
vector_2pt_3 = Vector2Pt(PointA=end_points_2.Start, PointB=end_points_2.End, Unitize=False)  # -> Vector, Length
plane_normal_2 = PlaneNormal(Origin=horizontal_frame_2, ZAxis=list_item_17)
vector_2pt_4 = Vector2Pt(PointA=curve_middle_2, PointB=list_item_16, Unitize=False)  # -> Vector, Length
pi_3 = Pi(Factor=".5")
construct_plane_3 = ConstructPlane(Origin=plane_normal_2, XAxis=vector_2pt_3.Vector, YAxis=Vector(0, 1, 0))
construct_plane_4 = ConstructPlane(Origin=curve_middle_2, XAxis=vector_2pt_4.Vector, YAxis=Vector(0, 1, 0))
rotate_plane_2 = RotatePlane(Plane=construct_plane_3, Angle=pi_3)
geometry_2 = Geometry(list_item_11)
orient_5 = Orient(Geometry=geometry_2, Source=construct_plane_4, Target=rotate_plane_2)  # -> Geometry, Transform
division_3 = Division(A=pi, B="2")
rotate_3d_3 = Rotate3D(Geometry=orient_5.Geometry, Angle=division_3, Center=rotate_plane_2, Axis=list_item_17)  # -> Geometry, Transform
list_item_19 = ListItem(List=curve_5, Index=Slider(2, range=0..10), Wrap=True)
explode_8 = Explode(Curve=rotate_3d_3.Geometry, Recursive=True)  # -> Segments, Vertices
explode_9 = Explode(Curve=list_item_19, Recursive=True)  # -> Segments, Vertices
list_item_20 = ListItem(List=explode_9.Vertices, Index=Slider(1, range=0..2), Wrap=True)
list_item_21 = ListItem(List=explode_8.Segments, Index=Slider(1, range=0..2), Wrap=True)
list_item_22 = ListItem(List=explode_9.Segments, Index=Slider(2, range=0..2), Wrap=True)
horizontal_frame_3 = HorizontalFrame(Curve=reparameterize(list_item_21), Parameter=".5")
end_points_3 = EndPoints(Curve=list_item_21)  # -> Start, End
curve_middle_3 = CurveMiddle(Curve=list_item_22)
vector_2pt_5 = Vector2Pt(PointA=end_points_3.Start, PointB=end_points_3.End, Unitize=False)  # -> Vector, Length
plane_normal_3 = PlaneNormal(Origin=horizontal_frame_3, ZAxis=list_item_21)
vector_2pt_6 = Vector2Pt(PointA=curve_middle_3, PointB=list_item_20, Unitize=False)  # -> Vector, Length
pi_4 = Pi(Factor=".5")
construct_plane_5 = ConstructPlane(Origin=plane_normal_3, XAxis=vector_2pt_5.Vector, YAxis=Vector(0, 1, 0))
construct_plane_6 = ConstructPlane(Origin=curve_middle_3, XAxis=vector_2pt_6.Vector, YAxis=Vector(0, 1, 0))
rotate_plane_3 = RotatePlane(Plane=construct_plane_5, Angle=pi_4)
geometry_3 = Geometry(list_item_19)
orient_6 = Orient(Geometry=geometry_3, Source=construct_plane_6, Target=rotate_plane_3)  # -> Geometry, Transform
division_4 = Division(A=pi, B="2")
rotate_3d_4 = Rotate3D(Geometry=orient_6.Geometry, Angle=division_4, Center=rotate_plane_3, Axis=list_item_21)  # -> Geometry, Transform
list_item_23 = ListItem(List=curve_4, Index=Slider(1, range=0..10), Wrap=True)
explode_10 = Explode(Curve=rotate_3d_4.Geometry, Recursive=True)  # -> Segments, Vertices
explode_11 = Explode(Curve=list_item_23, Recursive=True)  # -> Segments, Vertices
list_item_24 = ListItem(List=explode_11.Vertices, Index=Slider(1, range=0..2), Wrap=True)
list_item_25 = ListItem(List=explode_10.Segments, Index=Slider(0, range=0..2), Wrap=True)
list_item_26 = ListItem(List=explode_11.Segments, Index=Slider(2, range=0..2), Wrap=True)
horizontal_frame_4 = HorizontalFrame(Curve=reparameterize(list_item_25), Parameter=".5")
end_points_4 = EndPoints(Curve=list_item_25)  # -> Start, End
curve_middle_4 = CurveMiddle(Curve=list_item_26)
vector_2pt_7 = Vector2Pt(PointA=end_points_4.Start, PointB=end_points_4.End, Unitize=False)  # -> Vector, Length
plane_normal_4 = PlaneNormal(Origin=horizontal_frame_4, ZAxis=list_item_25)
vector_2pt_8 = Vector2Pt(PointA=curve_middle_4, PointB=list_item_24, Unitize=False)  # -> Vector, Length
pi_5 = Pi(Factor=".5")
construct_plane_7 = ConstructPlane(Origin=plane_normal_4, XAxis=vector_2pt_7.Vector, YAxis=Vector(0, 1, 0))
construct_plane_8 = ConstructPlane(Origin=curve_middle_4, XAxis=vector_2pt_8.Vector, YAxis=Vector(0, 1, 0))
rotate_plane_4 = RotatePlane(Plane=construct_plane_7, Angle=pi_5)
geometry_4 = Geometry(list_item_11)
orient_7 = Orient(Geometry=geometry_4, Source=construct_plane_8, Target=rotate_plane_4)  # -> Geometry, Transform
division_5 = Division(A=pi, B="2")
negative_2 = Negative(Value=division_5)
rotate_3d_5 = Rotate3D(Geometry=orient_7.Geometry, Angle=negative_2, Center=rotate_plane_4, Axis=list_item_25)  # -> Geometry, Transform; disabled
unit_z = UnitZ(Factor=1)
merge_2 = Merge(
    Data1=rotate_3d.Geometry,
    Data2=rotate_3d_2.Geometry,
    Data3=rotate_3d_3.Geometry,
    Data4=rotate_3d_4.Geometry,
    Data5=rotate_3d_5.Geometry)
boundary_surfaces_2 = BoundarySurfaces(Edges=merge_2)
list_item_27 = ListItem(List=flatten(triangular.Cells), Index=Slider(1, range=0..10), Wrap=True)
deconstruct_brep_3 = DeconstructBrep(Brep=list_item_27)  # -> Faces, Edges, Vertices
list_item_28 = ListItem(List=flatten(deconstruct_brep_3.Vertices), Index=0, Wrap=True)
construct_plane_9 = ConstructPlane(Origin=list_item_28, XAxis=unit_z, YAxis=Vector(0, 1, 0))
mirror_3 = Mirror(Geometry=boundary_surfaces_2, Plane=construct_plane_9)  # -> Geometry, Transform
