# Grasshopper definition Wolfram_Geometry_HS_004_LIVEb.gh (Grasshopper 1.0.7)
# plug-ins: Kangaroo2 Components

# ----
# Oscillation
trigger = Trigger(Interval=20, TimerInterval=20, Target=data_recorder)
data_recorder = DataRecorder("1", DataLimit=10000, RecordData=True)
list_length = ListLength(List=data_recorder)
division = Division(A=list_length, B=Slider(22.824, range=0..100))
sine = Sine(Value=division)
absolute = Absolute(Value=sine)
multiplication = Multiplication(A=Slider(0.22, range=0..1), B=absolute)
panel = Panel(multiplication)

number_slider = Slider(0.059, range=0..1)
construct_point = ConstructPoint(XCoordinate=0, YCoordinate=Slider(3, range=0..10), ZCoordinate=0)
pi = Pi(Factor=panel)
triangular = Triangular(Plane=construct_point, Size=1, ExtentX="10", ExtentY="3")  # -> simplify(Cells), Points
triangular_2 = Triangular(Plane=PlaneXY(0, 0, 0), Size=1, ExtentX="10", ExtentY="3")  # -> simplify(Cells), Points
param_viewer = ParamViewer(triangular_2.Cells)
split_tree = SplitTree(Data=triangular.Cells, Masks=flatten("{*}[1]"))  # -> Positive, Negative
split_tree_2 = SplitTree(Data=triangular_2.Cells, Masks=flatten("{*}[1]"))  # -> Positive, Negative
boolean_toggle = BooleanToggle(True)
boolean_toggle_2 = BooleanToggle(True)
panel_2 = Panel(split_tree_2.Positive)
clean_tree = CleanTree(RemoveNulls=True, RemoveInvalid=True, RemoveEmpty=boolean_toggle, Tree=split_tree.Positive)
clean_tree_2 = CleanTree(RemoveNulls=True, RemoveInvalid=True, RemoveEmpty=boolean_toggle_2, Tree=split_tree_2.Positive)
split_tree_3 = SplitTree(Data=flatten(clean_tree), Masks=flatten("{*}[0,2,...]"))  # -> Positive, Negative
panel_3 = Panel(clean_tree_2)
split_tree_4 = SplitTree(Data=flatten(clean_tree_2), Masks=flatten("{*}[0,2,...]"))  # -> Positive, Negative
clean_tree_3 = CleanTree(RemoveNulls=True, RemoveInvalid=True, RemoveEmpty=boolean_toggle, Tree=split_tree_3.Positive)
clean_tree_4 = CleanTree(RemoveNulls=True, RemoveInvalid=True, RemoveEmpty=boolean_toggle, Tree=split_tree_3.Negative)
clean_tree_5 = CleanTree(RemoveNulls=True, RemoveInvalid=True, RemoveEmpty=boolean_toggle_2, Tree=split_tree_4.Positive)
clean_tree_6 = CleanTree(RemoveNulls=True, RemoveInvalid=True, RemoveEmpty=boolean_toggle_2, Tree=split_tree_4.Negative)
curve = Curve(clean_tree_3)
curve_2 = Curve(clean_tree_4)
curve_3 = Curve(clean_tree_5)
curve_4 = Curve(clean_tree_6)
list_item = ListItem(List=curve_2, Index=Slider(0, range=0..10), Wrap=True)
list_item_2 = ListItem(List=curve, Index=Slider(0, range=0..10), Wrap=True)
list_item_3 = ListItem(List=curve_3, Index=Slider(0, range=0..5), Wrap=True)
list_item_4 = ListItem(List=curve_4, Index=Slider(0, range=0..5), Wrap=True)
explode = Explode(Curve=list_item_2, Recursive=True)  # -> Segments, Vertices
explode_2 = Explode(Curve=list_item_3, Recursive=True)  # -> Segments, Vertices
list_item_5 = ListItem(List=explode.Segments, Index=Slider(2, range=0..2), Wrap=True)
list_item_6 = ListItem(List=explode.Vertices, Index=Slider(1, range=0..2), Wrap=True)
list_item_7 = ListItem(List=explode_2.Segments, Index=Slider(2, range=0..2), Wrap=True)
list_item_8 = ListItem(List=explode_2.Vertices, Index=Slider(1, range=0..2), Wrap=True)
curve_middle = CurveMiddle(Curve=list_item_5)
curve_middle_2 = CurveMiddle(Curve=list_item_7)
vector_2pt = Vector2Pt(PointA=curve_middle, PointB=list_item_6, Unitize=False)  # -> Vector, Length
vector_2pt_2 = Vector2Pt(PointA=curve_middle_2, PointB=list_item_8, Unitize=False)  # -> Vector, Length
construct_plane = ConstructPlane(Origin=curve_middle, XAxis=vector_2pt.Vector, YAxis=Vector(0, 1, 0))
construct_plane_2 = ConstructPlane(Origin=curve_middle_2, XAxis=vector_2pt_2.Vector, YAxis=Vector(0, 1, 0))
vector_display = VectorDisplay(Anchor=curve_middle_2, Vector=vector_2pt_2.Vector)
vector_display_2 = VectorDisplay(Anchor=curve_middle, Vector=vector_2pt.Vector)
curve_5 = Curve(list_item_5)
curve_6 = Curve(list_item_3)
cool = Cool_(
    trianglebase=curve_5,
    planesource=construct_plane,
    trianglerotate=list_item_2,
    triangle=list_item_2,
    index=Slider(1, range=0..2),
    rotation=pi)
cluster = Cool_(
    trianglebase=list_item_2,
    planesource=construct_plane,
    trianglerotate=list_item_2,
    triangle=list_item_2,
    index=Slider(0, range=0..2),
    rotation=pi)
cluster_2 = Cool_(
    trianglebase=list_item_2,
    planesource=construct_plane,
    trianglerotate=cluster,
    triangle=cluster,
    index=Slider(0, range=0..2),
    rotation=pi)
cluster_3 = Cool_(
    trianglebase=list_item_2,
    planesource=construct_plane,
    trianglerotate=cluster,
    triangle=cluster,
    index=Slider(1, range=0..2),
    rotation=pi)
cluster_4 = Cool_(
    trianglebase=list_item_2,
    planesource=construct_plane,
    trianglerotate=cluster_3,
    triangle=cluster_3,
    index=Slider(1, range=0..2),
    rotation=pi)
cluster_5 = Cool_(
    trianglebase=list_item_2,
    planesource=construct_plane,
    trianglerotate=cluster_3,
    triangle=cluster_3,
    index=Slider(0, range=0..2),
    rotation=pi)
cluster_6 = Cool_(
    trianglebase=list_item_2,
    planesource=construct_plane,
    trianglerotate=cluster_5,
    triangle=cluster_5,
    index=Slider(0, range=0..2),
    rotation=pi)
cluster_7 = Cool_(
    trianglebase=list_item_2,
    planesource=construct_plane,
    trianglerotate=cluster_5,
    triangle=cluster_5,
    index=Slider(1, range=0..2),
    rotation=pi)
cluster_8 = Cool_(
    trianglebase=list_item_2,
    planesource=construct_plane,
    trianglerotate=cluster_7,
    triangle=cluster_7,
    index=Slider(1, range=0..2),
    rotation=pi)
cluster_9 = Cool_(
    trianglebase=list_item_2,
    planesource=construct_plane,
    trianglerotate=cluster_7,
    triangle=cluster_7,
    index=Slider(0, range=0..2),
    rotation=pi)
cluster_10 = Cool_(
    trianglebase=list_item_2,
    planesource=construct_plane,
    trianglerotate=cluster_9,
    triangle=cluster_9,
    index=Slider(0, range=0..2),
    rotation=pi)
cluster_11 = Cool_(
    trianglebase=list_item_2,
    planesource=construct_plane,
    trianglerotate=cluster_9,
    triangle=cluster_9,
    index=Slider(1, range=0..2),
    rotation=pi)
cluster_12 = Cool_(
    trianglebase=list_item_2,
    planesource=construct_plane,
    trianglerotate=cluster_11,
    triangle=cluster_11,
    index=Slider(1, range=0..2),
    rotation=pi)
cluster_13 = Cool_(
    trianglebase=list_item_2,
    planesource=construct_plane,
    trianglerotate=cluster_11,
    triangle=cluster_11,
    index=Slider(0, range=0..2),
    rotation=pi)
cluster_14 = Cool_(
    trianglebase=list_item_2,
    planesource=construct_plane,
    trianglerotate=cluster_13,
    triangle=cluster_13,
    index=Slider(0, range=0..2),
    rotation=pi)
cluster_15 = Cool_(
    trianglebase=list_item_2,
    planesource=construct_plane,
    trianglerotate=cluster_13,
    triangle=cluster_13,
    index=Slider(1, range=0..2),
    rotation=pi)
cluster_16 = Cool_(
    trianglebase=list_item_2,
    planesource=construct_plane,
    trianglerotate=cluster_15,
    triangle=cluster_15,
    index=Slider(1, range=0..2),
    rotation=pi)
cluster_17 = Cool_(
    trianglebase=list_item_2,
    planesource=construct_plane,
    trianglerotate=cluster_15,
    triangle=cluster_15,
    index=Slider(0, range=0..2),
    rotation=pi)
cluster_18 = Cool_(
    trianglebase=list_item_2,
    planesource=construct_plane,
    trianglerotate=cluster_17,
    triangle=cluster_17,
    index=Slider(0, range=0..2),
    rotation=pi)
merge = Merge(
    Data1=curve_5,
    Data2=cool,
    Data3=cluster,
    Data4=cluster_2,
    Data5=cluster_3,
    Data6=cluster_4,
    Data7=cluster_5,
    Data8=cluster_7,
    Data9=cluster_6,
    Data10=cluster_8,
    Data11=cluster_9,
    Data12=cluster_10,
    Data13=cluster_11,
    Data14=cluster_12,
    Data15=cluster_13,
    Data16=cluster_14,
    Data17=cluster_15,
    Data18=cluster_16,
    Data19=cluster_17,
    Data20=cluster_18)
multipipe = MultiPipe(Curves=merge, NodeSize=Slider(0.16, range=0..1), EndOffset=1, StrutSize=1, Segment=0, KinkAngle=0.6, CubeFit=0, Caps=0)
relay = Relay()

# ==== cluster Cool_
trianglerotate = ClusterInput()
rotation = ClusterInput()
triangle = ClusterInput()
index = ClusterInput()
trianglebase = ClusterInput()
planesource = ClusterInput()
explode = Explode(Curve=triangle, Recursive=True)  # -> Segments, Vertices
deconstruct_brep = DeconstructBrep(Brep=trianglerotate)  # -> Faces, Edges, Vertices
list_item = ListItem(List=explode.Segments, Index=index, Wrap=True)
curve_middle = CurveMiddle(Curve=list_item)
plane_normal = PlaneNormal(Origin=curve_middle, ZAxis=deconstruct_brep.Faces)
pi = Pi(Factor=1)
align_plane = AlignPlane(Plane=plane_normal, Direction=list_item)  # -> Plane, Angle
rotate = Rotate(Geometry=align_plane.Plane, Angle=pi, Plane=align_plane.Plane)  # -> Geometry, Transform
pi_2 = Pi(Factor=".5")
rotate_plane = RotatePlane(Plane=rotate.Geometry, Angle=pi_2)
orient = Orient(Geometry=trianglebase, Source=planesource, Target=rotate_plane)  # -> Geometry, Transform
negative = Negative(Value=rotation)
rotate_3d = Rotate3D(Geometry=orient.Geometry, Angle=negative, Center=rotate_plane, Axis=list_item)  # -> Geometry, Transform
triangleout = ClusterOutput(rotate_3d.Geometry)
