# Grasshopper definition Wolfram_Geometry_HS_004_Oscar.gh (Grasshopper 1.0.7)
# plug-ins: Kangaroo2 Components

# ----
# Oscillation
trigger = Trigger(Interval=20, TimerInterval=20, Target=data_recorder)
data_recorder = DataRecorder("1", DataLimit=10000, RecordData=True)
list_length = ListLength(List=data_recorder)
division = Division(A=list_length, B=Slider(22.824, range=0..100))
sine = Sine(Value=division)
absolute = Absolute(Value=sine)
multiplication = Multiplication(A=Slider(0.22, range=0..1), B=absolute)
panel = Panel(multiplication)

pi = Pi(Factor=panel)

number_slider = Slider(8, range=0..20)  # disabled
panel_2 = Panel("2")  # disabled
division_2 = Division(A=number_slider, B=panel_2)  # disabled
integer = Integer(division_2)  # disabled
range = Range(Domain=number_slider, Steps=integer)  # disabled
panel_3 = Panel("1")  # disabled
construct_point = ConstructPoint(XCoordinate=range, YCoordinate=0, ZCoordinate=0)  # disabled
multiplication_2 = Multiplication(A=panel_3, B=panel_2)  # disabled
point = Point(construct_point)  # disabled
circle = Circle(Plane=flatten(point), Radius=multiplication_2)  # disabled
dispatch = Dispatch(List=flatten(circle), DispatchPattern=[True, False])  # -> ListA, ListB; disabled
dispatch_2 = Dispatch(List=point, DispatchPattern=[True, False])  # -> ListA, ListB; disabled
shift_list = ShiftList(List=dispatch.ListA, Shift=1, Wrap=True)  # disabled
shift_list_2 = ShiftList(List=dispatch.ListB, Shift=1, Wrap=True)  # disabled
curve_curve = CurveCurve(CurveA=dispatch.ListA, CurveB=dispatch.ListB)  # -> flatten(Points), ParamsA, ParamsB; disabled
curve_curve_2 = CurveCurve(CurveA=shift_list, CurveB=dispatch.ListB)  # -> Points, ParamsA, ParamsB; disabled
list_item = ListItem(List=flatten(curve_curve.Points), Index=0, Wrap=True)  # disabled
list_item_2 = ListItem(List=flatten(dispatch_2.ListB), Index=0, Wrap=True)  # disabled
list_item_3 = ListItem(List=flatten(dispatch_2.ListA), Index=0, Wrap=True)  # disabled
polyline = PolyLine(Vertices=[list_item, list_item_3, list_item_2], Closed=True)  # disabled
orient = Orient(Geometry=polyline, Source=list_item, Target=point)  # -> Geometry, Transform; disabled
deconstruct_brep = DeconstructBrep(Brep=orient.Geometry)  # -> Faces, Edges, Vertices; disabled
panel_4 = Panel("1")  # disabled
list_item_4 = ListItem(List=deconstruct_brep.Vertices, Index=0, Wrap=True)  # disabled
list_item_5 = ListItem(List=deconstruct_brep.Vertices, Index=panel_4, Wrap=True)  # disabled
explode = Explode(Curve=orient.Geometry, Recursive=True)  # -> Segments, Vertices; disabled
orient_2 = Orient(Geometry=orient.Geometry, Source=list_item_5, Target=list_item_4)  # -> Geometry, Transform; disabled
merge = Merge(Data1=explode.Segments, Data2=orient_2.Geometry)  # disabled
boundary_surfaces = BoundarySurfaces(Edges=merge)  # disabled
xz_plane = XZPlane(Origin=Point(0, 0, 0))  # disabled
number_slider_2 = Slider(74, range=0..100)  # disabled
mirror = Mirror(Geometry=boundary_surfaces, Plane=PlaneYZ(0, 0, 0))  # -> Geometry, Transform; disabled
mirror_2 = Mirror(Geometry=mirror.Geometry, Plane=xz_plane)  # -> Geometry, Transform; disabled
deconstruct_brep_2 = DeconstructBrep(Brep=mirror_2.Geometry)  # -> Faces, Edges, Vertices; disabled
list_item_6 = ListItem(List=flatten(deconstruct_brep_2.Vertices), Index=number_slider_2, Wrap=True)  # disabled
list_item_7 = ListItem(List=flatten(deconstruct_brep_2.Vertices), Index=Slider(0, range=0..100), Wrap=True)  # disabled
orient_3 = Orient(Geometry=mirror_2.Geometry, Source=list_item_6, Target=list_item_7)  # -> Geometry, Transform; disabled

panel_5 = Panel("3")  # disabled
panel_6 = Panel("10")  # disabled
triangular = Triangular(Plane=PlaneXY(0, 0, 0), Size=1, ExtentX=panel_6, ExtentY=panel_5)  # -> simplify(Cells), Points; disabled
panel_7 = Panel("{*}[1]")  # disabled
split_tree = SplitTree(Data=triangular.Cells, Masks=flatten(panel_7))  # -> Positive, Negative; disabled
panel_8 = Panel("{1,3,...}[0]")  # disabled
panel_9 = Panel("{0,2,...}[2]")  # disabled
boolean_toggle = BooleanToggle(True)  # disabled
clean_tree = CleanTree(RemoveNulls=True, RemoveInvalid=True, RemoveEmpty=boolean_toggle, Tree=split_tree.Positive)  # disabled
split_tree_2 = SplitTree(Data=triangular.Cells, Masks=flatten(panel_8))  # -> Positive, Negative; disabled
split_tree_3 = SplitTree(Data=triangular.Cells, Masks=flatten(panel_9))  # -> Positive, Negative; disabled
panel_10 = Panel("{*}[0,2,...]")  # disabled
curve = Curve(clean_tree)  # disabled
split_tree_4 = SplitTree(Data=flatten(curve), Masks=flatten(panel_10))  # -> Positive, Negative; disabled
clean_tree_2 = CleanTree(RemoveNulls=True, RemoveInvalid=True, RemoveEmpty=boolean_toggle, Tree=split_tree_2.Positive)  # disabled
clean_tree_3 = CleanTree(RemoveNulls=True, RemoveInvalid=True, RemoveEmpty=boolean_toggle, Tree=split_tree_3.Positive)  # disabled
clean_tree_4 = CleanTree(RemoveNulls=True, RemoveInvalid=True, RemoveEmpty=boolean_toggle, Tree=split_tree_4.Negative)  # disabled
clean_tree_5 = CleanTree(RemoveNulls=True, RemoveInvalid=True, RemoveEmpty=boolean_toggle, Tree=split_tree_4.Positive)  # disabled
curve_2 = Curve(clean_tree_3)  # disabled
curve_3 = Curve(clean_tree_2)  # disabled
number_slider_3 = Slider(1, range=0..2)  # disabled
number_slider_4 = Slider(2, range=0..2)  # disabled
number_slider_5 = Slider(0, range=0..10)  # disabled
curve_4 = Curve(clean_tree_4)  # disabled
number_slider_6 = Slider(0, range=0..10)  # disabled
explode_2 = Explode(Curve=curve_4, Recursive=True)  # -> Segments, Vertices; disabled
curve_5 = Curve(clean_tree_5)  # disabled
explode_3 = Explode(Curve=curve_5, Recursive=True)  # -> flatten(Segments), Vertices; disabled
list_item_8 = ListItem(List=curve_5, Index=0, Wrap=True)  # disabled
list_item_9 = ListItem(List=curve_4, Index=number_slider_6, Wrap=True)  # disabled
list_item_10 = ListItem(List=flatten(explode_2.Segments), Index=number_slider_4, Wrap=True)  # disabled
list_item_11 = ListItem(List=flatten(curve_2), Index=number_slider_5, Wrap=True)  # disabled
list_item_12 = ListItem(List=explode_3.Segments, Index=number_slider_3, Wrap=True)  # disabled
boundary_surfaces_2 = BoundarySurfaces(Edges=list_item_8)  # disabled
negative = Negative(Value=pi)  # disabled
curve_middle = CurveMiddle(Curve=list_item_12)  # disabled
rotate_3d = Rotate3D(Geometry=list_item_11, Angle=negative, Center=curve_middle, Axis=list_item_12)  # -> Geometry, Transform; disabled
number_slider_7 = Slider(0, range=0..10)  # disabled
rotate_3d_2 = Rotate3D(Geometry=list_item_9, Angle=pi, Center=Point(0, 0, 0), Axis=list_item_10)  # -> Geometry, Transform; disabled
list_item_13 = ListItem(List=curve_5, Index=number_slider_7, Wrap=True)  # disabled
deconstruct_brep_3 = DeconstructBrep(Brep=rotate_3d.Geometry)  # -> Faces, Edges, Vertices; disabled
number_slider_8 = Slider(0, range=0..2)  # disabled
number_slider_9 = Slider(1, range=0..2)  # disabled
number_slider_10 = Slider(1, range=0..2)  # disabled
number_slider_11 = Slider(2, range=0..2)  # disabled
explode_4 = Explode(Curve=list_item_13, Recursive=True)  # -> Segments, Vertices; disabled
explode_5 = Explode(Curve=rotate_3d_2.Geometry, Recursive=True)  # -> Segments, Vertices; disabled
list_item_14 = ListItem(List=explode_5.Segments, Index=number_slider_8, Wrap=True)  # disabled
deconstruct_brep_4 = DeconstructBrep(Brep=rotate_3d_2.Geometry)  # -> Faces, Edges, Vertices; disabled
curve_middle_2 = CurveMiddle(Curve=reverse(list_item_14))  # disabled
list_item_15 = ListItem(List=explode_4.Vertices, Index=number_slider_10, Wrap=True)  # disabled
list_item_16 = ListItem(List=explode_4.Segments, Index=number_slider_11, Wrap=True)  # disabled
list_item_17 = ListItem(List=explode_5.Segments, Index=number_slider_9, Wrap=True)  # disabled
construct_plane = ConstructPlane(Origin=curve_middle_2, XAxis=list_item_14, YAxis=Vector(0, 1, 0))  # disabled
pi_2 = Pi(Factor=1)  # disabled
curve_middle_3 = CurveMiddle(Curve=list_item_16)  # disabled
curve_middle_4 = CurveMiddle(Curve=list_item_17)  # disabled
rotate_plane = RotatePlane(Plane=construct_plane, Angle=pi_2)  # disabled
geometry = Geometry(explode_5.Segments)  # disabled
plane_normal = PlaneNormal(Origin=curve_middle_4, ZAxis=deconstruct_brep_4.Faces)  # disabled
vector_2pt = Vector2Pt(PointA=curve_middle_3, PointB=list_item_15, Unitize=False)  # -> Vector, Length; disabled
negative_2 = Negative(Value=pi)  # disabled
orient_4 = Orient(Geometry=geometry, Source=rotate_plane, Target=construct_plane)  # -> Geometry, Transform; disabled
align_plane = AlignPlane(Plane=plane_normal, Direction=list_item_17)  # -> Plane, Angle; disabled
pi_3 = Pi(Factor=1)  # disabled
construct_plane_2 = ConstructPlane(Origin=curve_middle_3, XAxis=vector_2pt.Vector, YAxis=Vector(0, 1, 0))  # disabled
geometry_2 = Geometry(list_item_13)  # disabled
panel_11 = Panel(negative_2)  # disabled
panel_12 = Panel(".5")  # disabled
rotate = Rotate(Geometry=align_plane.Plane, Angle=pi_3, Plane=align_plane.Plane)  # -> Geometry, Transform; disabled
rotate_3d_3 = Rotate3D(Geometry=orient_4.Geometry, Angle=negative_2, Center=curve_middle_2, Axis=list_item_14)  # -> Geometry, Transform; disabled
pi_4 = Pi(Factor=panel_12)  # disabled
rotate_plane_2 = RotatePlane(Plane=rotate.Geometry, Angle=pi_4)  # disabled
orient_5 = Orient(Geometry=geometry_2, Source=construct_plane_2, Target=rotate_plane_2)  # -> Geometry, Transform; disabled
boundary_surfaces_3 = BoundarySurfaces(Edges=rotate_3d_3.Geometry)  # disabled
negative_3 = Negative(Value=pi)  # disabled
deconstruct_brep_5 = DeconstructBrep(Brep=boundary_surfaces_3)  # -> Faces, Edges, Vertices; disabled
rotate_3d_4 = Rotate3D(Geometry=orient_5.Geometry, Angle=negative_3, Center=rotate_plane_2, Axis=list_item_17)  # -> Geometry, Transform; disabled
rotate_3d_5 = Rotate3D(Geometry=deconstruct_brep_5.Faces, Angle=negative_2, Center=curve_middle_2, Axis=list_item_14)  # -> Geometry, Transform; disabled
number_slider_12 = Slider(1, range=0..1)  # disabled
number_slider_13 = Slider(1, range=0..10)  # disabled
deconstruct_brep_6 = DeconstructBrep(Brep=rotate_3d_4.Geometry)  # -> Faces, Edges, Vertices; disabled
number_slider_14 = Slider(0, range=0..2)  # disabled
list_item_18 = ListItem(List=deconstruct_brep_6.Edges, Index=number_slider_12, Wrap=True)  # disabled
explode_6 = Explode(Curve=rotate_3d_4.Geometry, Recursive=True)  # -> Segments, Vertices; disabled
list_item_19 = ListItem(List=curve_4, Index=number_slider_13, Wrap=True)  # disabled
number_slider_15 = Slider(0, range=0..2)  # disabled
list_item_20 = ListItem(List=explode_6.Segments, Index=number_slider_14, Wrap=True)  # disabled
curve_middle_5 = CurveMiddle(Curve=list_item_20)  # disabled
number_slider_16 = Slider(1, range=0..2)  # disabled
explode_7 = Explode(Curve=list_item_19, Recursive=True)  # -> Segments, Vertices; disabled
number_slider_17 = Slider(2, range=0..2)  # disabled
plane_normal_2 = PlaneNormal(Origin=curve_middle_5, ZAxis=deconstruct_brep_6.Faces)  # disabled
list_item_21 = ListItem(List=list_item_18, Index=number_slider_15, Wrap=True)  # disabled
list_item_22 = ListItem(List=explode_7.Vertices, Index=number_slider_16, Wrap=True)  # disabled
curve_middle_6 = CurveMiddle(Curve=reverse(list_item_21))  # disabled
list_item_23 = ListItem(List=explode_7.Segments, Index=number_slider_17, Wrap=True)  # disabled
align_plane_2 = AlignPlane(Plane=plane_normal_2, Direction=list_item_20)  # -> Plane, Angle; disabled
pi_5 = Pi(Factor=1)  # disabled
construct_plane_3 = ConstructPlane(Origin=curve_middle_6, XAxis=list_item_21, YAxis=Vector(0, 1, 0))  # disabled
curve_middle_7 = CurveMiddle(Curve=list_item_23)  # disabled
pi_6 = Pi(Factor=1)  # disabled
panel_13 = Panel(".5")  # disabled
rotate_2 = Rotate(Geometry=align_plane_2.Plane, Angle=pi_5, Plane=align_plane_2.Plane)  # -> Geometry, Transform; disabled
pi_7 = Pi(Factor=panel_13)  # disabled
rotate_plane_3 = RotatePlane(Plane=construct_plane_3, Angle=pi_6)  # disabled
vector_2pt_2 = Vector2Pt(PointA=curve_middle_7, PointB=list_item_22, Unitize=False)  # -> Vector, Length; disabled
geometry_3 = Geometry(deconstruct_brep_6.Edges)  # disabled
rotate_plane_4 = RotatePlane(Plane=rotate_2.Geometry, Angle=pi_7)  # disabled
geometry_4 = Geometry(list_item_19)  # disabled
construct_plane_4 = ConstructPlane(Origin=curve_middle_7, XAxis=vector_2pt_2.Vector, YAxis=Vector(0, 1, 0))  # disabled
negative_4 = Negative(Value=pi)  # disabled
orient_6 = Orient(Geometry=geometry_3, Source=rotate_plane_3, Target=construct_plane_3)  # -> Geometry, Transform; disabled
panel_14 = Panel("2")  # disabled
number_slider_18 = Slider(0.34, range=0..2)  # disabled
panel_15 = Panel(negative_4)  # disabled
negative_5 = Negative(Value=pi)  # disabled
orient_7 = Orient(Geometry=geometry_4, Source=construct_plane_4, Target=rotate_plane_4)  # -> Geometry, Transform; disabled
rotate_3d_6 = Rotate3D(Geometry=orient_6.Geometry, Angle=negative_4, Center=curve_middle_6, Axis=list_item_21)  # -> Geometry, Transform; disabled
rotate_3d_7 = Rotate3D(Geometry=orient_7.Geometry, Angle=negative_5, Center=rotate_plane_4, Axis=list_item_20)  # -> Geometry, Transform; disabled
boundary_surfaces_4 = BoundarySurfaces(Edges=rotate_3d_6.Geometry)  # disabled
deconstruct_brep_7 = DeconstructBrep(Brep=boundary_surfaces_4)  # -> Faces, Edges, Vertices; disabled
number_slider_19 = Slider(0, range=0..1)  # disabled
explode_8 = Explode(Curve=rotate_3d_7.Geometry, Recursive=True)  # -> Segments, Vertices; disabled
number_slider_20 = Slider(2, range=0..10)  # disabled
number_slider_21 = Slider(1, range=0..2)  # disabled
rotate_3d_8 = Rotate3D(Geometry=deconstruct_brep_7.Faces, Angle=negative_4, Center=curve_middle_6, Axis=list_item_21)  # -> Geometry, Transform; disabled
deconstruct_brep_8 = DeconstructBrep(Brep=rotate_3d_7.Geometry)  # -> Faces, Edges, Vertices; disabled
number_slider_22 = Slider(0, range=0..2)  # disabled
list_item_24 = ListItem(List=curve_5, Index=number_slider_20, Wrap=True)  # disabled
list_item_25 = ListItem(List=explode_8.Segments, Index=number_slider_21, Wrap=True)  # disabled
list_item_26 = ListItem(List=deconstruct_brep_8.Edges, Index=number_slider_19, Wrap=True)  # disabled
curve_middle_8 = CurveMiddle(Curve=list_item_25)  # disabled
list_item_27 = ListItem(List=list_item_26, Index=number_slider_22, Wrap=True)  # disabled
curve_middle_9 = CurveMiddle(Curve=reverse(list_item_27))  # disabled
plane_normal_3 = PlaneNormal(Origin=curve_middle_8, ZAxis=deconstruct_brep_8.Faces)  # disabled
construct_plane_5 = ConstructPlane(Origin=curve_middle_9, XAxis=list_item_27, YAxis=Vector(0, 1, 0))  # disabled
pi_8 = Pi(Factor=1)  # disabled
number_slider_23 = Slider(1, range=0..2)  # disabled
align_plane_3 = AlignPlane(Plane=plane_normal_3, Direction=list_item_25)  # -> Plane, Angle; disabled
explode_9 = Explode(Curve=list_item_24, Recursive=True)  # -> Segments, Vertices; disabled
pi_9 = Pi(Factor=1)  # disabled
number_slider_24 = Slider(2, range=0..2)  # disabled
rotate_plane_5 = RotatePlane(Plane=construct_plane_5, Angle=pi_9)  # disabled
panel_16 = Panel(".5")  # disabled
geometry_5 = Geometry(deconstruct_brep_8.Edges)  # disabled
rotate_3 = Rotate(Geometry=align_plane_3.Plane, Angle=pi_8, Plane=align_plane_3.Plane)  # -> Geometry, Transform; disabled
list_item_28 = ListItem(List=explode_9.Vertices, Index=number_slider_23, Wrap=True)  # disabled
list_item_29 = ListItem(List=explode_9.Segments, Index=number_slider_24, Wrap=True)  # disabled
pi_10 = Pi(Factor=panel_16)  # disabled
negative_6 = Negative(Value=pi)  # disabled
orient_8 = Orient(Geometry=geometry_5, Source=rotate_plane_5, Target=construct_plane_5)  # -> Geometry, Transform; disabled
rotate_plane_6 = RotatePlane(Plane=rotate_3.Geometry, Angle=pi_10)  # disabled
curve_middle_10 = CurveMiddle(Curve=list_item_29)  # disabled
panel_17 = Panel(negative_6)  # disabled
rotate_3d_9 = Rotate3D(Geometry=orient_8.Geometry, Angle=negative_6, Center=curve_middle_9, Axis=list_item_27)  # -> Geometry, Transform; disabled
vector_2pt_3 = Vector2Pt(PointA=curve_middle_10, PointB=list_item_28, Unitize=False)  # -> Vector, Length; disabled
boundary_surfaces_5 = BoundarySurfaces(Edges=rotate_3d_9.Geometry)  # disabled
construct_plane_6 = ConstructPlane(Origin=curve_middle_10, XAxis=vector_2pt_3.Vector, YAxis=Vector(0, 1, 0))  # disabled
geometry_6 = Geometry(list_item_24)  # disabled
deconstruct_brep_9 = DeconstructBrep(Brep=boundary_surfaces_5)  # -> Faces, Edges, Vertices; disabled
orient_9 = Orient(Geometry=geometry_6, Source=construct_plane_6, Target=rotate_plane_6)  # -> Geometry, Transform; disabled
negative_7 = Negative(Value=pi)  # disabled
rotate_3d_10 = Rotate3D(Geometry=deconstruct_brep_9.Faces, Angle=negative_6, Center=curve_middle_9, Axis=list_item_27)  # -> Geometry, Transform; disabled
rotate_3d_11 = Rotate3D(Geometry=orient_9.Geometry, Angle=negative_7, Center=rotate_plane_6, Axis=list_item_25)  # -> Geometry, Transform; disabled
number_slider_25 = Slider(1, range=0..1)  # disabled
deconstruct_brep_10 = DeconstructBrep(Brep=rotate_3d_11.Geometry)  # -> Faces, Edges, Vertices; disabled
number_slider_26 = Slider(0, range=0..2)  # disabled
number_slider_27 = Slider(0, range=0..2)  # disabled
explode_10 = Explode(Curve=rotate_3d_11.Geometry, Recursive=True)  # -> Segments, Vertices; disabled
list_item_30 = ListItem(List=deconstruct_brep_10.Edges, Index=number_slider_25, Wrap=True)  # disabled
list_item_31 = ListItem(List=list_item_30, Index=number_slider_26, Wrap=True)  # disabled
curve_middle_11 = CurveMiddle(Curve=reverse(list_item_31))  # disabled
list_item_32 = ListItem(List=explode_10.Segments, Index=number_slider_27, Wrap=True)  # disabled
curve_middle_12 = CurveMiddle(Curve=list_item_32)  # disabled
plane_normal_4 = PlaneNormal(Origin=curve_middle_12, ZAxis=deconstruct_brep_10.Faces)  # disabled
number_slider_28 = Slider(2, range=0..10)  # disabled
pi_11 = Pi(Factor=1)  # disabled
align_plane_4 = AlignPlane(Plane=plane_normal_4, Direction=list_item_32)  # -> Plane, Angle; disabled
construct_plane_7 = ConstructPlane(Origin=curve_middle_11, XAxis=list_item_31, YAxis=Vector(0, 1, 0))  # disabled
pi_12 = Pi(Factor=1)  # disabled
panel_18 = Panel(".5")  # disabled
list_item_33 = ListItem(List=curve_4, Index=number_slider_28, Wrap=True)  # disabled
rotate_plane_7 = RotatePlane(Plane=construct_plane_7, Angle=pi_12)  # disabled
rotate_4 = Rotate(Geometry=align_plane_4.Plane, Angle=pi_11, Plane=align_plane_4.Plane)  # -> Geometry, Transform; disabled
geometry_7 = Geometry(deconstruct_brep_10.Edges)  # disabled
pi_13 = Pi(Factor=panel_18)  # disabled
negative_8 = Negative(Value=pi)  # disabled
orient_10 = Orient(Geometry=geometry_7, Source=rotate_plane_7, Target=construct_plane_7)  # -> Geometry, Transform; disabled
number_slider_29 = Slider(1, range=0..2)  # disabled
explode_11 = Explode(Curve=list_item_33, Recursive=True)  # -> Segments, Vertices; disabled
number_slider_30 = Slider(2, range=0..2)  # disabled
rotate_plane_8 = RotatePlane(Plane=rotate_4.Geometry, Angle=pi_13)  # disabled
panel_19 = Panel(negative_8)  # disabled
list_item_34 = ListItem(List=explode_11.Vertices, Index=number_slider_29, Wrap=True)  # disabled
rotate_3d_12 = Rotate3D(Geometry=orient_10.Geometry, Angle=negative_8, Center=curve_middle_11, Axis=list_item_31)  # -> Geometry, Transform; disabled
list_item_35 = ListItem(List=explode_11.Segments, Index=number_slider_30, Wrap=True)  # disabled
boundary_surfaces_6 = BoundarySurfaces(Edges=rotate_3d_12.Geometry)  # disabled
curve_middle_13 = CurveMiddle(Curve=list_item_35)  # disabled
deconstruct_brep_11 = DeconstructBrep(Brep=boundary_surfaces_6)  # -> Faces, Edges, Vertices; disabled
vector_2pt_4 = Vector2Pt(PointA=curve_middle_13, PointB=list_item_34, Unitize=False)  # -> Vector, Length; disabled
number_slider_31 = Slider(0, range=0..1)  # disabled
number_slider_32 = Slider(0, range=0..2)  # disabled
construct_plane_8 = ConstructPlane(Origin=curve_middle_13, XAxis=vector_2pt_4.Vector, YAxis=Vector(0, 1, 0))  # disabled
rotate_3d_13 = Rotate3D(Geometry=deconstruct_brep_11.Faces, Angle=negative_8, Center=curve_middle_11, Axis=list_item_31)  # -> Geometry, Transform; disabled
geometry_8 = Geometry(list_item_33)  # disabled
orient_11 = Orient(Geometry=geometry_8, Source=construct_plane_8, Target=rotate_plane_8)  # -> Geometry, Transform; disabled
negative_9 = Negative(Value=pi)  # disabled
rotate_3d_14 = Rotate3D(Geometry=orient_11.Geometry, Angle=negative_9, Center=rotate_plane_8, Axis=list_item_32)  # -> Geometry, Transform; disabled
deconstruct_brep_12 = DeconstructBrep(Brep=rotate_3d_14.Geometry)  # -> Faces, Edges, Vertices; disabled
list_item_36 = ListItem(List=deconstruct_brep_12.Edges, Index=number_slider_31, Wrap=True)  # disabled
list_item_37 = ListItem(List=list_item_36, Index=number_slider_32, Wrap=True)  # disabled
curve_middle_14 = CurveMiddle(Curve=reverse(list_item_37))  # disabled
construct_plane_9 = ConstructPlane(Origin=curve_middle_14, XAxis=list_item_37, YAxis=Vector(0, 1, 0))  # disabled
pi_14 = Pi(Factor=1)  # disabled
rotate_plane_9 = RotatePlane(Plane=construct_plane_9, Angle=pi_14)  # disabled
geometry_9 = Geometry(deconstruct_brep_12.Edges)  # disabled
negative_10 = Negative(Value=pi)  # disabled
orient_12 = Orient(Geometry=geometry_9, Source=rotate_plane_9, Target=construct_plane_9)  # -> Geometry, Transform; disabled
merge_2 = Merge(
    Data1=rotate_3d_2.Geometry,
    Data2=rotate_3d_4.Geometry,
    Data3=rotate_3d_7.Geometry,
    Data4=rotate_3d_11.Geometry,
    Data5=deconstruct_brep_12.Faces)  # disabled
panel_20 = Panel(negative_10)  # disabled
rotate_3d_15 = Rotate3D(Geometry=orient_12.Geometry, Angle=negative_10, Center=curve_middle_14, Axis=list_item_37)  # -> Geometry, Transform; disabled
boundary_surfaces_7 = BoundarySurfaces(Edges=rotate_3d_15.Geometry)  # disabled
number_slider_33 = Slider(1, range=0..10)  # disabled
unit_z = UnitZ(Factor=1)  # disabled
deconstruct_brep_13 = DeconstructBrep(Brep=boundary_surfaces_7)  # -> Faces, Edges, Vertices; disabled
boundary_surfaces_8 = BoundarySurfaces(Edges=merge_2)  # disabled
list_item_38 = ListItem(List=flatten(triangular.Cells), Index=number_slider_33, Wrap=True)  # disabled
deconstruct_brep_14 = DeconstructBrep(Brep=list_item_38)  # -> Faces, Edges, Vertices; disabled
list_item_39 = ListItem(List=flatten(deconstruct_brep_14.Vertices), Index=0, Wrap=True)  # disabled
construct_plane_10 = ConstructPlane(Origin=list_item_39, XAxis=unit_z, YAxis=Vector(0, 1, 0))  # disabled
merge_3 = Merge(
    Data1=boundary_surfaces_8,
    Data2=deconstruct_brep_13.Faces,
    Data3=rotate_3d_13.Geometry,
    Data4=rotate_3d_10.Geometry,
    Data5=rotate_3d_8.Geometry,
    Data6=rotate_3d_5.Geometry,
    Data7=deconstruct_brep_3.Faces)  # disabled
surface = Surface(boundary_surfaces_2)  # disabled
mirror_3 = Mirror(Geometry=merge_3, Plane=construct_plane_10)  # -> Geometry, Transform; disabled

cluster = Cluster_6()  # -> i_2, i
cluster_2 = Cluster_5(curve=cluster.i_2)
cluster_3 = Cluster_4(
    geometry_10=cluster.i_2,
    source_10=cluster_2,
    relay=cluster.i_2,
    value_10=pi,
    geometry_8=cluster.i_2,
    source_8=cluster_2,
    value_8=pi,
    geometry_9=cluster.i_2,
    source_9=cluster_2,
    value_9=pi,
    geometry_12=cluster.i,
    angle=pi,
    curve=cluster.i,
    geometry_7=cluster.i_2,
    geometry_13=cluster.i_2,
    source_7=cluster_2,
    source_11=cluster_2,
    value_11=pi,
    value_7=pi,
    geometry_14=cluster.i_2,
    source_12=cluster_2,
    value_12=pi,
    geometry_15=cluster.i_2,
    source_13=cluster_2,
    value_13=pi,
    geometry_16=cluster.i_2,
    source_14=cluster_2,
    value_14=pi,
    geometry_17=cluster.i_2,
    source_15=cluster_2,
    value_15=pi,
    geometry_18=cluster.i_2,
    source_16=cluster_2,
    value_16=pi,
    geometry_19=cluster.i_2,
    source_17=cluster_2,
    value_17=pi,
    geometry_20=cluster.i_2,
    source_18=cluster_2,
    value_18=pi,
    geometry_6=cluster.i_2,
    source_6=cluster_2,
    value_6=pi,
    geometry_5=cluster.i_2,
    source_5=cluster_2,
    value_5=pi,
    geometry_4=cluster.i_2,
    source_4=cluster_2,
    value_4=pi,
    geometry_3=cluster.i_2,
    source_3=cluster_2,
    value_3=pi,
    geometry_2=cluster.i_2,
    source_2=cluster_2,
    value_2=pi,
    geometry=cluster.i_2,
    source=cluster_2,
    value=pi)  # -> geometry_11, geometry_28, geometry_29, geometry_30, geometry_27, geometry_31, geometry_32, geometry_33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
merge_4 = Merge(
    Data1=cluster.i_2,
    Data2=cluster_3.geometry_30,
    Data3=cluster_3.geometry_11,
    Data4=cluster_3.geometry_31,
    Data5=cluster_3.geometry_28,
    Data6=cluster_3.geometry_32,
    Data7=cluster_3.geometry_29,
    Data8=cluster_3.geometry_33,
    Data9=cluster_3.geometry_27,
    Data10=cluster_3.geometry_34,
    Data11=cluster_3.geometry_26,
    Data12=cluster_3.geometry_35,
    Data13=cluster_3.geometry_25,
    Data14=cluster_3.geometry_36,
    Data15=cluster_3.geometry_24,
    Data16=cluster_3.geometry_37,
    Data17=cluster_3.geometry_23,
    Data18=cluster_3.geometry_38,
    Data19=cluster_3.geometry_22,
    Data20=cluster_3.geometry_21)
multipipe = MultiPipe(Curves=merge_4, NodeSize=Slider(0.14, range=0..1), EndOffset=1, StrutSize=1, Segment=0, KinkAngle=0.6, CubeFit=0, Caps=0)
relay = Relay()

# ==== cluster Cluster_4
geometry = ClusterInput()
source = ClusterInput()
value = ClusterInput()
geometry_2 = ClusterInput()
source_2 = ClusterInput()
value_2 = ClusterInput()
geometry_3 = ClusterInput()
source_3 = ClusterInput()
value_3 = ClusterInput()
geometry_4 = ClusterInput()
source_4 = ClusterInput()
value_4 = ClusterInput()
geometry_5 = ClusterInput()
source_5 = ClusterInput()
value_5 = ClusterInput()
geometry_6 = ClusterInput()
source_6 = ClusterInput()
value_6 = ClusterInput()
geometry_7 = ClusterInput()
source_7 = ClusterInput()
value_7 = ClusterInput()
geometry_8 = ClusterInput()
source_8 = ClusterInput()
value_8 = ClusterInput()
geometry_9 = ClusterInput()
source_9 = ClusterInput()
value_9 = ClusterInput()
geometry_10 = ClusterInput()
source_10 = ClusterInput()
relay = ClusterInput()
value_10 = ClusterInput()
cluster = Cluster(geometry=geometry_10, source=source_10, relay=relay, value=value_10)
geometry_11 = ClusterOutput(cluster)
geometry_12 = ClusterInput()
angle = ClusterInput()
curve = ClusterInput()
geometry_13 = ClusterInput()
source_11 = ClusterInput()
value_11 = ClusterInput()
geometry_14 = ClusterInput()
source_12 = ClusterInput()
value_12 = ClusterInput()
geometry_15 = ClusterInput()
source_13 = ClusterInput()
value_13 = ClusterInput()
geometry_16 = ClusterInput()
source_14 = ClusterInput()
value_14 = ClusterInput()
geometry_17 = ClusterInput()
source_15 = ClusterInput()
value_15 = ClusterInput()
geometry_18 = ClusterInput()
source_16 = ClusterInput()
value_16 = ClusterInput()
geometry_19 = ClusterInput()
source_17 = ClusterInput()
value_17 = ClusterInput()
geometry_20 = ClusterInput()
source_18 = ClusterInput()
value_18 = ClusterInput()
cluster_2 = Cluster_3(
    geometry_9=geometry_12,
    angle=angle,
    curve=curve,
    geometry_5=geometry_13,
    source_5=source_11,
    value_5=value_11,
    geometry_6=geometry_14,
    source_6=source_12,
    value_6=value_12,
    geometry_7=geometry_15,
    source_7=source_13,
    value_7=value_13,
    geometry_8=geometry_16,
    source_8=source_14,
    value_8=value_14,
    geometry_4=geometry_17,
    source_4=source_15,
    value_4=value_15,
    geometry_3=geometry_18,
    source_3=source_16,
    value_3=value_16,
    geometry_2=geometry_19,
    source_2=source_17,
    value_2=value_17,
    geometry=geometry_20,
    source=source_18,
    value=value_18)  # -> geometry_13, geometry_15, geometry_16, geometry_17, geometry_18, geometry_14, geometry_12, geometry_11, geometry_10
cluster_3 = Cluster_2(geometry=geometry, source=source, relay=cluster_2.geometry_10, value=value)
cluster_4 = Cluster(geometry=geometry_2, source=source_2, relay=cluster_2.geometry_11, value=value_2)
cluster_5 = Cluster_2(geometry=geometry_3, source=source_3, relay=cluster_2.geometry_12, value=value_3)
cluster_6 = Cluster(geometry=geometry_4, source=source_4, relay=cluster_2.geometry_14, value=value_4)
cluster_7 = Cluster_2(geometry=geometry_5, source=source_5, relay=cluster_2.geometry_18, value=value_5)
geometry_21 = ClusterOutput(cluster_3)
cluster_8 = Cluster(geometry=geometry_6, source=source_6, relay=cluster_2.geometry_17, value=value_6)
geometry_22 = ClusterOutput(cluster_4)
cluster_9 = Cluster_2(geometry=geometry_7, source=source_7, relay=cluster_2.geometry_16, value=value_7)
cluster_10 = Cluster_2(geometry=geometry_8, source=source_8, relay=cluster_2.geometry_13, value=value_8)
geometry_23 = ClusterOutput(cluster_5)
cluster_11 = Cluster(geometry=geometry_9, source=source_9, relay=cluster_2.geometry_15, value=value_9)
geometry_24 = ClusterOutput(cluster_6)
geometry_25 = ClusterOutput(cluster_7)
geometry_26 = ClusterOutput(cluster_8)
geometry_27 = ClusterOutput(cluster_9)
geometry_28 = ClusterOutput(cluster_10)
geometry_29 = ClusterOutput(cluster_11)
geometry_30 = ClusterOutput(cluster_2.geometry_13)
geometry_31 = ClusterOutput(cluster_2.geometry_15)
geometry_32 = ClusterOutput(cluster_2.geometry_16)
geometry_33 = ClusterOutput(cluster_2.geometry_17)
geometry_34 = ClusterOutput(cluster_2.geometry_18)
geometry_35 = ClusterOutput(cluster_2.geometry_14)
geometry_36 = ClusterOutput(cluster_2.geometry_12)
geometry_37 = ClusterOutput(cluster_2.geometry_11)
geometry_38 = ClusterOutput(cluster_2.geometry_10)

# ==== cluster Cluster_5
curve = ClusterInput()
explode = Explode(Curve=curve, Recursive=True)  # -> Segments, Vertices
list_item = ListItem(List=explode.Segments, Index=Slider(2, range=0..2), Wrap=True)
list_item_2 = ListItem(List=explode.Vertices, Index=Slider(1, range=0..2), Wrap=True)
curve_middle = CurveMiddle(Curve=list_item)
vector_2pt = Vector2Pt(PointA=curve_middle, PointB=list_item_2, Unitize=False)  # -> Vector, Length
construct_plane = ConstructPlane(Origin=curve_middle, XAxis=vector_2pt.Vector, YAxis=Vector(0, 1, 0))
plane = ClusterOutput(construct_plane)

# ==== cluster Cluster_6
triangular = Triangular(Plane=PlaneXY(0, 0, 0), Size=1, ExtentX="10", ExtentY="3")  # -> simplify(Cells), Points
split_tree = SplitTree(Data=triangular.Cells, Masks=flatten("{*}[1]"))  # -> Positive, Negative
boolean_toggle = BooleanToggle(True)
clean_tree = CleanTree(RemoveNulls=True, RemoveInvalid=True, RemoveEmpty=boolean_toggle, Tree=split_tree.Positive)
split_tree_2 = SplitTree(Data=flatten(clean_tree), Masks=flatten("{*}[0,2,...]"))  # -> Positive, Negative
clean_tree_2 = CleanTree(RemoveNulls=True, RemoveInvalid=True, RemoveEmpty=boolean_toggle, Tree=split_tree_2.Positive)
clean_tree_3 = CleanTree(RemoveNulls=True, RemoveInvalid=True, RemoveEmpty=boolean_toggle, Tree=split_tree_2.Negative)
curve = Curve(clean_tree_2)
curve_2 = Curve(clean_tree_3)
list_item = ListItem(List=curve_2, Index=Slider(0, range=0..10), Wrap=True)
list_item_2 = ListItem(List=curve, Index=Slider(0, range=0..10), Wrap=True)
i = ClusterOutput(list_item)
i_2 = ClusterOutput(list_item_2)

# ==== cluster Cluster
relay = ClusterInput()
explode = Explode(Curve=relay, Recursive=True)  # -> Segments, Vertices
deconstruct_brep = DeconstructBrep(Brep=relay)  # -> Faces, Edges, Vertices
list_item = ListItem(List=explode.Segments, Index=Slider(1, range=0..2), Wrap=True)
curve_middle = CurveMiddle(Curve=list_item)
plane_normal = PlaneNormal(Origin=curve_middle, ZAxis=deconstruct_brep.Faces)
pi = Pi(Factor=1)
align_plane = AlignPlane(Plane=plane_normal, Direction=list_item)  # -> Plane, Angle
rotate = Rotate(Geometry=align_plane.Plane, Angle=pi, Plane=align_plane.Plane)  # -> Geometry, Transform
pi_2 = Pi(Factor=".5")
rotate_plane = RotatePlane(Plane=rotate.Geometry, Angle=pi_2)
geometry = ClusterInput()
source = ClusterInput()
value = ClusterInput()
orient = Orient(Geometry=geometry, Source=source, Target=rotate_plane)  # -> Geometry, Transform
negative = Negative(Value=value)
rotate_3d = Rotate3D(Geometry=orient.Geometry, Angle=negative, Center=rotate_plane, Axis=list_item)  # -> Geometry, Transform
geometry_2 = ClusterOutput(rotate_3d.Geometry)

# ==== cluster Cluster_2
relay = ClusterInput()
explode = Explode(Curve=relay, Recursive=True)  # -> Segments, Vertices
deconstruct_brep = DeconstructBrep(Brep=relay)  # -> Faces, Edges, Vertices
list_item = ListItem(List=explode.Segments, Index=Slider(0, range=0..2), Wrap=True)
curve_middle = CurveMiddle(Curve=list_item)
plane_normal = PlaneNormal(Origin=curve_middle, ZAxis=deconstruct_brep.Faces)
pi = Pi(Factor=1)
align_plane = AlignPlane(Plane=plane_normal, Direction=list_item)  # -> Plane, Angle
rotate = Rotate(Geometry=align_plane.Plane, Angle=pi, Plane=align_plane.Plane)  # -> Geometry, Transform
pi_2 = Pi(Factor=".5")
rotate_plane = RotatePlane(Plane=rotate.Geometry, Angle=pi_2)
geometry = ClusterInput()
source = ClusterInput()
value = ClusterInput()
orient = Orient(Geometry=geometry, Source=source, Target=rotate_plane)  # -> Geometry, Transform
negative = Negative(Value=value)
rotate_3d = Rotate3D(Geometry=orient.Geometry, Angle=negative, Center=rotate_plane, Axis=list_item)  # -> Geometry, Transform
geometry_2 = ClusterOutput(rotate_3d.Geometry)

# ==== cluster Cluster_3
pi = Pi(Factor=1)
pi_2 = Pi(Factor=1)
pi_3 = Pi(Factor=1)
pi_4 = Pi(Factor=1)
pi_5 = Pi(Factor=1)
pi_6 = Pi(Factor=1)
pi_7 = Pi(Factor=1)
pi_8 = Pi(Factor=".5")
pi_9 = Pi(Factor=1)
pi_10 = Pi(Factor=".5")
pi_11 = Pi(Factor=".5")
pi_12 = Pi(Factor=".5")
pi_13 = Pi(Factor=".5")
pi_14 = Pi(Factor=".5")
curve = ClusterInput()
pi_15 = Pi(Factor=".5")
geometry = ClusterInput()
source = ClusterInput()
pi_16 = Pi(Factor=".5")
value = ClusterInput()
geometry_2 = ClusterInput()
source_2 = ClusterInput()
value_2 = ClusterInput()
explode = Explode(Curve=curve, Recursive=True)  # -> Segments, Vertices
geometry_3 = ClusterInput()
source_3 = ClusterInput()
negative = Negative(Value=value)
value_3 = ClusterInput()
negative_2 = Negative(Value=value_2)
geometry_4 = ClusterInput()
source_4 = ClusterInput()
value_4 = ClusterInput()
geometry_5 = ClusterInput()
source_5 = ClusterInput()
geometry_6 = ClusterInput()
source_6 = ClusterInput()
value_5 = ClusterInput()
value_6 = ClusterInput()
geometry_7 = ClusterInput()
source_7 = ClusterInput()
negative_3 = Negative(Value=value_3)
value_7 = ClusterInput()
geometry_8 = ClusterInput()
source_8 = ClusterInput()
value_8 = ClusterInput()
negative_4 = Negative(Value=value_4)
negative_5 = Negative(Value=value_5)
negative_6 = Negative(Value=value_6)
negative_7 = Negative(Value=value_7)
list_item = ListItem(List=flatten(explode.Segments), Index=Slider(2, range=0..2), Wrap=True)
negative_8 = Negative(Value=value_8)
geometry_9 = ClusterInput()
angle = ClusterInput()
rotate_3d = Rotate3D(Geometry=geometry_9, Angle=angle, Center=Point(0, 0, 0), Axis=list_item)  # -> Geometry, Transform
explode_2 = Explode(Curve=rotate_3d.Geometry, Recursive=True)  # -> Segments, Vertices
deconstruct_brep = DeconstructBrep(Brep=rotate_3d.Geometry)  # -> Faces, Edges, Vertices
list_item_2 = ListItem(List=explode_2.Segments, Index=Slider(1, range=0..2), Wrap=True)
curve_middle = CurveMiddle(Curve=list_item_2)
plane_normal = PlaneNormal(Origin=curve_middle, ZAxis=deconstruct_brep.Faces)
align_plane = AlignPlane(Plane=plane_normal, Direction=list_item_2)  # -> Plane, Angle
rotate = Rotate(Geometry=align_plane.Plane, Angle=pi_5, Plane=align_plane.Plane)  # -> Geometry, Transform
rotate_plane = RotatePlane(Plane=rotate.Geometry, Angle=pi_13)
orient = Orient(Geometry=geometry_5, Source=source_5, Target=rotate_plane)  # -> Geometry, Transform
rotate_3d_2 = Rotate3D(Geometry=orient.Geometry, Angle=negative_5, Center=rotate_plane, Axis=list_item_2)  # -> Geometry, Transform
explode_3 = Explode(Curve=rotate_3d_2.Geometry, Recursive=True)  # -> Segments, Vertices
deconstruct_brep_2 = DeconstructBrep(Brep=rotate_3d_2.Geometry)  # -> Faces, Edges, Vertices
list_item_3 = ListItem(List=explode_3.Segments, Index=Slider(0, range=0..2), Wrap=True)
curve_middle_2 = CurveMiddle(Curve=list_item_3)
plane_normal_2 = PlaneNormal(Origin=curve_middle_2, ZAxis=deconstruct_brep_2.Faces)
align_plane_2 = AlignPlane(Plane=plane_normal_2, Direction=list_item_3)  # -> Plane, Angle
rotate_2 = Rotate(Geometry=align_plane_2.Plane, Angle=pi_6, Plane=align_plane_2.Plane)  # -> Geometry, Transform
rotate_plane_2 = RotatePlane(Plane=rotate_2.Geometry, Angle=pi_14)
orient_2 = Orient(Geometry=geometry_6, Source=source_6, Target=rotate_plane_2)  # -> Geometry, Transform
rotate_3d_3 = Rotate3D(Geometry=orient_2.Geometry, Angle=negative_6, Center=rotate_plane_2, Axis=list_item_3)  # -> Geometry, Transform
explode_4 = Explode(Curve=rotate_3d_3.Geometry, Recursive=True)  # -> Segments, Vertices
deconstruct_brep_3 = DeconstructBrep(Brep=rotate_3d_3.Geometry)  # -> Faces, Edges, Vertices
list_item_4 = ListItem(List=explode_4.Segments, Index=Slider(1, range=0..2), Wrap=True)
curve_middle_3 = CurveMiddle(Curve=list_item_4)
plane_normal_3 = PlaneNormal(Origin=curve_middle_3, ZAxis=deconstruct_brep_3.Faces)
align_plane_3 = AlignPlane(Plane=plane_normal_3, Direction=list_item_4)  # -> Plane, Angle
rotate_3 = Rotate(Geometry=align_plane_3.Plane, Angle=pi_7, Plane=align_plane_3.Plane)  # -> Geometry, Transform
rotate_plane_3 = RotatePlane(Plane=rotate_3.Geometry, Angle=pi_15)
orient_3 = Orient(Geometry=geometry_7, Source=source_7, Target=rotate_plane_3)  # -> Geometry, Transform
rotate_3d_4 = Rotate3D(Geometry=orient_3.Geometry, Angle=negative_7, Center=rotate_plane_3, Axis=list_item_4)  # -> Geometry, Transform
explode_5 = Explode(Curve=rotate_3d_4.Geometry, Recursive=True)  # -> Segments, Vertices
deconstruct_brep_4 = DeconstructBrep(Brep=rotate_3d_4.Geometry)  # -> Faces, Edges, Vertices
list_item_5 = ListItem(List=explode_5.Segments, Index=Slider(0, range=0..2), Wrap=True)
curve_middle_4 = CurveMiddle(Curve=list_item_5)
plane_normal_4 = PlaneNormal(Origin=curve_middle_4, ZAxis=deconstruct_brep_4.Faces)
align_plane_4 = AlignPlane(Plane=plane_normal_4, Direction=list_item_5)  # -> Plane, Angle
rotate_4 = Rotate(Geometry=align_plane_4.Plane, Angle=pi_9, Plane=align_plane_4.Plane)  # -> Geometry, Transform
rotate_plane_4 = RotatePlane(Plane=rotate_4.Geometry, Angle=pi_16)
orient_4 = Orient(Geometry=geometry_8, Source=source_8, Target=rotate_plane_4)  # -> Geometry, Transform
rotate_3d_5 = Rotate3D(Geometry=orient_4.Geometry, Angle=negative_8, Center=rotate_plane_4, Axis=list_item_5)  # -> Geometry, Transform
explode_6 = Explode(Curve=rotate_3d_5.Geometry, Recursive=True)  # -> Segments, Vertices
deconstruct_brep_5 = DeconstructBrep(Brep=rotate_3d_5.Geometry)  # -> Faces, Edges, Vertices
list_item_6 = ListItem(List=explode_6.Segments, Index=Slider(1, range=0..2), Wrap=True)
curve_middle_5 = CurveMiddle(Curve=list_item_6)
plane_normal_5 = PlaneNormal(Origin=curve_middle_5, ZAxis=deconstruct_brep_5.Faces)
align_plane_5 = AlignPlane(Plane=plane_normal_5, Direction=list_item_6)  # -> Plane, Angle
rotate_5 = Rotate(Geometry=align_plane_5.Plane, Angle=pi_4, Plane=align_plane_5.Plane)  # -> Geometry, Transform
rotate_plane_5 = RotatePlane(Plane=rotate_5.Geometry, Angle=pi_12)
orient_5 = Orient(Geometry=geometry_4, Source=source_4, Target=rotate_plane_5)  # -> Geometry, Transform
rotate_3d_6 = Rotate3D(Geometry=orient_5.Geometry, Angle=negative_4, Center=rotate_plane_5, Axis=list_item_6)  # -> Geometry, Transform
explode_7 = Explode(Curve=rotate_3d_6.Geometry, Recursive=True)  # -> Segments, Vertices
deconstruct_brep_6 = DeconstructBrep(Brep=rotate_3d_6.Geometry)  # -> Faces, Edges, Vertices
list_item_7 = ListItem(List=explode_7.Segments, Index=Slider(0, range=0..2), Wrap=True)
curve_middle_6 = CurveMiddle(Curve=list_item_7)
plane_normal_6 = PlaneNormal(Origin=curve_middle_6, ZAxis=deconstruct_brep_6.Faces)
align_plane_6 = AlignPlane(Plane=plane_normal_6, Direction=list_item_7)  # -> Plane, Angle
rotate_6 = Rotate(Geometry=align_plane_6.Plane, Angle=pi_3, Plane=align_plane_6.Plane)  # -> Geometry, Transform
rotate_plane_6 = RotatePlane(Plane=rotate_6.Geometry, Angle=pi_11)
orient_6 = Orient(Geometry=geometry_3, Source=source_3, Target=rotate_plane_6)  # -> Geometry, Transform
rotate_3d_7 = Rotate3D(Geometry=orient_6.Geometry, Angle=negative_3, Center=rotate_plane_6, Axis=list_item_7)  # -> Geometry, Transform
explode_8 = Explode(Curve=rotate_3d_7.Geometry, Recursive=True)  # -> Segments, Vertices
deconstruct_brep_7 = DeconstructBrep(Brep=rotate_3d_7.Geometry)  # -> Faces, Edges, Vertices
list_item_8 = ListItem(List=explode_8.Segments, Index=Slider(1, range=0..2), Wrap=True)
curve_middle_7 = CurveMiddle(Curve=list_item_8)
plane_normal_7 = PlaneNormal(Origin=curve_middle_7, ZAxis=deconstruct_brep_7.Faces)
align_plane_7 = AlignPlane(Plane=plane_normal_7, Direction=list_item_8)  # -> Plane, Angle
rotate_7 = Rotate(Geometry=align_plane_7.Plane, Angle=pi_2, Plane=align_plane_7.Plane)  # -> Geometry, Transform
rotate_plane_7 = RotatePlane(Plane=rotate_7.Geometry, Angle=pi_10)
orient_7 = Orient(Geometry=geometry_2, Source=source_2, Target=rotate_plane_7)  # -> Geometry, Transform
rotate_3d_8 = Rotate3D(Geometry=orient_7.Geometry, Angle=negative_2, Center=rotate_plane_7, Axis=list_item_8)  # -> Geometry, Transform
explode_9 = Explode(Curve=rotate_3d_8.Geometry, Recursive=True)  # -> Segments, Vertices
deconstruct_brep_8 = DeconstructBrep(Brep=rotate_3d_8.Geometry)  # -> Faces, Edges, Vertices
list_item_9 = ListItem(List=explode_9.Segments, Index=Slider(0, range=0..2), Wrap=True)
curve_middle_8 = CurveMiddle(Curve=list_item_9)
plane_normal_8 = PlaneNormal(Origin=curve_middle_8, ZAxis=deconstruct_brep_8.Faces)
align_plane_8 = AlignPlane(Plane=plane_normal_8, Direction=list_item_9)  # -> Plane, Angle
rotate_8 = Rotate(Geometry=align_plane_8.Plane, Angle=pi, Plane=align_plane_8.Plane)  # -> Geometry, Transform
rotate_plane_8 = RotatePlane(Plane=rotate_8.Geometry, Angle=pi_8)
orient_8 = Orient(Geometry=geometry, Source=source, Target=rotate_plane_8)  # -> Geometry, Transform
rotate_3d_9 = Rotate3D(Geometry=orient_8.Geometry, Angle=negative, Center=rotate_plane_8, Axis=list_item_9)  # -> Geometry, Transform
geometry_10 = ClusterOutput(rotate_3d_9.Geometry)
geometry_11 = ClusterOutput(rotate_3d_8.Geometry)
geometry_12 = ClusterOutput(rotate_3d_7.Geometry)
geometry_13 = ClusterOutput(rotate_3d.Geometry)
geometry_14 = ClusterOutput(rotate_3d_6.Geometry)
geometry_15 = ClusterOutput(rotate_3d_2.Geometry)
geometry_16 = ClusterOutput(rotate_3d_3.Geometry)
geometry_17 = ClusterOutput(rotate_3d_4.Geometry)
geometry_18 = ClusterOutput(rotate_3d_5.Geometry)
