# Grasshopper definition Wolfram_Geometry_HS_004_Oscar_LIVE.gh (Grasshopper 1.0.7)
# plug-ins: Kangaroo2 Components

# ----
# Oscillation
trigger = Trigger(Interval=20, TimerInterval=20, Target=data_recorder)  # disabled
panel = Panel("1")  # disabled
data_recorder = DataRecorder(panel, DataLimit=10000, RecordData=True)
number_slider = Slider(22.824, range=0..100)  # disabled
list_length = ListLength(List=data_recorder)  # disabled
division = Division(A=list_length, B=number_slider)  # disabled
sine = Sine(Value=division)  # disabled
number_slider_2 = Slider(0.22, range=0..1)  # disabled
absolute = Absolute(Value=sine)  # disabled
multiplication = Multiplication(A=number_slider_2, B=absolute)  # disabled
panel_2 = Panel(multiplication)  # disabled

construct_point = ConstructPoint(XCoordinate=0, YCoordinate=Slider(0, range=0..10), ZCoordinate=0)
pi = Pi(Factor=Slider(0.005, range=0..1))
pi_2 = Pi(Factor=Slider(0.075, range=0..1))
triangular = Triangular(Plane=PlaneXY(0, 0, 0), Size=1, ExtentX="10", ExtentY="3")  # -> simplify(Cells), Points
triangular_2 = Triangular(Plane=construct_point, Size=1, ExtentX="10", ExtentY="3")  # -> simplify(Cells), Points
param_viewer = ParamViewer(triangular.Cells)
split_tree = SplitTree(Data=triangular.Cells, Masks=flatten("{*}[1]"))  # -> Positive, Negative
split_tree_2 = SplitTree(Data=triangular_2.Cells, Masks=flatten("{*}[1]"))  # -> Positive, Negative
boolean_toggle = BooleanToggle(True)
boolean_toggle_2 = BooleanToggle(True)
panel_3 = Panel(split_tree.Positive)
clean_tree = CleanTree(RemoveNulls=True, RemoveInvalid=True, RemoveEmpty=boolean_toggle, Tree=split_tree.Positive)
clean_tree_2 = CleanTree(RemoveNulls=True, RemoveInvalid=True, RemoveEmpty=boolean_toggle_2, Tree=split_tree_2.Positive)
panel_4 = Panel(clean_tree)
split_tree_3 = SplitTree(Data=flatten(clean_tree_2), Masks=flatten("{*}[0,2,...]"))  # -> Positive, Negative
split_tree_4 = SplitTree(Data=flatten(clean_tree), Masks=flatten("{*}[0,2,...]"))  # -> Positive, Negative
clean_tree_3 = CleanTree(RemoveNulls=True, RemoveInvalid=True, RemoveEmpty=boolean_toggle, Tree=split_tree_4.Positive)
clean_tree_4 = CleanTree(RemoveNulls=True, RemoveInvalid=True, RemoveEmpty=boolean_toggle, Tree=split_tree_4.Negative)
clean_tree_5 = CleanTree(RemoveNulls=True, RemoveInvalid=True, RemoveEmpty=boolean_toggle_2, Tree=split_tree_3.Positive)
clean_tree_6 = CleanTree(RemoveNulls=True, RemoveInvalid=True, RemoveEmpty=boolean_toggle_2, Tree=split_tree_3.Negative)
curve = Curve(clean_tree_4)
curve_2 = Curve(clean_tree_3)
curve_3 = Curve(clean_tree_5)
curve_4 = Curve(clean_tree_6)
list_item = ListItem(List=curve_2, Index=Slider(0, range=0..5), Wrap=True)
list_item_2 = ListItem(List=curve_4, Index=Slider(0, range=0..10), Wrap=True)
list_item_3 = ListItem(List=curve_3, Index=Slider(0, range=0..10), Wrap=True)
list_item_4 = ListItem(List=curve, Index=Slider(0, range=0..5), Wrap=True)
explode = Explode(Curve=list_item, Recursive=True)  # -> Segments, Vertices
explode_2 = Explode(Curve=list_item_3, Recursive=True)  # -> Segments, Vertices
list_item_5 = ListItem(List=explode.Segments, Index=Slider(2, range=0..2), Wrap=True)
list_item_6 = ListItem(List=explode.Vertices, Index=Slider(1, range=0..2), Wrap=True)
list_item_7 = ListItem(List=explode_2.Segments, Index=Slider(2, range=0..2), Wrap=True)
list_item_8 = ListItem(List=explode_2.Vertices, Index=Slider(1, range=0..2), Wrap=True)
curve_middle = CurveMiddle(Curve=list_item_5)
curve_middle_2 = CurveMiddle(Curve=list_item_7)
vector_2pt = Vector2Pt(PointA=curve_middle_2, PointB=list_item_8, Unitize=False)  # -> Vector, Length
vector_2pt_2 = Vector2Pt(PointA=curve_middle, PointB=list_item_6, Unitize=False)  # -> Vector, Length
construct_plane = ConstructPlane(Origin=curve_middle, XAxis=vector_2pt_2.Vector, YAxis=Vector(0, 1, 0))
construct_plane_2 = ConstructPlane(Origin=curve_middle_2, XAxis=vector_2pt.Vector, YAxis=Vector(0, 1, 0))
vector_display = VectorDisplay(Anchor=curve_middle, Vector=vector_2pt_2.Vector)
vector_display_2 = VectorDisplay(Anchor=curve_middle_2, Vector=vector_2pt.Vector)
cluster = Cluster_4(
    geometry_10=list_item_3,
    source_10=construct_plane_2,
    relay=list_item_3,
    value_10=pi_2,
    geometry_8=list_item_3,
    source_8=construct_plane_2,
    value_8=pi_2,
    geometry_9=list_item_3,
    source_9=construct_plane_2,
    value_9=pi_2,
    geometry_12=list_item_2,
    angle=pi_2,
    curve=list_item_2,
    geometry_7=list_item_3,
    geometry_13=list_item_3,
    source_7=construct_plane_2,
    source_11=construct_plane_2,
    value_11=pi_2,
    value_7=pi_2,
    geometry_14=list_item_3,
    source_12=construct_plane_2,
    value_12=pi_2,
    geometry_15=list_item_3,
    source_13=construct_plane_2,
    value_13=pi_2,
    geometry_16=list_item_3,
    source_14=construct_plane_2,
    value_14=pi_2,
    geometry_17=list_item_3,
    source_15=construct_plane_2,
    value_15=pi_2,
    geometry_18=list_item_3,
    source_16=construct_plane_2,
    value_16=pi_2,
    geometry_19=list_item_3,
    source_17=construct_plane_2,
    value_17=pi_2,
    geometry_20=list_item_3,
    source_18=construct_plane_2,
    value_18=pi_2,
    geometry_6=list_item_3,
    source_6=construct_plane_2,
    value_6=pi_2,
    geometry_5=list_item_3,
    source_5=construct_plane_2,
    value_5=pi_2,
    geometry_4=list_item_3,
    source_4=construct_plane_2,
    value_4=pi_2,
    geometry_3=list_item_3,
    source_3=construct_plane_2,
    value_3=pi_2,
    geometry_2=list_item_3,
    source_2=construct_plane_2,
    value_2=pi_2,
    geometry=list_item_3,
    source=construct_plane_2,
    value=pi_2)  # -> geometry_11, geometry_28, geometry_29, geometry_30, geometry_27, geometry_31, geometry_32, geometry_33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
merge = Merge(
    Data1=list_item_3,
    Data2=cluster.geometry_30,
    Data3=cluster.geometry_11,
    Data4=cluster.geometry_31,
    Data5=cluster.geometry_28,
    Data6=cluster.geometry_32,
    Data7=cluster.geometry_29,
    Data8=cluster.geometry_33,
    Data9=cluster.geometry_27,
    Data10=cluster.geometry_34,
    Data11=cluster.geometry_26,
    Data12=cluster.geometry_35,
    Data13=cluster.geometry_25,
    Data14=cluster.geometry_36,
    Data15=cluster.geometry_24,
    Data16=cluster.geometry_37,
    Data17=cluster.geometry_23,
    Data18=cluster.geometry_38,
    Data19=cluster.geometry_22,
    Data20=cluster.geometry_21)
multipipe = MultiPipe(Curves=merge, NodeSize=Slider(0.14, range=0..1), EndOffset=1, StrutSize=1, Segment=0, KinkAngle=0.6, CubeFit=0, Caps=0)
relay = Relay()

# ==== cluster Cluster_4
geometry = ClusterInput()
source = ClusterInput()
value = ClusterInput()
geometry_2 = ClusterInput()
source_2 = ClusterInput()
value_2 = ClusterInput()
geometry_3 = ClusterInput()
source_3 = ClusterInput()
value_3 = ClusterInput()
geometry_4 = ClusterInput()
source_4 = ClusterInput()
value_4 = ClusterInput()
geometry_5 = ClusterInput()
source_5 = ClusterInput()
value_5 = ClusterInput()
geometry_6 = ClusterInput()
source_6 = ClusterInput()
value_6 = ClusterInput()
geometry_7 = ClusterInput()
source_7 = ClusterInput()
value_7 = ClusterInput()
geometry_8 = ClusterInput()
source_8 = ClusterInput()
value_8 = ClusterInput()
geometry_9 = ClusterInput()
source_9 = ClusterInput()
value_9 = ClusterInput()
geometry_10 = ClusterInput()
source_10 = ClusterInput()
relay = ClusterInput()
value_10 = ClusterInput()
cluster = Cluster(geometry=geometry_10, source=source_10, relay=relay, value=value_10)
geometry_11 = ClusterOutput(cluster)
geometry_12 = ClusterInput()
angle = ClusterInput()
curve = ClusterInput()
geometry_13 = ClusterInput()
source_11 = ClusterInput()
value_11 = ClusterInput()
geometry_14 = ClusterInput()
source_12 = ClusterInput()
value_12 = ClusterInput()
geometry_15 = ClusterInput()
source_13 = ClusterInput()
value_13 = ClusterInput()
geometry_16 = ClusterInput()
source_14 = ClusterInput()
value_14 = ClusterInput()
geometry_17 = ClusterInput()
source_15 = ClusterInput()
value_15 = ClusterInput()
geometry_18 = ClusterInput()
source_16 = ClusterInput()
value_16 = ClusterInput()
geometry_19 = ClusterInput()
source_17 = ClusterInput()
value_17 = ClusterInput()
geometry_20 = ClusterInput()
source_18 = ClusterInput()
value_18 = ClusterInput()
cluster_2 = Cluster_3(
    geometry_9=geometry_12,
    angle=angle,
    curve=curve,
    geometry_5=geometry_13,
    source_5=source_11,
    value_5=value_11,
    geometry_6=geometry_14,
    source_6=source_12,
    value_6=value_12,
    geometry_7=geometry_15,
    source_7=source_13,
    value_7=value_13,
    geometry_8=geometry_16,
    source_8=source_14,
    value_8=value_14,
    geometry_4=geometry_17,
    source_4=source_15,
    value_4=value_15,
    geometry_3=geometry_18,
    source_3=source_16,
    value_3=value_16,
    geometry_2=geometry_19,
    source_2=source_17,
    value_2=value_17,
    geometry=geometry_20,
    source=source_18,
    value=value_18)  # -> geometry_13, geometry_15, geometry_16, geometry_17, geometry_18, geometry_14, geometry_12, geometry_11, geometry_10
cluster_3 = Cluster_2(geometry=geometry, source=source, relay=cluster_2.geometry_10, value=value)
cluster_4 = Cluster(geometry=geometry_2, source=source_2, relay=cluster_2.geometry_11, value=value_2)
cluster_5 = Cluster_2(geometry=geometry_3, source=source_3, relay=cluster_2.geometry_12, value=value_3)
cluster_6 = Cluster(geometry=geometry_4, source=source_4, relay=cluster_2.geometry_14, value=value_4)
cluster_7 = Cluster_2(geometry=geometry_5, source=source_5, relay=cluster_2.geometry_18, value=value_5)
geometry_21 = ClusterOutput(cluster_3)
cluster_8 = Cluster(geometry=geometry_6, source=source_6, relay=cluster_2.geometry_17, value=value_6)
geometry_22 = ClusterOutput(cluster_4)
cluster_9 = Cluster_2(geometry=geometry_7, source=source_7, relay=cluster_2.geometry_16, value=value_7)
cluster_10 = Cluster_2(geometry=geometry_8, source=source_8, relay=cluster_2.geometry_13, value=value_8)
geometry_23 = ClusterOutput(cluster_5)
cluster_11 = Cluster(geometry=geometry_9, source=source_9, relay=cluster_2.geometry_15, value=value_9)
geometry_24 = ClusterOutput(cluster_6)
geometry_25 = ClusterOutput(cluster_7)
geometry_26 = ClusterOutput(cluster_8)
geometry_27 = ClusterOutput(cluster_9)
geometry_28 = ClusterOutput(cluster_10)
geometry_29 = ClusterOutput(cluster_11)
geometry_30 = ClusterOutput(cluster_2.geometry_13)
geometry_31 = ClusterOutput(cluster_2.geometry_15)
geometry_32 = ClusterOutput(cluster_2.geometry_16)
geometry_33 = ClusterOutput(cluster_2.geometry_17)
geometry_34 = ClusterOutput(cluster_2.geometry_18)
geometry_35 = ClusterOutput(cluster_2.geometry_14)
geometry_36 = ClusterOutput(cluster_2.geometry_12)
geometry_37 = ClusterOutput(cluster_2.geometry_11)
geometry_38 = ClusterOutput(cluster_2.geometry_10)

# ==== cluster Cluster
relay = ClusterInput()
explode = Explode(Curve=relay, Recursive=True)  # -> Segments, Vertices
deconstruct_brep = DeconstructBrep(Brep=relay)  # -> Faces, Edges, Vertices
list_item = ListItem(List=explode.Segments, Index=Slider(1, range=0..2), Wrap=True)
curve_middle = CurveMiddle(Curve=list_item)
plane_normal = PlaneNormal(Origin=curve_middle, ZAxis=deconstruct_brep.Faces)
pi = Pi(Factor=1)
align_plane = AlignPlane(Plane=plane_normal, Direction=list_item)  # -> Plane, Angle
rotate = Rotate(Geometry=align_plane.Plane, Angle=pi, Plane=align_plane.Plane)  # -> Geometry, Transform
pi_2 = Pi(Factor=".5")
rotate_plane = RotatePlane(Plane=rotate.Geometry, Angle=pi_2)
geometry = ClusterInput()
source = ClusterInput()
value = ClusterInput()
orient = Orient(Geometry=geometry, Source=source, Target=rotate_plane)  # -> Geometry, Transform
negative = Negative(Value=value)
rotate_3d = Rotate3D(Geometry=orient.Geometry, Angle=negative, Center=rotate_plane, Axis=list_item)  # -> Geometry, Transform
geometry_2 = ClusterOutput(rotate_3d.Geometry)

# ==== cluster Cluster_2
relay = ClusterInput()
explode = Explode(Curve=relay, Recursive=True)  # -> Segments, Vertices
deconstruct_brep = DeconstructBrep(Brep=relay)  # -> Faces, Edges, Vertices
list_item = ListItem(List=explode.Segments, Index=Slider(0, range=0..2), Wrap=True)
curve_middle = CurveMiddle(Curve=list_item)
plane_normal = PlaneNormal(Origin=curve_middle, ZAxis=deconstruct_brep.Faces)
pi = Pi(Factor=1)
align_plane = AlignPlane(Plane=plane_normal, Direction=list_item)  # -> Plane, Angle
rotate = Rotate(Geometry=align_plane.Plane, Angle=pi, Plane=align_plane.Plane)  # -> Geometry, Transform
pi_2 = Pi(Factor=".5")
rotate_plane = RotatePlane(Plane=rotate.Geometry, Angle=pi_2)
geometry = ClusterInput()
source = ClusterInput()
value = ClusterInput()
orient = Orient(Geometry=geometry, Source=source, Target=rotate_plane)  # -> Geometry, Transform
negative = Negative(Value=value)
rotate_3d = Rotate3D(Geometry=orient.Geometry, Angle=negative, Center=rotate_plane, Axis=list_item)  # -> Geometry, Transform
geometry_2 = ClusterOutput(rotate_3d.Geometry)

# ==== cluster Cluster_3
pi = Pi(Factor=1)
pi_2 = Pi(Factor=1)
pi_3 = Pi(Factor=1)
pi_4 = Pi(Factor=1)
pi_5 = Pi(Factor=1)
pi_6 = Pi(Factor=1)
pi_7 = Pi(Factor=1)
pi_8 = Pi(Factor=".5")
pi_9 = Pi(Factor=1)
pi_10 = Pi(Factor=".5")
pi_11 = Pi(Factor=".5")
pi_12 = Pi(Factor=".5")
pi_13 = Pi(Factor=".5")
pi_14 = Pi(Factor=".5")
curve = ClusterInput()
pi_15 = Pi(Factor=".5")
geometry = ClusterInput()
source = ClusterInput()
pi_16 = Pi(Factor=".5")
value = ClusterInput()
geometry_2 = ClusterInput()
source_2 = ClusterInput()
value_2 = ClusterInput()
explode = Explode(Curve=curve, Recursive=True)  # -> Segments, Vertices
geometry_3 = ClusterInput()
source_3 = ClusterInput()
negative = Negative(Value=value)
value_3 = ClusterInput()
negative_2 = Negative(Value=value_2)
geometry_4 = ClusterInput()
source_4 = ClusterInput()
value_4 = ClusterInput()
geometry_5 = ClusterInput()
source_5 = ClusterInput()
geometry_6 = ClusterInput()
source_6 = ClusterInput()
value_5 = ClusterInput()
value_6 = ClusterInput()
geometry_7 = ClusterInput()
source_7 = ClusterInput()
negative_3 = Negative(Value=value_3)
value_7 = ClusterInput()
geometry_8 = ClusterInput()
source_8 = ClusterInput()
value_8 = ClusterInput()
negative_4 = Negative(Value=value_4)
negative_5 = Negative(Value=value_5)
negative_6 = Negative(Value=value_6)
negative_7 = Negative(Value=value_7)
list_item = ListItem(List=flatten(explode.Segments), Index=Slider(2, range=0..2), Wrap=True)
negative_8 = Negative(Value=value_8)
geometry_9 = ClusterInput()
angle = ClusterInput()
rotate_3d = Rotate3D(Geometry=geometry_9, Angle=angle, Center=Point(0, 0, 0), Axis=list_item)  # -> Geometry, Transform
explode_2 = Explode(Curve=rotate_3d.Geometry, Recursive=True)  # -> Segments, Vertices
deconstruct_brep = DeconstructBrep(Brep=rotate_3d.Geometry)  # -> Faces, Edges, Vertices
list_item_2 = ListItem(List=explode_2.Segments, Index=Slider(1, range=0..2), Wrap=True)
curve_middle = CurveMiddle(Curve=list_item_2)
plane_normal = PlaneNormal(Origin=curve_middle, ZAxis=deconstruct_brep.Faces)
align_plane = AlignPlane(Plane=plane_normal, Direction=list_item_2)  # -> Plane, Angle
rotate = Rotate(Geometry=align_plane.Plane, Angle=pi_5, Plane=align_plane.Plane)  # -> Geometry, Transform
rotate_plane = RotatePlane(Plane=rotate.Geometry, Angle=pi_13)
orient = Orient(Geometry=geometry_5, Source=source_5, Target=rotate_plane)  # -> Geometry, Transform
rotate_3d_2 = Rotate3D(Geometry=orient.Geometry, Angle=negative_5, Center=rotate_plane, Axis=list_item_2)  # -> Geometry, Transform
explode_3 = Explode(Curve=rotate_3d_2.Geometry, Recursive=True)  # -> Segments, Vertices
deconstruct_brep_2 = DeconstructBrep(Brep=rotate_3d_2.Geometry)  # -> Faces, Edges, Vertices
list_item_3 = ListItem(List=explode_3.Segments, Index=Slider(0, range=0..2), Wrap=True)
curve_middle_2 = CurveMiddle(Curve=list_item_3)
plane_normal_2 = PlaneNormal(Origin=curve_middle_2, ZAxis=deconstruct_brep_2.Faces)
align_plane_2 = AlignPlane(Plane=plane_normal_2, Direction=list_item_3)  # -> Plane, Angle
rotate_2 = Rotate(Geometry=align_plane_2.Plane, Angle=pi_6, Plane=align_plane_2.Plane)  # -> Geometry, Transform
rotate_plane_2 = RotatePlane(Plane=rotate_2.Geometry, Angle=pi_14)
orient_2 = Orient(Geometry=geometry_6, Source=source_6, Target=rotate_plane_2)  # -> Geometry, Transform
rotate_3d_3 = Rotate3D(Geometry=orient_2.Geometry, Angle=negative_6, Center=rotate_plane_2, Axis=list_item_3)  # -> Geometry, Transform
explode_4 = Explode(Curve=rotate_3d_3.Geometry, Recursive=True)  # -> Segments, Vertices
deconstruct_brep_3 = DeconstructBrep(Brep=rotate_3d_3.Geometry)  # -> Faces, Edges, Vertices
list_item_4 = ListItem(List=explode_4.Segments, Index=Slider(1, range=0..2), Wrap=True)
curve_middle_3 = CurveMiddle(Curve=list_item_4)
plane_normal_3 = PlaneNormal(Origin=curve_middle_3, ZAxis=deconstruct_brep_3.Faces)
align_plane_3 = AlignPlane(Plane=plane_normal_3, Direction=list_item_4)  # -> Plane, Angle
rotate_3 = Rotate(Geometry=align_plane_3.Plane, Angle=pi_7, Plane=align_plane_3.Plane)  # -> Geometry, Transform
rotate_plane_3 = RotatePlane(Plane=rotate_3.Geometry, Angle=pi_15)
orient_3 = Orient(Geometry=geometry_7, Source=source_7, Target=rotate_plane_3)  # -> Geometry, Transform
rotate_3d_4 = Rotate3D(Geometry=orient_3.Geometry, Angle=negative_7, Center=rotate_plane_3, Axis=list_item_4)  # -> Geometry, Transform
explode_5 = Explode(Curve=rotate_3d_4.Geometry, Recursive=True)  # -> Segments, Vertices
deconstruct_brep_4 = DeconstructBrep(Brep=rotate_3d_4.Geometry)  # -> Faces, Edges, Vertices
list_item_5 = ListItem(List=explode_5.Segments, Index=Slider(0, range=0..2), Wrap=True)
curve_middle_4 = CurveMiddle(Curve=list_item_5)
plane_normal_4 = PlaneNormal(Origin=curve_middle_4, ZAxis=deconstruct_brep_4.Faces)
align_plane_4 = AlignPlane(Plane=plane_normal_4, Direction=list_item_5)  # -> Plane, Angle
rotate_4 = Rotate(Geometry=align_plane_4.Plane, Angle=pi_9, Plane=align_plane_4.Plane)  # -> Geometry, Transform
rotate_plane_4 = RotatePlane(Plane=rotate_4.Geometry, Angle=pi_16)
orient_4 = Orient(Geometry=geometry_8, Source=source_8, Target=rotate_plane_4)  # -> Geometry, Transform
rotate_3d_5 = Rotate3D(Geometry=orient_4.Geometry, Angle=negative_8, Center=rotate_plane_4, Axis=list_item_5)  # -> Geometry, Transform
explode_6 = Explode(Curve=rotate_3d_5.Geometry, Recursive=True)  # -> Segments, Vertices
deconstruct_brep_5 = DeconstructBrep(Brep=rotate_3d_5.Geometry)  # -> Faces, Edges, Vertices
list_item_6 = ListItem(List=explode_6.Segments, Index=Slider(1, range=0..2), Wrap=True)
curve_middle_5 = CurveMiddle(Curve=list_item_6)
plane_normal_5 = PlaneNormal(Origin=curve_middle_5, ZAxis=deconstruct_brep_5.Faces)
align_plane_5 = AlignPlane(Plane=plane_normal_5, Direction=list_item_6)  # -> Plane, Angle
rotate_5 = Rotate(Geometry=align_plane_5.Plane, Angle=pi_4, Plane=align_plane_5.Plane)  # -> Geometry, Transform
rotate_plane_5 = RotatePlane(Plane=rotate_5.Geometry, Angle=pi_12)
orient_5 = Orient(Geometry=geometry_4, Source=source_4, Target=rotate_plane_5)  # -> Geometry, Transform
rotate_3d_6 = Rotate3D(Geometry=orient_5.Geometry, Angle=negative_4, Center=rotate_plane_5, Axis=list_item_6)  # -> Geometry, Transform
explode_7 = Explode(Curve=rotate_3d_6.Geometry, Recursive=True)  # -> Segments, Vertices
deconstruct_brep_6 = DeconstructBrep(Brep=rotate_3d_6.Geometry)  # -> Faces, Edges, Vertices
list_item_7 = ListItem(List=explode_7.Segments, Index=Slider(0, range=0..2), Wrap=True)
curve_middle_6 = CurveMiddle(Curve=list_item_7)
plane_normal_6 = PlaneNormal(Origin=curve_middle_6, ZAxis=deconstruct_brep_6.Faces)
align_plane_6 = AlignPlane(Plane=plane_normal_6, Direction=list_item_7)  # -> Plane, Angle
rotate_6 = Rotate(Geometry=align_plane_6.Plane, Angle=pi_3, Plane=align_plane_6.Plane)  # -> Geometry, Transform
rotate_plane_6 = RotatePlane(Plane=rotate_6.Geometry, Angle=pi_11)
orient_6 = Orient(Geometry=geometry_3, Source=source_3, Target=rotate_plane_6)  # -> Geometry, Transform
rotate_3d_7 = Rotate3D(Geometry=orient_6.Geometry, Angle=negative_3, Center=rotate_plane_6, Axis=list_item_7)  # -> Geometry, Transform
explode_8 = Explode(Curve=rotate_3d_7.Geometry, Recursive=True)  # -> Segments, Vertices
deconstruct_brep_7 = DeconstructBrep(Brep=rotate_3d_7.Geometry)  # -> Faces, Edges, Vertices
list_item_8 = ListItem(List=explode_8.Segments, Index=Slider(1, range=0..2), Wrap=True)
curve_middle_7 = CurveMiddle(Curve=list_item_8)
plane_normal_7 = PlaneNormal(Origin=curve_middle_7, ZAxis=deconstruct_brep_7.Faces)
align_plane_7 = AlignPlane(Plane=plane_normal_7, Direction=list_item_8)  # -> Plane, Angle
rotate_7 = Rotate(Geometry=align_plane_7.Plane, Angle=pi_2, Plane=align_plane_7.Plane)  # -> Geometry, Transform
rotate_plane_7 = RotatePlane(Plane=rotate_7.Geometry, Angle=pi_10)
orient_7 = Orient(Geometry=geometry_2, Source=source_2, Target=rotate_plane_7)  # -> Geometry, Transform
rotate_3d_8 = Rotate3D(Geometry=orient_7.Geometry, Angle=negative_2, Center=rotate_plane_7, Axis=list_item_8)  # -> Geometry, Transform
explode_9 = Explode(Curve=rotate_3d_8.Geometry, Recursive=True)  # -> Segments, Vertices
deconstruct_brep_8 = DeconstructBrep(Brep=rotate_3d_8.Geometry)  # -> Faces, Edges, Vertices
list_item_9 = ListItem(List=explode_9.Segments, Index=Slider(0, range=0..2), Wrap=True)
curve_middle_8 = CurveMiddle(Curve=list_item_9)
plane_normal_8 = PlaneNormal(Origin=curve_middle_8, ZAxis=deconstruct_brep_8.Faces)
align_plane_8 = AlignPlane(Plane=plane_normal_8, Direction=list_item_9)  # -> Plane, Angle
rotate_8 = Rotate(Geometry=align_plane_8.Plane, Angle=pi, Plane=align_plane_8.Plane)  # -> Geometry, Transform
rotate_plane_8 = RotatePlane(Plane=rotate_8.Geometry, Angle=pi_8)
orient_8 = Orient(Geometry=geometry, Source=source, Target=rotate_plane_8)  # -> Geometry, Transform
rotate_3d_9 = Rotate3D(Geometry=orient_8.Geometry, Angle=negative, Center=rotate_plane_8, Axis=list_item_9)  # -> Geometry, Transform
geometry_10 = ClusterOutput(rotate_3d_9.Geometry)
geometry_11 = ClusterOutput(rotate_3d_8.Geometry)
geometry_12 = ClusterOutput(rotate_3d_7.Geometry)
geometry_13 = ClusterOutput(rotate_3d.Geometry)
geometry_14 = ClusterOutput(rotate_3d_6.Geometry)
geometry_15 = ClusterOutput(rotate_3d_2.Geometry)
geometry_16 = ClusterOutput(rotate_3d_3.Geometry)
geometry_17 = ClusterOutput(rotate_3d_4.Geometry)
geometry_18 = ClusterOutput(rotate_3d_5.Geometry)
