# Grasshopper definition Wolfram_Geometry_HS_004b.gh (Grasshopper 1.0.7)

trigger = Trigger(Interval=20, TimerInterval=20, Target=data_recorder)  # disabled
data_recorder = DataRecorder("1", DataLimit=10000, RecordData=False)
list_length = ListLength(List=data_recorder)
division = Division(A=list_length, B=Slider(22.824, range=0..100))
cosine = Cosine(Value=division)
sine = Sine(Value=division)
absolute = Absolute(Value=cosine)
absolute_2 = Absolute(Value=sine)
multiplication = Multiplication(A=Slider(0.19, range=0..1), B=absolute_2)
panel = Panel(multiplication)
number_slider = Slider(0.233, range=0..0.233)

number_slider_2 = Slider(8, range=0..20)
division_2 = Division(A=number_slider_2, B="2")
integer = Integer(division_2)
range = Range(Domain=number_slider_2, Steps=integer)
construct_point = ConstructPoint(XCoordinate=range, YCoordinate=0, ZCoordinate=0)
multiplication_2 = Multiplication(A="1", B="2")
point = Point(construct_point)
circle = Circle(Plane=flatten(point), Radius=multiplication_2)
dispatch = Dispatch(List=flatten(circle), DispatchPattern=[True, False])  # -> ListA, ListB
dispatch_2 = Dispatch(List=point, DispatchPattern=[True, False])  # -> ListA, ListB
shift_list = ShiftList(List=dispatch.ListA, Shift=1, Wrap=True)
shift_list_2 = ShiftList(List=dispatch.ListB, Shift=1, Wrap=True)
curve_curve = CurveCurve(CurveA=dispatch.ListA, CurveB=dispatch.ListB)  # -> flatten(Points), ParamsA, ParamsB
curve_curve_2 = CurveCurve(CurveA=shift_list, CurveB=dispatch.ListB)  # -> Points, ParamsA, ParamsB
list_item = ListItem(List=flatten(curve_curve.Points), Index=0, Wrap=True)
list_item_2 = ListItem(List=flatten(dispatch_2.ListB), Index=0, Wrap=True)
list_item_3 = ListItem(List=flatten(dispatch_2.ListA), Index=0, Wrap=True)
polyline = PolyLine(Vertices=[list_item, list_item_3, list_item_2], Closed=True)
orient = Orient(Geometry=polyline, Source=list_item, Target=point)  # -> Geometry, Transform
deconstruct_brep = DeconstructBrep(Brep=orient.Geometry)  # -> Faces, Edges, Vertices
list_item_4 = ListItem(List=deconstruct_brep.Vertices, Index=0, Wrap=True)
list_item_5 = ListItem(List=deconstruct_brep.Vertices, Index="1", Wrap=True)
explode = Explode(Curve=orient.Geometry, Recursive=True)  # -> Segments, Vertices
orient_2 = Orient(Geometry=orient.Geometry, Source=list_item_5, Target=list_item_4)  # -> Geometry, Transform
merge = Merge(Data1=explode.Segments, Data2=orient_2.Geometry)
boundary_surfaces = BoundarySurfaces(Edges=merge)
xz_plane = XZPlane(Origin=Point(0, 0, 0))
mirror = Mirror(Geometry=boundary_surfaces, Plane=PlaneYZ(0, 0, 0))  # -> Geometry, Transform
mirror_2 = Mirror(Geometry=mirror.Geometry, Plane=xz_plane)  # -> Geometry, Transform
deconstruct_brep_2 = DeconstructBrep(Brep=mirror_2.Geometry)  # -> Faces, Edges, Vertices
list_item_6 = ListItem(List=flatten(deconstruct_brep_2.Vertices), Index=Slider(74, range=0..100), Wrap=True)
list_item_7 = ListItem(List=flatten(deconstruct_brep_2.Vertices), Index=Slider(0, range=0..100), Wrap=True)
orient_3 = Orient(Geometry=mirror_2.Geometry, Source=list_item_6, Target=list_item_7)  # -> Geometry, Transform

triangular = Triangular(Plane=PlaneXY(0, 0, 0), Size=1, ExtentX="10", ExtentY="3")  # -> simplify(Cells), Points
param_viewer = ParamViewer(triangular.Cells)
pi = Pi(Factor=multiplication)
split_tree = SplitTree(Data=triangular.Cells, Masks=flatten("{*}[1]"))  # -> Positive, Negative
boolean_toggle = BooleanToggle(True)
clean_tree = CleanTree(RemoveNulls=True, RemoveInvalid=True, RemoveEmpty=boolean_toggle, Tree=split_tree.Positive)
split_tree_2 = SplitTree(Data=triangular.Cells, Masks=flatten("{1,3,...}[0]"))  # -> Positive, Negative
split_tree_3 = SplitTree(Data=triangular.Cells, Masks=flatten("{0,2,...}[2]"))  # -> Positive, Negative
curve = Curve(clean_tree)
split_tree_4 = SplitTree(Data=flatten(curve), Masks=flatten("{*}[0,2,...]"))  # -> Positive, Negative
clean_tree_2 = CleanTree(RemoveNulls=True, RemoveInvalid=True, RemoveEmpty=boolean_toggle, Tree=split_tree_2.Positive)
clean_tree_3 = CleanTree(RemoveNulls=True, RemoveInvalid=True, RemoveEmpty=boolean_toggle, Tree=split_tree_3.Positive)
curve_2 = Curve(clean_tree_2)
curve_3 = Curve(clean_tree_3)
clean_tree_4 = CleanTree(RemoveNulls=True, RemoveInvalid=True, RemoveEmpty=boolean_toggle, Tree=split_tree_4.Negative)
clean_tree_5 = CleanTree(RemoveNulls=True, RemoveInvalid=True, RemoveEmpty=boolean_toggle, Tree=split_tree_4.Positive)
explode_2 = Explode(Curve=curve_2, Recursive=True)  # -> Segments, Vertices
curve_4 = Curve(clean_tree_4)
curve_5 = Curve(clean_tree_5)
list_item_8 = ListItem(List=explode_2.Segments, Index=Slider(1, range=0..2), Wrap=True)
explode_3 = Explode(Curve=curve_4, Recursive=True)  # -> Segments, Vertices
list_item_9 = ListItem(List=curve_4, Index=Slider(0, range=0..10), Wrap=True)
list_item_10 = ListItem(List=flatten(explode_3.Segments), Index=Slider(2, range=0..2), Wrap=True)
rotate_3d = Rotate3D(Geometry=list_item_9, Angle=pi, Center=Point(0, 0, 0), Axis=list_item_10)  # -> Geometry, Transform
deconstruct_brep_3 = DeconstructBrep(Brep=rotate_3d.Geometry)  # -> Faces, Edges, Vertices
list_item_11 = ListItem(List=curve_5, Index=Slider(1, range=0..10), Wrap=True)
explode_4 = Explode(Curve=list_item_11, Recursive=True)  # -> Segments, Vertices
explode_5 = Explode(Curve=rotate_3d.Geometry, Recursive=True)  # -> Segments, Vertices
list_item_12 = ListItem(List=explode_4.Vertices, Index=Slider(1, range=0..2), Wrap=True)
list_item_13 = ListItem(List=explode_4.Segments, Index=Slider(2, range=0..2), Wrap=True)
list_item_14 = ListItem(List=explode_5.Segments, Index=Slider(1, range=0..2), Wrap=True)
curve_middle = CurveMiddle(Curve=list_item_13)
curve_middle_2 = CurveMiddle(Curve=list_item_14)
vector_2pt = Vector2Pt(PointA=curve_middle, PointB=list_item_12, Unitize=False)  # -> Vector, Length
plane_normal = PlaneNormal(Origin=curve_middle_2, ZAxis=deconstruct_brep_3.Faces)
align_plane = AlignPlane(Plane=plane_normal, Direction=list_item_14)  # -> Plane, Angle
pi_2 = Pi(Factor=1)
construct_plane = ConstructPlane(Origin=curve_middle, XAxis=vector_2pt.Vector, YAxis=Vector(0, 1, 0))
geometry = Geometry(list_item_11)
rotate = Rotate(Geometry=align_plane.Plane, Angle=pi_2, Plane=align_plane.Plane)  # -> Geometry, Transform
pi_3 = Pi(Factor=".5")
rotate_plane = RotatePlane(Plane=rotate.Geometry, Angle=pi_3)
orient_4 = Orient(Geometry=geometry, Source=construct_plane, Target=rotate_plane)  # -> Geometry, Transform
negative = Negative(Value=pi)
rotate_3d_2 = Rotate3D(Geometry=orient_4.Geometry, Angle=negative, Center=rotate_plane, Axis=list_item_14)  # -> Geometry, Transform
deconstruct_brep_4 = DeconstructBrep(Brep=rotate_3d_2.Geometry)  # -> Faces, Edges, Vertices
explode_6 = Explode(Curve=rotate_3d_2.Geometry, Recursive=True)  # -> Segments, Vertices
list_item_15 = ListItem(List=curve_4, Index=Slider(1, range=0..10), Wrap=True)
list_item_16 = ListItem(List=explode_6.Segments, Index=Slider(0, range=0..2), Wrap=True)
curve_middle_3 = CurveMiddle(Curve=list_item_16)
explode_7 = Explode(Curve=list_item_15, Recursive=True)  # -> Segments, Vertices
plane_normal_2 = PlaneNormal(Origin=curve_middle_3, ZAxis=deconstruct_brep_4.Faces)
list_item_17 = ListItem(List=explode_7.Vertices, Index=Slider(1, range=0..2), Wrap=True)
list_item_18 = ListItem(List=explode_7.Segments, Index=Slider(2, range=0..2), Wrap=True)
align_plane_2 = AlignPlane(Plane=plane_normal_2, Direction=list_item_16)  # -> Plane, Angle
pi_4 = Pi(Factor=1)
curve_middle_4 = CurveMiddle(Curve=list_item_18)
rotate_2 = Rotate(Geometry=align_plane_2.Plane, Angle=pi_4, Plane=align_plane_2.Plane)  # -> Geometry, Transform
pi_5 = Pi(Factor=".5")
vector_2pt_2 = Vector2Pt(PointA=curve_middle_4, PointB=list_item_17, Unitize=False)  # -> Vector, Length
rotate_plane_2 = RotatePlane(Plane=rotate_2.Geometry, Angle=pi_5)
geometry_2 = Geometry(list_item_15)
construct_plane_2 = ConstructPlane(Origin=curve_middle_4, XAxis=vector_2pt_2.Vector, YAxis=Vector(0, 1, 0))
panel_2 = Panel("2")
number_slider_3 = Slider(0.34, range=0..2)
negative_2 = Negative(Value=pi)
orient_5 = Orient(Geometry=geometry_2, Source=construct_plane_2, Target=rotate_plane_2)  # -> Geometry, Transform
rotate_3d_3 = Rotate3D(Geometry=orient_5.Geometry, Angle=negative_2, Center=rotate_plane_2, Axis=list_item_16)  # -> Geometry, Transform
explode_8 = Explode(Curve=rotate_3d_3.Geometry, Recursive=True)  # -> Segments, Vertices
deconstruct_brep_5 = DeconstructBrep(Brep=rotate_3d_3.Geometry)  # -> Faces, Edges, Vertices
list_item_19 = ListItem(List=curve_5, Index=Slider(2, range=0..10), Wrap=True)
list_item_20 = ListItem(List=explode_8.Segments, Index=Slider(1, range=0..2), Wrap=True)
curve_middle_5 = CurveMiddle(Curve=list_item_20)
plane_normal_3 = PlaneNormal(Origin=curve_middle_5, ZAxis=deconstruct_brep_5.Faces)
pi_6 = Pi(Factor=1)
align_plane_3 = AlignPlane(Plane=plane_normal_3, Direction=list_item_20)  # -> Plane, Angle
explode_9 = Explode(Curve=list_item_19, Recursive=True)  # -> Segments, Vertices
rotate_3 = Rotate(Geometry=align_plane_3.Plane, Angle=pi_6, Plane=align_plane_3.Plane)  # -> Geometry, Transform
list_item_21 = ListItem(List=explode_9.Vertices, Index=Slider(1, range=0..2), Wrap=True)
list_item_22 = ListItem(List=explode_9.Segments, Index=Slider(2, range=0..2), Wrap=True)
pi_7 = Pi(Factor=".5")
rotate_plane_3 = RotatePlane(Plane=rotate_3.Geometry, Angle=pi_7)
curve_middle_6 = CurveMiddle(Curve=list_item_22)
vector_2pt_3 = Vector2Pt(PointA=curve_middle_6, PointB=list_item_21, Unitize=False)  # -> Vector, Length
construct_plane_3 = ConstructPlane(Origin=curve_middle_6, XAxis=vector_2pt_3.Vector, YAxis=Vector(0, 1, 0))
geometry_3 = Geometry(list_item_19)
orient_6 = Orient(Geometry=geometry_3, Source=construct_plane_3, Target=rotate_plane_3)  # -> Geometry, Transform
negative_3 = Negative(Value=pi)
rotate_3d_4 = Rotate3D(Geometry=orient_6.Geometry, Angle=negative_3, Center=rotate_plane_3, Axis=list_item_20)  # -> Geometry, Transform
deconstruct_brep_6 = DeconstructBrep(Brep=rotate_3d_4.Geometry)  # -> Faces, Edges, Vertices
explode_10 = Explode(Curve=rotate_3d_4.Geometry, Recursive=True)  # -> Segments, Vertices
list_item_23 = ListItem(List=explode_10.Segments, Index=Slider(0, range=0..2), Wrap=True)
curve_middle_7 = CurveMiddle(Curve=list_item_23)
plane_normal_4 = PlaneNormal(Origin=curve_middle_7, ZAxis=deconstruct_brep_6.Faces)
pi_8 = Pi(Factor=1)
align_plane_4 = AlignPlane(Plane=plane_normal_4, Direction=list_item_23)  # -> Plane, Angle
list_item_24 = ListItem(List=curve_4, Index=Slider(2, range=0..10), Wrap=True)
rotate_4 = Rotate(Geometry=align_plane_4.Plane, Angle=pi_8, Plane=align_plane_4.Plane)  # -> Geometry, Transform
pi_9 = Pi(Factor=".5")
explode_11 = Explode(Curve=list_item_24, Recursive=True)  # -> Segments, Vertices
rotate_plane_4 = RotatePlane(Plane=rotate_4.Geometry, Angle=pi_9)
list_item_25 = ListItem(List=explode_11.Vertices, Index=Slider(1, range=0..2), Wrap=True)
list_item_26 = ListItem(List=explode_11.Segments, Index=Slider(2, range=0..2), Wrap=True)
curve_middle_8 = CurveMiddle(Curve=list_item_26)
vector_2pt_4 = Vector2Pt(PointA=curve_middle_8, PointB=list_item_25, Unitize=False)  # -> Vector, Length
construct_plane_4 = ConstructPlane(Origin=curve_middle_8, XAxis=vector_2pt_4.Vector, YAxis=Vector(0, 1, 0))
geometry_4 = Geometry(list_item_24)
orient_7 = Orient(Geometry=geometry_4, Source=construct_plane_4, Target=rotate_plane_4)  # -> Geometry, Transform
negative_4 = Negative(Value=pi)
rotate_3d_5 = Rotate3D(Geometry=orient_7.Geometry, Angle=negative_4, Center=rotate_plane_4, Axis=list_item_23)  # -> Geometry, Transform
deconstruct_brep_7 = DeconstructBrep(Brep=rotate_3d_5.Geometry)  # -> Faces, Edges, Vertices
merge_2 = Merge(
    Data1=rotate_3d.Geometry,
    Data2=rotate_3d_2.Geometry,
    Data3=rotate_3d_3.Geometry,
    Data4=rotate_3d_4.Geometry,
    Data5=deconstruct_brep_7.Faces)
unit_z = UnitZ(Factor=1)
boundary_surfaces_2 = BoundarySurfaces(Edges=merge_2)
list_item_27 = ListItem(List=flatten(triangular.Cells), Index=Slider(1, range=0..10), Wrap=True)
deconstruct_brep_8 = DeconstructBrep(Brep=list_item_27)  # -> Faces, Edges, Vertices
list_item_28 = ListItem(List=flatten(deconstruct_brep_8.Vertices), Index=0, Wrap=True)
construct_plane_5 = ConstructPlane(Origin=list_item_28, XAxis=unit_z, YAxis=Vector(0, 1, 0))
mirror_3 = Mirror(Geometry=boundary_surfaces_2, Plane=construct_plane_5)  # -> Geometry, Transform
