# Grasshopper definition Wolfram_Geometry_HS_004c.gh (Grasshopper 1.0.7)

trigger = Trigger(Interval=20, TimerInterval=20, Target=data_recorder)
data_recorder = DataRecorder("1", DataLimit=10000, RecordData=True)
list_length = ListLength(List=data_recorder)
division = Division(A=list_length, B=Slider(22.824, range=0..100))
cosine = Cosine(Value=division)
sine = Sine(Value=division)
absolute = Absolute(Value=cosine)
absolute_2 = Absolute(Value=sine)
multiplication = Multiplication(A=Slider(0.22, range=0..1), B=absolute_2)
panel = Panel(multiplication)
number_slider = Slider(0.233, range=0..0.233)

number_slider_2 = Slider(8, range=0..20)
division_2 = Division(A=number_slider_2, B="2")
integer = Integer(division_2)
range = Range(Domain=number_slider_2, Steps=integer)
construct_point = ConstructPoint(XCoordinate=range, YCoordinate=0, ZCoordinate=0)
multiplication_2 = Multiplication(A="1", B="2")
point = Point(construct_point)
circle = Circle(Plane=flatten(point), Radius=multiplication_2)
dispatch = Dispatch(List=flatten(circle), DispatchPattern=[True, False])  # -> ListA, ListB
dispatch_2 = Dispatch(List=point, DispatchPattern=[True, False])  # -> ListA, ListB
shift_list = ShiftList(List=dispatch.ListA, Shift=1, Wrap=True)
shift_list_2 = ShiftList(List=dispatch.ListB, Shift=1, Wrap=True)
curve_curve = CurveCurve(CurveA=dispatch.ListA, CurveB=dispatch.ListB)  # -> flatten(Points), ParamsA, ParamsB
curve_curve_2 = CurveCurve(CurveA=shift_list, CurveB=dispatch.ListB)  # -> Points, ParamsA, ParamsB
list_item = ListItem(List=flatten(curve_curve.Points), Index=0, Wrap=True)
list_item_2 = ListItem(List=flatten(dispatch_2.ListB), Index=0, Wrap=True)
list_item_3 = ListItem(List=flatten(dispatch_2.ListA), Index=0, Wrap=True)
polyline = PolyLine(Vertices=[list_item, list_item_3, list_item_2], Closed=True)
orient = Orient(Geometry=polyline, Source=list_item, Target=point)  # -> Geometry, Transform
deconstruct_brep = DeconstructBrep(Brep=orient.Geometry)  # -> Faces, Edges, Vertices
list_item_4 = ListItem(List=deconstruct_brep.Vertices, Index=0, Wrap=True)
list_item_5 = ListItem(List=deconstruct_brep.Vertices, Index="1", Wrap=True)
explode = Explode(Curve=orient.Geometry, Recursive=True)  # -> Segments, Vertices
orient_2 = Orient(Geometry=orient.Geometry, Source=list_item_5, Target=list_item_4)  # -> Geometry, Transform
merge = Merge(Data1=explode.Segments, Data2=orient_2.Geometry)
boundary_surfaces = BoundarySurfaces(Edges=merge)
xz_plane = XZPlane(Origin=Point(0, 0, 0))
mirror = Mirror(Geometry=boundary_surfaces, Plane=PlaneYZ(0, 0, 0))  # -> Geometry, Transform
mirror_2 = Mirror(Geometry=mirror.Geometry, Plane=xz_plane)  # -> Geometry, Transform
deconstruct_brep_2 = DeconstructBrep(Brep=mirror_2.Geometry)  # -> Faces, Edges, Vertices
list_item_6 = ListItem(List=flatten(deconstruct_brep_2.Vertices), Index=Slider(74, range=0..100), Wrap=True)
list_item_7 = ListItem(List=flatten(deconstruct_brep_2.Vertices), Index=Slider(0, range=0..100), Wrap=True)
orient_3 = Orient(Geometry=mirror_2.Geometry, Source=list_item_6, Target=list_item_7)  # -> Geometry, Transform

triangular = Triangular(Plane=PlaneXY(0, 0, 0), Size=1, ExtentX="10", ExtentY="3")  # -> simplify(Cells), Points
param_viewer = ParamViewer(triangular.Cells)
pi = Pi(Factor=multiplication)
split_tree = SplitTree(Data=triangular.Cells, Masks=flatten("{*}[1]"))  # -> Positive, Negative
boolean_toggle = BooleanToggle(True)
clean_tree = CleanTree(RemoveNulls=True, RemoveInvalid=True, RemoveEmpty=boolean_toggle, Tree=split_tree.Positive)
split_tree_2 = SplitTree(Data=triangular.Cells, Masks=flatten("{1,3,...}[0]"))  # -> Positive, Negative
split_tree_3 = SplitTree(Data=triangular.Cells, Masks=flatten("{0,2,...}[2]"))  # -> Positive, Negative
curve = Curve(clean_tree)
split_tree_4 = SplitTree(Data=flatten(curve), Masks=flatten("{*}[0,2,...]"))  # -> Positive, Negative
clean_tree_2 = CleanTree(RemoveNulls=True, RemoveInvalid=True, RemoveEmpty=boolean_toggle, Tree=split_tree_2.Positive)
clean_tree_3 = CleanTree(RemoveNulls=True, RemoveInvalid=True, RemoveEmpty=boolean_toggle, Tree=split_tree_3.Positive)
clean_tree_4 = CleanTree(RemoveNulls=True, RemoveInvalid=True, RemoveEmpty=boolean_toggle, Tree=split_tree_4.Negative)
clean_tree_5 = CleanTree(RemoveNulls=True, RemoveInvalid=True, RemoveEmpty=boolean_toggle, Tree=split_tree_4.Positive)
curve_2 = Curve(clean_tree_3)
curve_3 = Curve(clean_tree_2)
curve_4 = Curve(clean_tree_4)
curve_5 = Curve(clean_tree_5)
explode_2 = Explode(Curve=curve_5, Recursive=True)  # -> flatten(Segments), Vertices
explode_3 = Explode(Curve=curve_4, Recursive=True)  # -> Segments, Vertices
list_item_8 = ListItem(List=curve_5, Index=0, Wrap=True)
list_item_9 = ListItem(List=curve_4, Index=Slider(0, range=0..10), Wrap=True)
list_item_10 = ListItem(List=flatten(explode_3.Segments), Index=Slider(2, range=0..2), Wrap=True)
list_item_11 = ListItem(List=flatten(curve_2), Index=Slider(0, range=0..10), Wrap=True)
list_item_12 = ListItem(List=explode_2.Segments, Index=Slider(1, range=0..2), Wrap=True)
boundary_surfaces_2 = BoundarySurfaces(Edges=list_item_8)
negative = Negative(Value=pi)
curve_middle = CurveMiddle(Curve=list_item_12)
rotate_3d = Rotate3D(Geometry=list_item_11, Angle=negative, Center=curve_middle, Axis=list_item_12)  # -> Geometry, Transform
rotate_3d_2 = Rotate3D(Geometry=list_item_9, Angle=pi, Center=Point(0, 0, 0), Axis=list_item_10)  # -> Geometry, Transform
list_item_13 = ListItem(List=curve_5, Index=Slider(0, range=0..10), Wrap=True)
deconstruct_brep_3 = DeconstructBrep(Brep=rotate_3d.Geometry)  # -> Faces, Edges, Vertices
explode_4 = Explode(Curve=list_item_13, Recursive=True)  # -> Segments, Vertices
explode_5 = Explode(Curve=rotate_3d_2.Geometry, Recursive=True)  # -> Segments, Vertices
list_item_14 = ListItem(List=explode_5.Segments, Index=Slider(0, range=0..2), Wrap=True)
deconstruct_brep_4 = DeconstructBrep(Brep=rotate_3d_2.Geometry)  # -> Faces, Edges, Vertices
curve_middle_2 = CurveMiddle(Curve=reverse(list_item_14))
list_item_15 = ListItem(List=explode_4.Vertices, Index=Slider(1, range=0..2), Wrap=True)
list_item_16 = ListItem(List=explode_4.Segments, Index=Slider(2, range=0..2), Wrap=True)
list_item_17 = ListItem(List=explode_5.Segments, Index=Slider(1, range=0..2), Wrap=True)
construct_plane = ConstructPlane(Origin=curve_middle_2, XAxis=list_item_14, YAxis=Vector(0, 1, 0))
pi_2 = Pi(Factor=1)
curve_middle_3 = CurveMiddle(Curve=list_item_16)
curve_middle_4 = CurveMiddle(Curve=list_item_17)
rotate_plane = RotatePlane(Plane=construct_plane, Angle=pi_2)
geometry = Geometry(explode_5.Segments)
plane_normal = PlaneNormal(Origin=curve_middle_4, ZAxis=deconstruct_brep_4.Faces)
vector_2pt = Vector2Pt(PointA=curve_middle_3, PointB=list_item_15, Unitize=False)  # -> Vector, Length
negative_2 = Negative(Value=pi)
orient_4 = Orient(Geometry=geometry, Source=rotate_plane, Target=construct_plane)  # -> Geometry, Transform
align_plane = AlignPlane(Plane=plane_normal, Direction=list_item_17)  # -> Plane, Angle
pi_3 = Pi(Factor=1)
construct_plane_2 = ConstructPlane(Origin=curve_middle_3, XAxis=vector_2pt.Vector, YAxis=Vector(0, 1, 0))
geometry_2 = Geometry(list_item_13)
panel_2 = Panel(negative_2)
rotate = Rotate(Geometry=align_plane.Plane, Angle=pi_3, Plane=align_plane.Plane)  # -> Geometry, Transform
rotate_3d_3 = Rotate3D(Geometry=orient_4.Geometry, Angle=negative_2, Center=curve_middle_2, Axis=list_item_14)  # -> Geometry, Transform
pi_4 = Pi(Factor=".5")
rotate_plane_2 = RotatePlane(Plane=rotate.Geometry, Angle=pi_4)
orient_5 = Orient(Geometry=geometry_2, Source=construct_plane_2, Target=rotate_plane_2)  # -> Geometry, Transform
boundary_surfaces_3 = BoundarySurfaces(Edges=rotate_3d_3.Geometry)
negative_3 = Negative(Value=pi)
deconstruct_brep_5 = DeconstructBrep(Brep=boundary_surfaces_3)  # -> Faces, Edges, Vertices
rotate_3d_4 = Rotate3D(Geometry=orient_5.Geometry, Angle=negative_3, Center=rotate_plane_2, Axis=list_item_17)  # -> Geometry, Transform
rotate_3d_5 = Rotate3D(Geometry=deconstruct_brep_5.Faces, Angle=negative_2, Center=curve_middle_2, Axis=list_item_14)  # -> Geometry, Transform
deconstruct_brep_6 = DeconstructBrep(Brep=rotate_3d_4.Geometry)  # -> Faces, Edges, Vertices
list_item_18 = ListItem(List=deconstruct_brep_6.Edges, Index=Slider(1, range=0..1), Wrap=True)
explode_6 = Explode(Curve=rotate_3d_4.Geometry, Recursive=True)  # -> Segments, Vertices
list_item_19 = ListItem(List=curve_4, Index=Slider(1, range=0..10), Wrap=True)
list_item_20 = ListItem(List=explode_6.Segments, Index=Slider(0, range=0..2), Wrap=True)
curve_middle_5 = CurveMiddle(Curve=list_item_20)
explode_7 = Explode(Curve=list_item_19, Recursive=True)  # -> Segments, Vertices
plane_normal_2 = PlaneNormal(Origin=curve_middle_5, ZAxis=deconstruct_brep_6.Faces)
list_item_21 = ListItem(List=list_item_18, Index=Slider(0, range=0..2), Wrap=True)
list_item_22 = ListItem(List=explode_7.Vertices, Index=Slider(1, range=0..2), Wrap=True)
curve_middle_6 = CurveMiddle(Curve=reverse(list_item_21))
list_item_23 = ListItem(List=explode_7.Segments, Index=Slider(2, range=0..2), Wrap=True)
align_plane_2 = AlignPlane(Plane=plane_normal_2, Direction=list_item_20)  # -> Plane, Angle
pi_5 = Pi(Factor=1)
construct_plane_3 = ConstructPlane(Origin=curve_middle_6, XAxis=list_item_21, YAxis=Vector(0, 1, 0))
curve_middle_7 = CurveMiddle(Curve=list_item_23)
pi_6 = Pi(Factor=1)
rotate_2 = Rotate(Geometry=align_plane_2.Plane, Angle=pi_5, Plane=align_plane_2.Plane)  # -> Geometry, Transform
pi_7 = Pi(Factor=".5")
rotate_plane_3 = RotatePlane(Plane=construct_plane_3, Angle=pi_6)
vector_2pt_2 = Vector2Pt(PointA=curve_middle_7, PointB=list_item_22, Unitize=False)  # -> Vector, Length
geometry_3 = Geometry(deconstruct_brep_6.Edges)
rotate_plane_4 = RotatePlane(Plane=rotate_2.Geometry, Angle=pi_7)
geometry_4 = Geometry(list_item_19)
construct_plane_4 = ConstructPlane(Origin=curve_middle_7, XAxis=vector_2pt_2.Vector, YAxis=Vector(0, 1, 0))
negative_4 = Negative(Value=pi)
orient_6 = Orient(Geometry=geometry_3, Source=rotate_plane_3, Target=construct_plane_3)  # -> Geometry, Transform
panel_3 = Panel("2")
number_slider_3 = Slider(0.34, range=0..2)
panel_4 = Panel(negative_4)
negative_5 = Negative(Value=pi)
orient_7 = Orient(Geometry=geometry_4, Source=construct_plane_4, Target=rotate_plane_4)  # -> Geometry, Transform
rotate_3d_6 = Rotate3D(Geometry=orient_6.Geometry, Angle=negative_4, Center=curve_middle_6, Axis=list_item_21)  # -> Geometry, Transform
rotate_3d_7 = Rotate3D(Geometry=orient_7.Geometry, Angle=negative_5, Center=rotate_plane_4, Axis=list_item_20)  # -> Geometry, Transform
boundary_surfaces_4 = BoundarySurfaces(Edges=rotate_3d_6.Geometry)
deconstruct_brep_7 = DeconstructBrep(Brep=boundary_surfaces_4)  # -> Faces, Edges, Vertices
explode_8 = Explode(Curve=rotate_3d_7.Geometry, Recursive=True)  # -> Segments, Vertices
rotate_3d_8 = Rotate3D(Geometry=deconstruct_brep_7.Faces, Angle=negative_4, Center=curve_middle_6, Axis=list_item_21)  # -> Geometry, Transform
deconstruct_brep_8 = DeconstructBrep(Brep=rotate_3d_7.Geometry)  # -> Faces, Edges, Vertices
list_item_24 = ListItem(List=curve_5, Index=Slider(2, range=0..10), Wrap=True)
list_item_25 = ListItem(List=explode_8.Segments, Index=Slider(1, range=0..2), Wrap=True)
list_item_26 = ListItem(List=deconstruct_brep_8.Edges, Index=Slider(0, range=0..1), Wrap=True)
curve_middle_8 = CurveMiddle(Curve=list_item_25)
list_item_27 = ListItem(List=list_item_26, Index=Slider(0, range=0..2), Wrap=True)
curve_middle_9 = CurveMiddle(Curve=reverse(list_item_27))
plane_normal_3 = PlaneNormal(Origin=curve_middle_8, ZAxis=deconstruct_brep_8.Faces)
construct_plane_5 = ConstructPlane(Origin=curve_middle_9, XAxis=list_item_27, YAxis=Vector(0, 1, 0))
pi_8 = Pi(Factor=1)
align_plane_3 = AlignPlane(Plane=plane_normal_3, Direction=list_item_25)  # -> Plane, Angle
explode_9 = Explode(Curve=list_item_24, Recursive=True)  # -> Segments, Vertices
pi_9 = Pi(Factor=1)
rotate_plane_5 = RotatePlane(Plane=construct_plane_5, Angle=pi_9)
geometry_5 = Geometry(deconstruct_brep_8.Edges)
rotate_3 = Rotate(Geometry=align_plane_3.Plane, Angle=pi_8, Plane=align_plane_3.Plane)  # -> Geometry, Transform
list_item_28 = ListItem(List=explode_9.Vertices, Index=Slider(1, range=0..2), Wrap=True)
list_item_29 = ListItem(List=explode_9.Segments, Index=Slider(2, range=0..2), Wrap=True)
pi_10 = Pi(Factor=".5")
negative_6 = Negative(Value=pi)
orient_8 = Orient(Geometry=geometry_5, Source=rotate_plane_5, Target=construct_plane_5)  # -> Geometry, Transform
rotate_plane_6 = RotatePlane(Plane=rotate_3.Geometry, Angle=pi_10)
curve_middle_10 = CurveMiddle(Curve=list_item_29)
panel_5 = Panel(negative_6)
rotate_3d_9 = Rotate3D(Geometry=orient_8.Geometry, Angle=negative_6, Center=curve_middle_9, Axis=list_item_27)  # -> Geometry, Transform
vector_2pt_3 = Vector2Pt(PointA=curve_middle_10, PointB=list_item_28, Unitize=False)  # -> Vector, Length
boundary_surfaces_5 = BoundarySurfaces(Edges=rotate_3d_9.Geometry)
construct_plane_6 = ConstructPlane(Origin=curve_middle_10, XAxis=vector_2pt_3.Vector, YAxis=Vector(0, 1, 0))
geometry_6 = Geometry(list_item_24)
deconstruct_brep_9 = DeconstructBrep(Brep=boundary_surfaces_5)  # -> Faces, Edges, Vertices
orient_9 = Orient(Geometry=geometry_6, Source=construct_plane_6, Target=rotate_plane_6)  # -> Geometry, Transform
negative_7 = Negative(Value=pi)
rotate_3d_10 = Rotate3D(Geometry=deconstruct_brep_9.Faces, Angle=negative_6, Center=curve_middle_9, Axis=list_item_27)  # -> Geometry, Transform
rotate_3d_11 = Rotate3D(Geometry=orient_9.Geometry, Angle=negative_7, Center=rotate_plane_6, Axis=list_item_25)  # -> Geometry, Transform
deconstruct_brep_10 = DeconstructBrep(Brep=rotate_3d_11.Geometry)  # -> Faces, Edges, Vertices
explode_10 = Explode(Curve=rotate_3d_11.Geometry, Recursive=True)  # -> Segments, Vertices
list_item_30 = ListItem(List=deconstruct_brep_10.Edges, Index=Slider(1, range=0..1), Wrap=True)
list_item_31 = ListItem(List=list_item_30, Index=Slider(0, range=0..2), Wrap=True)
curve_middle_11 = CurveMiddle(Curve=reverse(list_item_31))
list_item_32 = ListItem(List=explode_10.Segments, Index=Slider(0, range=0..2), Wrap=True)
curve_middle_12 = CurveMiddle(Curve=list_item_32)
plane_normal_4 = PlaneNormal(Origin=curve_middle_12, ZAxis=deconstruct_brep_10.Faces)
pi_11 = Pi(Factor=1)
align_plane_4 = AlignPlane(Plane=plane_normal_4, Direction=list_item_32)  # -> Plane, Angle
construct_plane_7 = ConstructPlane(Origin=curve_middle_11, XAxis=list_item_31, YAxis=Vector(0, 1, 0))
pi_12 = Pi(Factor=1)
list_item_33 = ListItem(List=curve_4, Index=Slider(2, range=0..10), Wrap=True)
rotate_plane_7 = RotatePlane(Plane=construct_plane_7, Angle=pi_12)
rotate_4 = Rotate(Geometry=align_plane_4.Plane, Angle=pi_11, Plane=align_plane_4.Plane)  # -> Geometry, Transform
geometry_7 = Geometry(deconstruct_brep_10.Edges)
pi_13 = Pi(Factor=".5")
negative_8 = Negative(Value=pi)
orient_10 = Orient(Geometry=geometry_7, Source=rotate_plane_7, Target=construct_plane_7)  # -> Geometry, Transform
explode_11 = Explode(Curve=list_item_33, Recursive=True)  # -> Segments, Vertices
rotate_plane_8 = RotatePlane(Plane=rotate_4.Geometry, Angle=pi_13)
panel_6 = Panel(negative_8)
list_item_34 = ListItem(List=explode_11.Vertices, Index=Slider(1, range=0..2), Wrap=True)
rotate_3d_12 = Rotate3D(Geometry=orient_10.Geometry, Angle=negative_8, Center=curve_middle_11, Axis=list_item_31)  # -> Geometry, Transform
list_item_35 = ListItem(List=explode_11.Segments, Index=Slider(2, range=0..2), Wrap=True)
boundary_surfaces_6 = BoundarySurfaces(Edges=rotate_3d_12.Geometry)
curve_middle_13 = CurveMiddle(Curve=list_item_35)
deconstruct_brep_11 = DeconstructBrep(Brep=boundary_surfaces_6)  # -> Faces, Edges, Vertices
vector_2pt_4 = Vector2Pt(PointA=curve_middle_13, PointB=list_item_34, Unitize=False)  # -> Vector, Length
construct_plane_8 = ConstructPlane(Origin=curve_middle_13, XAxis=vector_2pt_4.Vector, YAxis=Vector(0, 1, 0))
rotate_3d_13 = Rotate3D(Geometry=deconstruct_brep_11.Faces, Angle=negative_8, Center=curve_middle_11, Axis=list_item_31)  # -> Geometry, Transform
geometry_8 = Geometry(list_item_33)
orient_11 = Orient(Geometry=geometry_8, Source=construct_plane_8, Target=rotate_plane_8)  # -> Geometry, Transform
negative_9 = Negative(Value=pi)
rotate_3d_14 = Rotate3D(Geometry=orient_11.Geometry, Angle=negative_9, Center=rotate_plane_8, Axis=list_item_32)  # -> Geometry, Transform
deconstruct_brep_12 = DeconstructBrep(Brep=rotate_3d_14.Geometry)  # -> Faces, Edges, Vertices
list_item_36 = ListItem(List=deconstruct_brep_12.Edges, Index=Slider(0, range=0..1), Wrap=True)
list_item_37 = ListItem(List=list_item_36, Index=Slider(0, range=0..2), Wrap=True)
curve_middle_14 = CurveMiddle(Curve=reverse(list_item_37))
construct_plane_9 = ConstructPlane(Origin=curve_middle_14, XAxis=list_item_37, YAxis=Vector(0, 1, 0))
pi_14 = Pi(Factor=1)
rotate_plane_9 = RotatePlane(Plane=construct_plane_9, Angle=pi_14)
geometry_9 = Geometry(deconstruct_brep_12.Edges)
negative_10 = Negative(Value=pi)
orient_12 = Orient(Geometry=geometry_9, Source=rotate_plane_9, Target=construct_plane_9)  # -> Geometry, Transform
merge_2 = Merge(
    Data1=rotate_3d_2.Geometry,
    Data2=rotate_3d_4.Geometry,
    Data3=rotate_3d_7.Geometry,
    Data4=rotate_3d_11.Geometry,
    Data5=deconstruct_brep_12.Faces)
panel_7 = Panel(negative_10)
rotate_3d_15 = Rotate3D(Geometry=orient_12.Geometry, Angle=negative_10, Center=curve_middle_14, Axis=list_item_37)  # -> Geometry, Transform
boundary_surfaces_7 = BoundarySurfaces(Edges=rotate_3d_15.Geometry)
unit_z = UnitZ(Factor=1)
deconstruct_brep_13 = DeconstructBrep(Brep=boundary_surfaces_7)  # -> Faces, Edges, Vertices
boundary_surfaces_8 = BoundarySurfaces(Edges=merge_2)
list_item_38 = ListItem(List=flatten(triangular.Cells), Index=Slider(1, range=0..10), Wrap=True)
deconstruct_brep_14 = DeconstructBrep(Brep=list_item_38)  # -> Faces, Edges, Vertices
list_item_39 = ListItem(List=flatten(deconstruct_brep_14.Vertices), Index=0, Wrap=True)
construct_plane_10 = ConstructPlane(Origin=list_item_39, XAxis=unit_z, YAxis=Vector(0, 1, 0))
merge_3 = Merge(
    Data1=boundary_surfaces_8,
    Data2=deconstruct_brep_13.Faces,
    Data3=rotate_3d_13.Geometry,
    Data4=rotate_3d_10.Geometry,
    Data5=rotate_3d_8.Geometry,
    Data6=rotate_3d_5.Geometry,
    Data7=deconstruct_brep_3.Faces)
surface = Surface(boundary_surfaces_2)
mirror_3 = Mirror(Geometry=merge_3, Plane=construct_plane_10)  # -> Geometry, Transform
