# Grasshopper definition Wolfram_Geometry_HS_004d.gh (Grasshopper 1.0.7)

# ----
# Oscillation
trigger = Trigger(Interval=20, TimerInterval=20, Target=data_recorder)
data_recorder = DataRecorder("1", DataLimit=10000, RecordData=True)
list_length = ListLength(List=data_recorder)
division = Division(A=list_length, B=Slider(22.824, range=0..100))
sine = Sine(Value=division)
absolute = Absolute(Value=sine)
multiplication = Multiplication(A=Slider(0.22, range=0..1), B=absolute)
panel = Panel(multiplication)

pi = Pi(Factor=panel)

number_slider = Slider(8, range=0..20)  # disabled
panel_2 = Panel("2")  # disabled
division_2 = Division(A=number_slider, B=panel_2)  # disabled
integer = Integer(division_2)  # disabled
range = Range(Domain=number_slider, Steps=integer)  # disabled
panel_3 = Panel("1")  # disabled
construct_point = ConstructPoint(XCoordinate=range, YCoordinate=0, ZCoordinate=0)  # disabled
multiplication_2 = Multiplication(A=panel_3, B=panel_2)  # disabled
point = Point(construct_point)  # disabled
circle = Circle(Plane=flatten(point), Radius=multiplication_2)  # disabled
dispatch = Dispatch(List=flatten(circle), DispatchPattern=[True, False])  # -> ListA, ListB; disabled
dispatch_2 = Dispatch(List=point, DispatchPattern=[True, False])  # -> ListA, ListB; disabled
shift_list = ShiftList(List=dispatch.ListA, Shift=1, Wrap=True)  # disabled
shift_list_2 = ShiftList(List=dispatch.ListB, Shift=1, Wrap=True)  # disabled
curve_curve = CurveCurve(CurveA=dispatch.ListA, CurveB=dispatch.ListB)  # -> flatten(Points), ParamsA, ParamsB; disabled
curve_curve_2 = CurveCurve(CurveA=shift_list, CurveB=dispatch.ListB)  # -> Points, ParamsA, ParamsB; disabled
list_item = ListItem(List=flatten(curve_curve.Points), Index=0, Wrap=True)  # disabled
list_item_2 = ListItem(List=flatten(dispatch_2.ListB), Index=0, Wrap=True)  # disabled
list_item_3 = ListItem(List=flatten(dispatch_2.ListA), Index=0, Wrap=True)  # disabled
polyline = PolyLine(Vertices=[list_item, list_item_3, list_item_2], Closed=True)  # disabled
orient = Orient(Geometry=polyline, Source=list_item, Target=point)  # -> Geometry, Transform; disabled
deconstruct_brep = DeconstructBrep(Brep=orient.Geometry)  # -> Faces, Edges, Vertices; disabled
panel_4 = Panel("1")  # disabled
list_item_4 = ListItem(List=deconstruct_brep.Vertices, Index=0, Wrap=True)  # disabled
list_item_5 = ListItem(List=deconstruct_brep.Vertices, Index=panel_4, Wrap=True)  # disabled
explode = Explode(Curve=orient.Geometry, Recursive=True)  # -> Segments, Vertices; disabled
orient_2 = Orient(Geometry=orient.Geometry, Source=list_item_5, Target=list_item_4)  # -> Geometry, Transform; disabled
merge = Merge(Data1=explode.Segments, Data2=orient_2.Geometry)  # disabled
boundary_surfaces = BoundarySurfaces(Edges=merge)  # disabled
xz_plane = XZPlane(Origin=Point(0, 0, 0))  # disabled
number_slider_2 = Slider(74, range=0..100)  # disabled
mirror = Mirror(Geometry=boundary_surfaces, Plane=PlaneYZ(0, 0, 0))  # -> Geometry, Transform; disabled
mirror_2 = Mirror(Geometry=mirror.Geometry, Plane=xz_plane)  # -> Geometry, Transform; disabled
deconstruct_brep_2 = DeconstructBrep(Brep=mirror_2.Geometry)  # -> Faces, Edges, Vertices; disabled
list_item_6 = ListItem(List=flatten(deconstruct_brep_2.Vertices), Index=number_slider_2, Wrap=True)  # disabled
list_item_7 = ListItem(List=flatten(deconstruct_brep_2.Vertices), Index=Slider(0, range=0..100), Wrap=True)  # disabled
orient_3 = Orient(Geometry=mirror_2.Geometry, Source=list_item_6, Target=list_item_7)  # -> Geometry, Transform; disabled

panel_5 = Panel("3")  # disabled
panel_6 = Panel("10")  # disabled
triangular = Triangular(Plane=PlaneXY(0, 0, 0), Size=1, ExtentX=panel_6, ExtentY=panel_5)  # -> simplify(Cells), Points; disabled
panel_7 = Panel("{*}[1]")  # disabled
split_tree = SplitTree(Data=triangular.Cells, Masks=flatten(panel_7))  # -> Positive, Negative; disabled
panel_8 = Panel("{1,3,...}[0]")  # disabled
panel_9 = Panel("{0,2,...}[2]")  # disabled
boolean_toggle = BooleanToggle(True)  # disabled
clean_tree = CleanTree(RemoveNulls=True, RemoveInvalid=True, RemoveEmpty=boolean_toggle, Tree=split_tree.Positive)  # disabled
split_tree_2 = SplitTree(Data=triangular.Cells, Masks=flatten(panel_8))  # -> Positive, Negative; disabled
split_tree_3 = SplitTree(Data=triangular.Cells, Masks=flatten(panel_9))  # -> Positive, Negative; disabled
panel_10 = Panel("{*}[0,2,...]")  # disabled
curve = Curve(clean_tree)  # disabled
split_tree_4 = SplitTree(Data=flatten(curve), Masks=flatten(panel_10))  # -> Positive, Negative; disabled
clean_tree_2 = CleanTree(RemoveNulls=True, RemoveInvalid=True, RemoveEmpty=boolean_toggle, Tree=split_tree_2.Positive)  # disabled
clean_tree_3 = CleanTree(RemoveNulls=True, RemoveInvalid=True, RemoveEmpty=boolean_toggle, Tree=split_tree_3.Positive)  # disabled
clean_tree_4 = CleanTree(RemoveNulls=True, RemoveInvalid=True, RemoveEmpty=boolean_toggle, Tree=split_tree_4.Negative)  # disabled
clean_tree_5 = CleanTree(RemoveNulls=True, RemoveInvalid=True, RemoveEmpty=boolean_toggle, Tree=split_tree_4.Positive)  # disabled
curve_2 = Curve(clean_tree_3)  # disabled
curve_3 = Curve(clean_tree_2)  # disabled
number_slider_3 = Slider(1, range=0..2)  # disabled
number_slider_4 = Slider(2, range=0..2)  # disabled
number_slider_5 = Slider(0, range=0..10)  # disabled
curve_4 = Curve(clean_tree_4)  # disabled
number_slider_6 = Slider(0, range=0..10)  # disabled
explode_2 = Explode(Curve=curve_4, Recursive=True)  # -> Segments, Vertices; disabled
curve_5 = Curve(clean_tree_5)  # disabled
explode_3 = Explode(Curve=curve_5, Recursive=True)  # -> flatten(Segments), Vertices; disabled
list_item_8 = ListItem(List=curve_5, Index=0, Wrap=True)  # disabled
list_item_9 = ListItem(List=curve_4, Index=number_slider_6, Wrap=True)  # disabled
list_item_10 = ListItem(List=flatten(explode_2.Segments), Index=number_slider_4, Wrap=True)  # disabled
list_item_11 = ListItem(List=flatten(curve_2), Index=number_slider_5, Wrap=True)  # disabled
list_item_12 = ListItem(List=explode_3.Segments, Index=number_slider_3, Wrap=True)  # disabled
boundary_surfaces_2 = BoundarySurfaces(Edges=list_item_8)  # disabled
negative = Negative(Value=pi)  # disabled
curve_middle = CurveMiddle(Curve=list_item_12)  # disabled
rotate_3d = Rotate3D(Geometry=list_item_11, Angle=negative, Center=curve_middle, Axis=list_item_12)  # -> Geometry, Transform; disabled
number_slider_7 = Slider(0, range=0..10)  # disabled
rotate_3d_2 = Rotate3D(Geometry=list_item_9, Angle=pi, Center=Point(0, 0, 0), Axis=list_item_10)  # -> Geometry, Transform; disabled
list_item_13 = ListItem(List=curve_5, Index=number_slider_7, Wrap=True)  # disabled
deconstruct_brep_3 = DeconstructBrep(Brep=rotate_3d.Geometry)  # -> Faces, Edges, Vertices; disabled
number_slider_8 = Slider(0, range=0..2)  # disabled
number_slider_9 = Slider(1, range=0..2)  # disabled
number_slider_10 = Slider(1, range=0..2)  # disabled
number_slider_11 = Slider(2, range=0..2)  # disabled
explode_4 = Explode(Curve=list_item_13, Recursive=True)  # -> Segments, Vertices; disabled
explode_5 = Explode(Curve=rotate_3d_2.Geometry, Recursive=True)  # -> Segments, Vertices; disabled
list_item_14 = ListItem(List=explode_5.Segments, Index=number_slider_8, Wrap=True)  # disabled
deconstruct_brep_4 = DeconstructBrep(Brep=rotate_3d_2.Geometry)  # -> Faces, Edges, Vertices; disabled
curve_middle_2 = CurveMiddle(Curve=reverse(list_item_14))  # disabled
list_item_15 = ListItem(List=explode_4.Vertices, Index=number_slider_10, Wrap=True)  # disabled
list_item_16 = ListItem(List=explode_4.Segments, Index=number_slider_11, Wrap=True)  # disabled
list_item_17 = ListItem(List=explode_5.Segments, Index=number_slider_9, Wrap=True)  # disabled
construct_plane = ConstructPlane(Origin=curve_middle_2, XAxis=list_item_14, YAxis=Vector(0, 1, 0))  # disabled
pi_2 = Pi(Factor=1)  # disabled
curve_middle_3 = CurveMiddle(Curve=list_item_16)  # disabled
curve_middle_4 = CurveMiddle(Curve=list_item_17)  # disabled
rotate_plane = RotatePlane(Plane=construct_plane, Angle=pi_2)  # disabled
geometry = Geometry(explode_5.Segments)  # disabled
plane_normal = PlaneNormal(Origin=curve_middle_4, ZAxis=deconstruct_brep_4.Faces)  # disabled
vector_2pt = Vector2Pt(PointA=curve_middle_3, PointB=list_item_15, Unitize=False)  # -> Vector, Length; disabled
negative_2 = Negative(Value=pi)  # disabled
orient_4 = Orient(Geometry=geometry, Source=rotate_plane, Target=construct_plane)  # -> Geometry, Transform; disabled
align_plane = AlignPlane(Plane=plane_normal, Direction=list_item_17)  # -> Plane, Angle; disabled
pi_3 = Pi(Factor=1)  # disabled
construct_plane_2 = ConstructPlane(Origin=curve_middle_3, XAxis=vector_2pt.Vector, YAxis=Vector(0, 1, 0))  # disabled
geometry_2 = Geometry(list_item_13)  # disabled
panel_11 = Panel(negative_2)  # disabled
panel_12 = Panel(".5")  # disabled
rotate = Rotate(Geometry=align_plane.Plane, Angle=pi_3, Plane=align_plane.Plane)  # -> Geometry, Transform; disabled
rotate_3d_3 = Rotate3D(Geometry=orient_4.Geometry, Angle=negative_2, Center=curve_middle_2, Axis=list_item_14)  # -> Geometry, Transform; disabled
pi_4 = Pi(Factor=panel_12)  # disabled
rotate_plane_2 = RotatePlane(Plane=rotate.Geometry, Angle=pi_4)  # disabled
orient_5 = Orient(Geometry=geometry_2, Source=construct_plane_2, Target=rotate_plane_2)  # -> Geometry, Transform; disabled
boundary_surfaces_3 = BoundarySurfaces(Edges=rotate_3d_3.Geometry)  # disabled
negative_3 = Negative(Value=pi)  # disabled
deconstruct_brep_5 = DeconstructBrep(Brep=boundary_surfaces_3)  # -> Faces, Edges, Vertices; disabled
rotate_3d_4 = Rotate3D(Geometry=orient_5.Geometry, Angle=negative_3, Center=rotate_plane_2, Axis=list_item_17)  # -> Geometry, Transform; disabled
rotate_3d_5 = Rotate3D(Geometry=deconstruct_brep_5.Faces, Angle=negative_2, Center=curve_middle_2, Axis=list_item_14)  # -> Geometry, Transform; disabled
number_slider_12 = Slider(1, range=0..1)  # disabled
number_slider_13 = Slider(1, range=0..10)  # disabled
deconstruct_brep_6 = DeconstructBrep(Brep=rotate_3d_4.Geometry)  # -> Faces, Edges, Vertices; disabled
number_slider_14 = Slider(0, range=0..2)  # disabled
list_item_18 = ListItem(List=deconstruct_brep_6.Edges, Index=number_slider_12, Wrap=True)  # disabled
explode_6 = Explode(Curve=rotate_3d_4.Geometry, Recursive=True)  # -> Segments, Vertices; disabled
list_item_19 = ListItem(List=curve_4, Index=number_slider_13, Wrap=True)  # disabled
number_slider_15 = Slider(0, range=0..2)  # disabled
list_item_20 = ListItem(List=explode_6.Segments, Index=number_slider_14, Wrap=True)  # disabled
curve_middle_5 = CurveMiddle(Curve=list_item_20)  # disabled
number_slider_16 = Slider(1, range=0..2)  # disabled
explode_7 = Explode(Curve=list_item_19, Recursive=True)  # -> Segments, Vertices; disabled
number_slider_17 = Slider(2, range=0..2)  # disabled
plane_normal_2 = PlaneNormal(Origin=curve_middle_5, ZAxis=deconstruct_brep_6.Faces)  # disabled
list_item_21 = ListItem(List=list_item_18, Index=number_slider_15, Wrap=True)  # disabled
list_item_22 = ListItem(List=explode_7.Vertices, Index=number_slider_16, Wrap=True)  # disabled
curve_middle_6 = CurveMiddle(Curve=reverse(list_item_21))  # disabled
list_item_23 = ListItem(List=explode_7.Segments, Index=number_slider_17, Wrap=True)  # disabled
align_plane_2 = AlignPlane(Plane=plane_normal_2, Direction=list_item_20)  # -> Plane, Angle; disabled
pi_5 = Pi(Factor=1)  # disabled
construct_plane_3 = ConstructPlane(Origin=curve_middle_6, XAxis=list_item_21, YAxis=Vector(0, 1, 0))  # disabled
curve_middle_7 = CurveMiddle(Curve=list_item_23)  # disabled
pi_6 = Pi(Factor=1)  # disabled
panel_13 = Panel(".5")  # disabled
rotate_2 = Rotate(Geometry=align_plane_2.Plane, Angle=pi_5, Plane=align_plane_2.Plane)  # -> Geometry, Transform; disabled
pi_7 = Pi(Factor=panel_13)  # disabled
rotate_plane_3 = RotatePlane(Plane=construct_plane_3, Angle=pi_6)  # disabled
vector_2pt_2 = Vector2Pt(PointA=curve_middle_7, PointB=list_item_22, Unitize=False)  # -> Vector, Length; disabled
geometry_3 = Geometry(deconstruct_brep_6.Edges)  # disabled
rotate_plane_4 = RotatePlane(Plane=rotate_2.Geometry, Angle=pi_7)  # disabled
geometry_4 = Geometry(list_item_19)  # disabled
construct_plane_4 = ConstructPlane(Origin=curve_middle_7, XAxis=vector_2pt_2.Vector, YAxis=Vector(0, 1, 0))  # disabled
negative_4 = Negative(Value=pi)  # disabled
orient_6 = Orient(Geometry=geometry_3, Source=rotate_plane_3, Target=construct_plane_3)  # -> Geometry, Transform; disabled
panel_14 = Panel("2")  # disabled
number_slider_18 = Slider(0.34, range=0..2)  # disabled
panel_15 = Panel(negative_4)  # disabled
negative_5 = Negative(Value=pi)  # disabled
orient_7 = Orient(Geometry=geometry_4, Source=construct_plane_4, Target=rotate_plane_4)  # -> Geometry, Transform; disabled
rotate_3d_6 = Rotate3D(Geometry=orient_6.Geometry, Angle=negative_4, Center=curve_middle_6, Axis=list_item_21)  # -> Geometry, Transform; disabled
rotate_3d_7 = Rotate3D(Geometry=orient_7.Geometry, Angle=negative_5, Center=rotate_plane_4, Axis=list_item_20)  # -> Geometry, Transform; disabled
boundary_surfaces_4 = BoundarySurfaces(Edges=rotate_3d_6.Geometry)  # disabled
deconstruct_brep_7 = DeconstructBrep(Brep=boundary_surfaces_4)  # -> Faces, Edges, Vertices; disabled
number_slider_19 = Slider(0, range=0..1)  # disabled
explode_8 = Explode(Curve=rotate_3d_7.Geometry, Recursive=True)  # -> Segments, Vertices; disabled
number_slider_20 = Slider(2, range=0..10)  # disabled
number_slider_21 = Slider(1, range=0..2)  # disabled
rotate_3d_8 = Rotate3D(Geometry=deconstruct_brep_7.Faces, Angle=negative_4, Center=curve_middle_6, Axis=list_item_21)  # -> Geometry, Transform; disabled
deconstruct_brep_8 = DeconstructBrep(Brep=rotate_3d_7.Geometry)  # -> Faces, Edges, Vertices; disabled
number_slider_22 = Slider(0, range=0..2)  # disabled
list_item_24 = ListItem(List=curve_5, Index=number_slider_20, Wrap=True)  # disabled
list_item_25 = ListItem(List=explode_8.Segments, Index=number_slider_21, Wrap=True)  # disabled
list_item_26 = ListItem(List=deconstruct_brep_8.Edges, Index=number_slider_19, Wrap=True)  # disabled
curve_middle_8 = CurveMiddle(Curve=list_item_25)  # disabled
list_item_27 = ListItem(List=list_item_26, Index=number_slider_22, Wrap=True)  # disabled
curve_middle_9 = CurveMiddle(Curve=reverse(list_item_27))  # disabled
plane_normal_3 = PlaneNormal(Origin=curve_middle_8, ZAxis=deconstruct_brep_8.Faces)  # disabled
construct_plane_5 = ConstructPlane(Origin=curve_middle_9, XAxis=list_item_27, YAxis=Vector(0, 1, 0))  # disabled
pi_8 = Pi(Factor=1)  # disabled
number_slider_23 = Slider(1, range=0..2)  # disabled
align_plane_3 = AlignPlane(Plane=plane_normal_3, Direction=list_item_25)  # -> Plane, Angle; disabled
explode_9 = Explode(Curve=list_item_24, Recursive=True)  # -> Segments, Vertices; disabled
pi_9 = Pi(Factor=1)  # disabled
number_slider_24 = Slider(2, range=0..2)  # disabled
rotate_plane_5 = RotatePlane(Plane=construct_plane_5, Angle=pi_9)  # disabled
panel_16 = Panel(".5")  # disabled
geometry_5 = Geometry(deconstruct_brep_8.Edges)  # disabled
rotate_3 = Rotate(Geometry=align_plane_3.Plane, Angle=pi_8, Plane=align_plane_3.Plane)  # -> Geometry, Transform; disabled
list_item_28 = ListItem(List=explode_9.Vertices, Index=number_slider_23, Wrap=True)  # disabled
list_item_29 = ListItem(List=explode_9.Segments, Index=number_slider_24, Wrap=True)  # disabled
pi_10 = Pi(Factor=panel_16)  # disabled
negative_6 = Negative(Value=pi)  # disabled
orient_8 = Orient(Geometry=geometry_5, Source=rotate_plane_5, Target=construct_plane_5)  # -> Geometry, Transform; disabled
rotate_plane_6 = RotatePlane(Plane=rotate_3.Geometry, Angle=pi_10)  # disabled
curve_middle_10 = CurveMiddle(Curve=list_item_29)  # disabled
panel_17 = Panel(negative_6)  # disabled
rotate_3d_9 = Rotate3D(Geometry=orient_8.Geometry, Angle=negative_6, Center=curve_middle_9, Axis=list_item_27)  # -> Geometry, Transform; disabled
vector_2pt_3 = Vector2Pt(PointA=curve_middle_10, PointB=list_item_28, Unitize=False)  # -> Vector, Length; disabled
boundary_surfaces_5 = BoundarySurfaces(Edges=rotate_3d_9.Geometry)  # disabled
construct_plane_6 = ConstructPlane(Origin=curve_middle_10, XAxis=vector_2pt_3.Vector, YAxis=Vector(0, 1, 0))  # disabled
geometry_6 = Geometry(list_item_24)  # disabled
deconstruct_brep_9 = DeconstructBrep(Brep=boundary_surfaces_5)  # -> Faces, Edges, Vertices; disabled
orient_9 = Orient(Geometry=geometry_6, Source=construct_plane_6, Target=rotate_plane_6)  # -> Geometry, Transform; disabled
negative_7 = Negative(Value=pi)  # disabled
rotate_3d_10 = Rotate3D(Geometry=deconstruct_brep_9.Faces, Angle=negative_6, Center=curve_middle_9, Axis=list_item_27)  # -> Geometry, Transform; disabled
rotate_3d_11 = Rotate3D(Geometry=orient_9.Geometry, Angle=negative_7, Center=rotate_plane_6, Axis=list_item_25)  # -> Geometry, Transform; disabled
number_slider_25 = Slider(1, range=0..1)  # disabled
deconstruct_brep_10 = DeconstructBrep(Brep=rotate_3d_11.Geometry)  # -> Faces, Edges, Vertices; disabled
number_slider_26 = Slider(0, range=0..2)  # disabled
number_slider_27 = Slider(0, range=0..2)  # disabled
explode_10 = Explode(Curve=rotate_3d_11.Geometry, Recursive=True)  # -> Segments, Vertices; disabled
list_item_30 = ListItem(List=deconstruct_brep_10.Edges, Index=number_slider_25, Wrap=True)  # disabled
list_item_31 = ListItem(List=list_item_30, Index=number_slider_26, Wrap=True)  # disabled
curve_middle_11 = CurveMiddle(Curve=reverse(list_item_31))  # disabled
list_item_32 = ListItem(List=explode_10.Segments, Index=number_slider_27, Wrap=True)  # disabled
curve_middle_12 = CurveMiddle(Curve=list_item_32)  # disabled
plane_normal_4 = PlaneNormal(Origin=curve_middle_12, ZAxis=deconstruct_brep_10.Faces)  # disabled
number_slider_28 = Slider(2, range=0..10)  # disabled
pi_11 = Pi(Factor=1)  # disabled
align_plane_4 = AlignPlane(Plane=plane_normal_4, Direction=list_item_32)  # -> Plane, Angle; disabled
construct_plane_7 = ConstructPlane(Origin=curve_middle_11, XAxis=list_item_31, YAxis=Vector(0, 1, 0))  # disabled
pi_12 = Pi(Factor=1)  # disabled
panel_18 = Panel(".5")  # disabled
list_item_33 = ListItem(List=curve_4, Index=number_slider_28, Wrap=True)  # disabled
rotate_plane_7 = RotatePlane(Plane=construct_plane_7, Angle=pi_12)  # disabled
rotate_4 = Rotate(Geometry=align_plane_4.Plane, Angle=pi_11, Plane=align_plane_4.Plane)  # -> Geometry, Transform; disabled
geometry_7 = Geometry(deconstruct_brep_10.Edges)  # disabled
pi_13 = Pi(Factor=panel_18)  # disabled
negative_8 = Negative(Value=pi)  # disabled
orient_10 = Orient(Geometry=geometry_7, Source=rotate_plane_7, Target=construct_plane_7)  # -> Geometry, Transform; disabled
number_slider_29 = Slider(1, range=0..2)  # disabled
explode_11 = Explode(Curve=list_item_33, Recursive=True)  # -> Segments, Vertices; disabled
number_slider_30 = Slider(2, range=0..2)  # disabled
rotate_plane_8 = RotatePlane(Plane=rotate_4.Geometry, Angle=pi_13)  # disabled
panel_19 = Panel(negative_8)  # disabled
list_item_34 = ListItem(List=explode_11.Vertices, Index=number_slider_29, Wrap=True)  # disabled
rotate_3d_12 = Rotate3D(Geometry=orient_10.Geometry, Angle=negative_8, Center=curve_middle_11, Axis=list_item_31)  # -> Geometry, Transform; disabled
list_item_35 = ListItem(List=explode_11.Segments, Index=number_slider_30, Wrap=True)  # disabled
boundary_surfaces_6 = BoundarySurfaces(Edges=rotate_3d_12.Geometry)  # disabled
curve_middle_13 = CurveMiddle(Curve=list_item_35)  # disabled
deconstruct_brep_11 = DeconstructBrep(Brep=boundary_surfaces_6)  # -> Faces, Edges, Vertices; disabled
vector_2pt_4 = Vector2Pt(PointA=curve_middle_13, PointB=list_item_34, Unitize=False)  # -> Vector, Length; disabled
number_slider_31 = Slider(0, range=0..1)  # disabled
number_slider_32 = Slider(0, range=0..2)  # disabled
construct_plane_8 = ConstructPlane(Origin=curve_middle_13, XAxis=vector_2pt_4.Vector, YAxis=Vector(0, 1, 0))  # disabled
rotate_3d_13 = Rotate3D(Geometry=deconstruct_brep_11.Faces, Angle=negative_8, Center=curve_middle_11, Axis=list_item_31)  # -> Geometry, Transform; disabled
geometry_8 = Geometry(list_item_33)  # disabled
orient_11 = Orient(Geometry=geometry_8, Source=construct_plane_8, Target=rotate_plane_8)  # -> Geometry, Transform; disabled
negative_9 = Negative(Value=pi)  # disabled
rotate_3d_14 = Rotate3D(Geometry=orient_11.Geometry, Angle=negative_9, Center=rotate_plane_8, Axis=list_item_32)  # -> Geometry, Transform; disabled
deconstruct_brep_12 = DeconstructBrep(Brep=rotate_3d_14.Geometry)  # -> Faces, Edges, Vertices; disabled
list_item_36 = ListItem(List=deconstruct_brep_12.Edges, Index=number_slider_31, Wrap=True)  # disabled
list_item_37 = ListItem(List=list_item_36, Index=number_slider_32, Wrap=True)  # disabled
curve_middle_14 = CurveMiddle(Curve=reverse(list_item_37))  # disabled
construct_plane_9 = ConstructPlane(Origin=curve_middle_14, XAxis=list_item_37, YAxis=Vector(0, 1, 0))  # disabled
pi_14 = Pi(Factor=1)  # disabled
rotate_plane_9 = RotatePlane(Plane=construct_plane_9, Angle=pi_14)  # disabled
geometry_9 = Geometry(deconstruct_brep_12.Edges)  # disabled
negative_10 = Negative(Value=pi)  # disabled
orient_12 = Orient(Geometry=geometry_9, Source=rotate_plane_9, Target=construct_plane_9)  # -> Geometry, Transform; disabled
merge_2 = Merge(
    Data1=rotate_3d_2.Geometry,
    Data2=rotate_3d_4.Geometry,
    Data3=rotate_3d_7.Geometry,
    Data4=rotate_3d_11.Geometry,
    Data5=deconstruct_brep_12.Faces)  # disabled
panel_20 = Panel(negative_10)  # disabled
rotate_3d_15 = Rotate3D(Geometry=orient_12.Geometry, Angle=negative_10, Center=curve_middle_14, Axis=list_item_37)  # -> Geometry, Transform; disabled
boundary_surfaces_7 = BoundarySurfaces(Edges=rotate_3d_15.Geometry)  # disabled
number_slider_33 = Slider(1, range=0..10)  # disabled
unit_z = UnitZ(Factor=1)  # disabled
deconstruct_brep_13 = DeconstructBrep(Brep=boundary_surfaces_7)  # -> Faces, Edges, Vertices; disabled
boundary_surfaces_8 = BoundarySurfaces(Edges=merge_2)  # disabled
list_item_38 = ListItem(List=flatten(triangular.Cells), Index=number_slider_33, Wrap=True)  # disabled
deconstruct_brep_14 = DeconstructBrep(Brep=list_item_38)  # -> Faces, Edges, Vertices; disabled
list_item_39 = ListItem(List=flatten(deconstruct_brep_14.Vertices), Index=0, Wrap=True)  # disabled
construct_plane_10 = ConstructPlane(Origin=list_item_39, XAxis=unit_z, YAxis=Vector(0, 1, 0))  # disabled
merge_3 = Merge(
    Data1=boundary_surfaces_8,
    Data2=deconstruct_brep_13.Faces,
    Data3=rotate_3d_13.Geometry,
    Data4=rotate_3d_10.Geometry,
    Data5=rotate_3d_8.Geometry,
    Data6=rotate_3d_5.Geometry,
    Data7=deconstruct_brep_3.Faces)  # disabled
surface = Surface(boundary_surfaces_2)  # disabled
mirror_3 = Mirror(Geometry=merge_3, Plane=construct_plane_10)  # -> Geometry, Transform; disabled

triangular_2 = Triangular(Plane=PlaneXY(0, 0, 0), Size=1, ExtentX="10", ExtentY="3")  # -> simplify(Cells), Points
split_tree_5 = SplitTree(Data=triangular_2.Cells, Masks=flatten("{*}[1]"))  # -> Positive, Negative
boolean_toggle_2 = BooleanToggle(True)
clean_tree_6 = CleanTree(RemoveNulls=True, RemoveInvalid=True, RemoveEmpty=boolean_toggle_2, Tree=split_tree_5.Positive)
split_tree_6 = SplitTree(Data=flatten(clean_tree_6), Masks=flatten("{*}[0,2,...]"))  # -> Positive, Negative
clean_tree_7 = CleanTree(RemoveNulls=True, RemoveInvalid=True, RemoveEmpty=boolean_toggle_2, Tree=split_tree_6.Positive)
clean_tree_8 = CleanTree(RemoveNulls=True, RemoveInvalid=True, RemoveEmpty=boolean_toggle_2, Tree=split_tree_6.Negative)
curve_6 = Curve(clean_tree_7)
curve_7 = Curve(clean_tree_8)
list_item_40 = ListItem(List=curve_7, Index=Slider(0, range=0..10), Wrap=True)
list_item_41 = ListItem(List=curve_6, Index=Slider(0, range=0..10), Wrap=True)
explode_12 = Explode(Curve=list_item_41, Recursive=True)  # -> Segments, Vertices
list_item_42 = ListItem(List=explode_12.Segments, Index=Slider(2, range=0..2), Wrap=True)
list_item_43 = ListItem(List=explode_12.Vertices, Index=Slider(1, range=0..2), Wrap=True)
curve_middle_15 = CurveMiddle(Curve=list_item_42)
vector_2pt_5 = Vector2Pt(PointA=curve_middle_15, PointB=list_item_43, Unitize=False)  # -> Vector, Length
explode_13 = Explode(Curve=list_item_41, Recursive=True)  # -> Segments, Vertices
deconstruct_brep_15 = DeconstructBrep(Brep=list_item_41)  # -> Faces, Edges, Vertices
construct_plane_11 = ConstructPlane(Origin=curve_middle_15, XAxis=vector_2pt_5.Vector, YAxis=Vector(0, 1, 0))
list_item_44 = ListItem(List=explode_13.Segments, Index=Slider(1, range=0..2), Wrap=True)
pi_15 = Pi(Factor=1)
curve_middle_16 = CurveMiddle(Curve=list_item_44)
pi_16 = Pi(Factor=1)
pi_17 = Pi(Factor=1)
pi_18 = Pi(Factor=1)
pi_19 = Pi(Factor=1)
plane_normal_5 = PlaneNormal(Origin=curve_middle_16, ZAxis=deconstruct_brep_15.Faces)
pi_20 = Pi(Factor=1)
pi_21 = Pi(Factor=".5")
pi_22 = Pi(Factor=1)
pi_23 = Pi(Factor=1)
pi_24 = Pi(Factor=".5")
pi_25 = Pi(Factor=1)
pi_26 = Pi(Factor=1)
pi_27 = Pi(Factor=".5")
align_plane_5 = AlignPlane(Plane=plane_normal_5, Direction=list_item_44)  # -> Plane, Angle
pi_28 = Pi(Factor=".5")
pi_29 = Pi(Factor=".5")
pi_30 = Pi(Factor=".5")
pi_31 = Pi(Factor=".5")
pi_32 = Pi(Factor=".5")
pi_33 = Pi(Factor=".5")
rotate_5 = Rotate(Geometry=align_plane_5.Plane, Angle=pi_26, Plane=align_plane_5.Plane)  # -> Geometry, Transform
pi_34 = Pi(Factor=".5")
negative_11 = Negative(Value=pi)
negative_12 = Negative(Value=pi)
negative_13 = Negative(Value=pi)
rotate_plane_10 = RotatePlane(Plane=rotate_5.Geometry, Angle=pi_34)
negative_14 = Negative(Value=pi)
negative_15 = Negative(Value=pi)
negative_16 = Negative(Value=pi)
negative_17 = Negative(Value=pi)
negative_18 = Negative(Value=pi)
negative_19 = Negative(Value=pi)
orient_13 = Orient(Geometry=list_item_41, Source=construct_plane_11, Target=rotate_plane_10)  # -> Geometry, Transform
negative_20 = Negative(Value=pi)
rotate_3d_16 = Rotate3D(Geometry=orient_13.Geometry, Angle=negative_20, Center=rotate_plane_10, Axis=list_item_44)  # -> Geometry, Transform
pi_35 = Pi(Factor=1)
pi_36 = Pi(Factor=1)
pi_37 = Pi(Factor=1)
pi_38 = Pi(Factor=1)
pi_39 = Pi(Factor=1)
pi_40 = Pi(Factor=1)
pi_41 = Pi(Factor=1)
pi_42 = Pi(Factor=".5")
pi_43 = Pi(Factor=1)
pi_44 = Pi(Factor=".5")
pi_45 = Pi(Factor=".5")
pi_46 = Pi(Factor=".5")
pi_47 = Pi(Factor=".5")
pi_48 = Pi(Factor=".5")
pi_49 = Pi(Factor=".5")
pi_50 = Pi(Factor=".5")
explode_14 = Explode(Curve=list_item_40, Recursive=True)  # -> Segments, Vertices
negative_21 = Negative(Value=pi)
negative_22 = Negative(Value=pi)
negative_23 = Negative(Value=pi)
negative_24 = Negative(Value=pi)
negative_25 = Negative(Value=pi)
negative_26 = Negative(Value=pi)
negative_27 = Negative(Value=pi)
list_item_45 = ListItem(List=flatten(explode_14.Segments), Index=Slider(2, range=0..2), Wrap=True)
negative_28 = Negative(Value=pi)
rotate_3d_17 = Rotate3D(Geometry=list_item_40, Angle=pi, Center=Point(0, 0, 0), Axis=list_item_45)  # -> Geometry, Transform
explode_15 = Explode(Curve=rotate_3d_17.Geometry, Recursive=True)  # -> Segments, Vertices
deconstruct_brep_16 = DeconstructBrep(Brep=rotate_3d_17.Geometry)  # -> Faces, Edges, Vertices
list_item_46 = ListItem(List=explode_15.Segments, Index=Slider(0, range=0..2), Wrap=True)
curve_middle_17 = CurveMiddle(Curve=list_item_46)
plane_normal_6 = PlaneNormal(Origin=curve_middle_17, ZAxis=deconstruct_brep_16.Faces)
align_plane_6 = AlignPlane(Plane=plane_normal_6, Direction=list_item_46)  # -> Plane, Angle
rotate_6 = Rotate(Geometry=align_plane_6.Plane, Angle=pi_23, Plane=align_plane_6.Plane)  # -> Geometry, Transform
rotate_plane_11 = RotatePlane(Plane=rotate_6.Geometry, Angle=pi_32)
orient_14 = Orient(Geometry=list_item_41, Source=construct_plane_11, Target=rotate_plane_11)  # -> Geometry, Transform
rotate_3d_18 = Rotate3D(Geometry=orient_14.Geometry, Angle=negative_18, Center=rotate_plane_11, Axis=list_item_46)  # -> Geometry, Transform
explode_16 = Explode(Curve=rotate_3d_17.Geometry, Recursive=True)  # -> Segments, Vertices
deconstruct_brep_17 = DeconstructBrep(Brep=rotate_3d_17.Geometry)  # -> Faces, Edges, Vertices
list_item_47 = ListItem(List=explode_16.Segments, Index=Slider(1, range=0..2), Wrap=True)
curve_middle_18 = CurveMiddle(Curve=list_item_47)
plane_normal_7 = PlaneNormal(Origin=curve_middle_18, ZAxis=deconstruct_brep_17.Faces)
align_plane_7 = AlignPlane(Plane=plane_normal_7, Direction=list_item_47)  # -> Plane, Angle
rotate_7 = Rotate(Geometry=align_plane_7.Plane, Angle=pi_39, Plane=align_plane_7.Plane)  # -> Geometry, Transform
rotate_plane_12 = RotatePlane(Plane=rotate_7.Geometry, Angle=pi_47)
orient_15 = Orient(Geometry=list_item_41, Source=construct_plane_11, Target=rotate_plane_12)  # -> Geometry, Transform
rotate_3d_19 = Rotate3D(Geometry=orient_15.Geometry, Angle=negative_25, Center=rotate_plane_12, Axis=list_item_47)  # -> Geometry, Transform
explode_17 = Explode(Curve=rotate_3d_19.Geometry, Recursive=True)  # -> Segments, Vertices
deconstruct_brep_18 = DeconstructBrep(Brep=rotate_3d_19.Geometry)  # -> Faces, Edges, Vertices
list_item_48 = ListItem(List=explode_17.Segments, Index=Slider(1, range=0..2), Wrap=True)
curve_middle_19 = CurveMiddle(Curve=list_item_48)
plane_normal_8 = PlaneNormal(Origin=curve_middle_19, ZAxis=deconstruct_brep_18.Faces)
align_plane_8 = AlignPlane(Plane=plane_normal_8, Direction=list_item_48)  # -> Plane, Angle
rotate_8 = Rotate(Geometry=align_plane_8.Plane, Angle=pi_25, Plane=align_plane_8.Plane)  # -> Geometry, Transform
rotate_plane_13 = RotatePlane(Plane=rotate_8.Geometry, Angle=pi_33)
orient_16 = Orient(Geometry=list_item_41, Source=construct_plane_11, Target=rotate_plane_13)  # -> Geometry, Transform
rotate_3d_20 = Rotate3D(Geometry=orient_16.Geometry, Angle=negative_19, Center=rotate_plane_13, Axis=list_item_48)  # -> Geometry, Transform
explode_18 = Explode(Curve=rotate_3d_19.Geometry, Recursive=True)  # -> Segments, Vertices
deconstruct_brep_19 = DeconstructBrep(Brep=rotate_3d_19.Geometry)  # -> Faces, Edges, Vertices
list_item_49 = ListItem(List=explode_18.Segments, Index=Slider(0, range=0..2), Wrap=True)
curve_middle_20 = CurveMiddle(Curve=list_item_49)
plane_normal_9 = PlaneNormal(Origin=curve_middle_20, ZAxis=deconstruct_brep_19.Faces)
align_plane_9 = AlignPlane(Plane=plane_normal_9, Direction=list_item_49)  # -> Plane, Angle
rotate_9 = Rotate(Geometry=align_plane_9.Plane, Angle=pi_40, Plane=align_plane_9.Plane)  # -> Geometry, Transform
rotate_plane_14 = RotatePlane(Plane=rotate_9.Geometry, Angle=pi_48)
orient_17 = Orient(Geometry=list_item_41, Source=construct_plane_11, Target=rotate_plane_14)  # -> Geometry, Transform
rotate_3d_21 = Rotate3D(Geometry=orient_17.Geometry, Angle=negative_26, Center=rotate_plane_14, Axis=list_item_49)  # -> Geometry, Transform
explode_19 = Explode(Curve=rotate_3d_21.Geometry, Recursive=True)  # -> Segments, Vertices
deconstruct_brep_20 = DeconstructBrep(Brep=rotate_3d_21.Geometry)  # -> Faces, Edges, Vertices
list_item_50 = ListItem(List=explode_19.Segments, Index=Slider(0, range=0..2), Wrap=True)
curve_middle_21 = CurveMiddle(Curve=list_item_50)
plane_normal_10 = PlaneNormal(Origin=curve_middle_21, ZAxis=deconstruct_brep_20.Faces)
align_plane_10 = AlignPlane(Plane=plane_normal_10, Direction=list_item_50)  # -> Plane, Angle
rotate_10 = Rotate(Geometry=align_plane_10.Plane, Angle=pi_22, Plane=align_plane_10.Plane)  # -> Geometry, Transform
rotate_plane_15 = RotatePlane(Plane=rotate_10.Geometry, Angle=pi_31)
orient_18 = Orient(Geometry=list_item_41, Source=construct_plane_11, Target=rotate_plane_15)  # -> Geometry, Transform
rotate_3d_22 = Rotate3D(Geometry=orient_18.Geometry, Angle=negative_17, Center=rotate_plane_15, Axis=list_item_50)  # -> Geometry, Transform
explode_20 = Explode(Curve=rotate_3d_21.Geometry, Recursive=True)  # -> Segments, Vertices
deconstruct_brep_21 = DeconstructBrep(Brep=rotate_3d_21.Geometry)  # -> Faces, Edges, Vertices
list_item_51 = ListItem(List=explode_20.Segments, Index=Slider(1, range=0..2), Wrap=True)
curve_middle_22 = CurveMiddle(Curve=list_item_51)
plane_normal_11 = PlaneNormal(Origin=curve_middle_22, ZAxis=deconstruct_brep_21.Faces)
align_plane_11 = AlignPlane(Plane=plane_normal_11, Direction=list_item_51)  # -> Plane, Angle
rotate_11 = Rotate(Geometry=align_plane_11.Plane, Angle=pi_41, Plane=align_plane_11.Plane)  # -> Geometry, Transform
rotate_plane_16 = RotatePlane(Plane=rotate_11.Geometry, Angle=pi_49)
orient_19 = Orient(Geometry=list_item_41, Source=construct_plane_11, Target=rotate_plane_16)  # -> Geometry, Transform
rotate_3d_23 = Rotate3D(Geometry=orient_19.Geometry, Angle=negative_27, Center=rotate_plane_16, Axis=list_item_51)  # -> Geometry, Transform
explode_21 = Explode(Curve=rotate_3d_23.Geometry, Recursive=True)  # -> Segments, Vertices
deconstruct_brep_22 = DeconstructBrep(Brep=rotate_3d_23.Geometry)  # -> Faces, Edges, Vertices
list_item_52 = ListItem(List=explode_21.Segments, Index=Slider(1, range=0..2), Wrap=True)
curve_middle_23 = CurveMiddle(Curve=list_item_52)
plane_normal_12 = PlaneNormal(Origin=curve_middle_23, ZAxis=deconstruct_brep_22.Faces)
align_plane_12 = AlignPlane(Plane=plane_normal_12, Direction=list_item_52)  # -> Plane, Angle
rotate_12 = Rotate(Geometry=align_plane_12.Plane, Angle=pi_20, Plane=align_plane_12.Plane)  # -> Geometry, Transform
rotate_plane_17 = RotatePlane(Plane=rotate_12.Geometry, Angle=pi_30)
orient_20 = Orient(Geometry=list_item_41, Source=construct_plane_11, Target=rotate_plane_17)  # -> Geometry, Transform
rotate_3d_24 = Rotate3D(Geometry=orient_20.Geometry, Angle=negative_16, Center=rotate_plane_17, Axis=list_item_52)  # -> Geometry, Transform
explode_22 = Explode(Curve=rotate_3d_23.Geometry, Recursive=True)  # -> Segments, Vertices
deconstruct_brep_23 = DeconstructBrep(Brep=rotate_3d_23.Geometry)  # -> Faces, Edges, Vertices
list_item_53 = ListItem(List=explode_22.Segments, Index=Slider(0, range=0..2), Wrap=True)
curve_middle_24 = CurveMiddle(Curve=list_item_53)
plane_normal_13 = PlaneNormal(Origin=curve_middle_24, ZAxis=deconstruct_brep_23.Faces)
align_plane_13 = AlignPlane(Plane=plane_normal_13, Direction=list_item_53)  # -> Plane, Angle
rotate_13 = Rotate(Geometry=align_plane_13.Plane, Angle=pi_43, Plane=align_plane_13.Plane)  # -> Geometry, Transform
rotate_plane_18 = RotatePlane(Plane=rotate_13.Geometry, Angle=pi_50)
orient_21 = Orient(Geometry=list_item_41, Source=construct_plane_11, Target=rotate_plane_18)  # -> Geometry, Transform
rotate_3d_25 = Rotate3D(Geometry=orient_21.Geometry, Angle=negative_28, Center=rotate_plane_18, Axis=list_item_53)  # -> Geometry, Transform
explode_23 = Explode(Curve=rotate_3d_25.Geometry, Recursive=True)  # -> Segments, Vertices
deconstruct_brep_24 = DeconstructBrep(Brep=rotate_3d_25.Geometry)  # -> Faces, Edges, Vertices
list_item_54 = ListItem(List=explode_23.Segments, Index=Slider(0, range=0..2), Wrap=True)
curve_middle_25 = CurveMiddle(Curve=list_item_54)
plane_normal_14 = PlaneNormal(Origin=curve_middle_25, ZAxis=deconstruct_brep_24.Faces)
align_plane_14 = AlignPlane(Plane=plane_normal_14, Direction=list_item_54)  # -> Plane, Angle
rotate_14 = Rotate(Geometry=align_plane_14.Plane, Angle=pi_19, Plane=align_plane_14.Plane)  # -> Geometry, Transform
rotate_plane_19 = RotatePlane(Plane=rotate_14.Geometry, Angle=pi_29)
orient_22 = Orient(Geometry=list_item_41, Source=construct_plane_11, Target=rotate_plane_19)  # -> Geometry, Transform
rotate_3d_26 = Rotate3D(Geometry=orient_22.Geometry, Angle=negative_15, Center=rotate_plane_19, Axis=list_item_54)  # -> Geometry, Transform
explode_24 = Explode(Curve=rotate_3d_25.Geometry, Recursive=True)  # -> Segments, Vertices
deconstruct_brep_25 = DeconstructBrep(Brep=rotate_3d_25.Geometry)  # -> Faces, Edges, Vertices
list_item_55 = ListItem(List=explode_24.Segments, Index=Slider(1, range=0..2), Wrap=True)
curve_middle_26 = CurveMiddle(Curve=list_item_55)
plane_normal_15 = PlaneNormal(Origin=curve_middle_26, ZAxis=deconstruct_brep_25.Faces)
align_plane_15 = AlignPlane(Plane=plane_normal_15, Direction=list_item_55)  # -> Plane, Angle
rotate_15 = Rotate(Geometry=align_plane_15.Plane, Angle=pi_38, Plane=align_plane_15.Plane)  # -> Geometry, Transform
rotate_plane_20 = RotatePlane(Plane=rotate_15.Geometry, Angle=pi_46)
orient_23 = Orient(Geometry=list_item_41, Source=construct_plane_11, Target=rotate_plane_20)  # -> Geometry, Transform
rotate_3d_27 = Rotate3D(Geometry=orient_23.Geometry, Angle=negative_24, Center=rotate_plane_20, Axis=list_item_55)  # -> Geometry, Transform
explode_25 = Explode(Curve=rotate_3d_27.Geometry, Recursive=True)  # -> Segments, Vertices
deconstruct_brep_26 = DeconstructBrep(Brep=rotate_3d_27.Geometry)  # -> Faces, Edges, Vertices
list_item_56 = ListItem(List=explode_25.Segments, Index=Slider(1, range=0..2), Wrap=True)
curve_middle_27 = CurveMiddle(Curve=list_item_56)
plane_normal_16 = PlaneNormal(Origin=curve_middle_27, ZAxis=deconstruct_brep_26.Faces)
align_plane_16 = AlignPlane(Plane=plane_normal_16, Direction=list_item_56)  # -> Plane, Angle
rotate_16 = Rotate(Geometry=align_plane_16.Plane, Angle=pi_18, Plane=align_plane_16.Plane)  # -> Geometry, Transform
rotate_plane_21 = RotatePlane(Plane=rotate_16.Geometry, Angle=pi_28)
orient_24 = Orient(Geometry=list_item_41, Source=construct_plane_11, Target=rotate_plane_21)  # -> Geometry, Transform
rotate_3d_28 = Rotate3D(Geometry=orient_24.Geometry, Angle=negative_14, Center=rotate_plane_21, Axis=list_item_56)  # -> Geometry, Transform
explode_26 = Explode(Curve=rotate_3d_27.Geometry, Recursive=True)  # -> Segments, Vertices
deconstruct_brep_27 = DeconstructBrep(Brep=rotate_3d_27.Geometry)  # -> Faces, Edges, Vertices
list_item_57 = ListItem(List=explode_26.Segments, Index=Slider(0, range=0..2), Wrap=True)
curve_middle_28 = CurveMiddle(Curve=list_item_57)
plane_normal_17 = PlaneNormal(Origin=curve_middle_28, ZAxis=deconstruct_brep_27.Faces)
align_plane_17 = AlignPlane(Plane=plane_normal_17, Direction=list_item_57)  # -> Plane, Angle
rotate_17 = Rotate(Geometry=align_plane_17.Plane, Angle=pi_37, Plane=align_plane_17.Plane)  # -> Geometry, Transform
rotate_plane_22 = RotatePlane(Plane=rotate_17.Geometry, Angle=pi_45)
orient_25 = Orient(Geometry=list_item_41, Source=construct_plane_11, Target=rotate_plane_22)  # -> Geometry, Transform
rotate_3d_29 = Rotate3D(Geometry=orient_25.Geometry, Angle=negative_23, Center=rotate_plane_22, Axis=list_item_57)  # -> Geometry, Transform
explode_27 = Explode(Curve=rotate_3d_29.Geometry, Recursive=True)  # -> Segments, Vertices
deconstruct_brep_28 = DeconstructBrep(Brep=rotate_3d_29.Geometry)  # -> Faces, Edges, Vertices
list_item_58 = ListItem(List=explode_27.Segments, Index=Slider(0, range=0..2), Wrap=True)
curve_middle_29 = CurveMiddle(Curve=list_item_58)
plane_normal_18 = PlaneNormal(Origin=curve_middle_29, ZAxis=deconstruct_brep_28.Faces)
align_plane_18 = AlignPlane(Plane=plane_normal_18, Direction=list_item_58)  # -> Plane, Angle
rotate_18 = Rotate(Geometry=align_plane_18.Plane, Angle=pi_17, Plane=align_plane_18.Plane)  # -> Geometry, Transform
rotate_plane_23 = RotatePlane(Plane=rotate_18.Geometry, Angle=pi_27)
orient_26 = Orient(Geometry=list_item_41, Source=construct_plane_11, Target=rotate_plane_23)  # -> Geometry, Transform
rotate_3d_30 = Rotate3D(Geometry=orient_26.Geometry, Angle=negative_13, Center=rotate_plane_23, Axis=list_item_58)  # -> Geometry, Transform
explode_28 = Explode(Curve=rotate_3d_29.Geometry, Recursive=True)  # -> Segments, Vertices
deconstruct_brep_29 = DeconstructBrep(Brep=rotate_3d_29.Geometry)  # -> Faces, Edges, Vertices
list_item_59 = ListItem(List=explode_28.Segments, Index=Slider(1, range=0..2), Wrap=True)
curve_middle_30 = CurveMiddle(Curve=list_item_59)
plane_normal_19 = PlaneNormal(Origin=curve_middle_30, ZAxis=deconstruct_brep_29.Faces)
align_plane_19 = AlignPlane(Plane=plane_normal_19, Direction=list_item_59)  # -> Plane, Angle
rotate_19 = Rotate(Geometry=align_plane_19.Plane, Angle=pi_36, Plane=align_plane_19.Plane)  # -> Geometry, Transform
rotate_plane_24 = RotatePlane(Plane=rotate_19.Geometry, Angle=pi_44)
orient_27 = Orient(Geometry=list_item_41, Source=construct_plane_11, Target=rotate_plane_24)  # -> Geometry, Transform
rotate_3d_31 = Rotate3D(Geometry=orient_27.Geometry, Angle=negative_22, Center=rotate_plane_24, Axis=list_item_59)  # -> Geometry, Transform
explode_29 = Explode(Curve=rotate_3d_31.Geometry, Recursive=True)  # -> Segments, Vertices
deconstruct_brep_30 = DeconstructBrep(Brep=rotate_3d_31.Geometry)  # -> Faces, Edges, Vertices
list_item_60 = ListItem(List=explode_29.Segments, Index=Slider(1, range=0..2), Wrap=True)
curve_middle_31 = CurveMiddle(Curve=list_item_60)
plane_normal_20 = PlaneNormal(Origin=curve_middle_31, ZAxis=deconstruct_brep_30.Faces)
align_plane_20 = AlignPlane(Plane=plane_normal_20, Direction=list_item_60)  # -> Plane, Angle
rotate_20 = Rotate(Geometry=align_plane_20.Plane, Angle=pi_16, Plane=align_plane_20.Plane)  # -> Geometry, Transform
rotate_plane_25 = RotatePlane(Plane=rotate_20.Geometry, Angle=pi_24)
orient_28 = Orient(Geometry=list_item_41, Source=construct_plane_11, Target=rotate_plane_25)  # -> Geometry, Transform
rotate_3d_32 = Rotate3D(Geometry=orient_28.Geometry, Angle=negative_12, Center=rotate_plane_25, Axis=list_item_60)  # -> Geometry, Transform
explode_30 = Explode(Curve=rotate_3d_31.Geometry, Recursive=True)  # -> Segments, Vertices
deconstruct_brep_31 = DeconstructBrep(Brep=rotate_3d_31.Geometry)  # -> Faces, Edges, Vertices
list_item_61 = ListItem(List=explode_30.Segments, Index=Slider(0, range=0..2), Wrap=True)
curve_middle_32 = CurveMiddle(Curve=list_item_61)
plane_normal_21 = PlaneNormal(Origin=curve_middle_32, ZAxis=deconstruct_brep_31.Faces)
align_plane_21 = AlignPlane(Plane=plane_normal_21, Direction=list_item_61)  # -> Plane, Angle
rotate_21 = Rotate(Geometry=align_plane_21.Plane, Angle=pi_35, Plane=align_plane_21.Plane)  # -> Geometry, Transform
rotate_plane_26 = RotatePlane(Plane=rotate_21.Geometry, Angle=pi_42)
orient_29 = Orient(Geometry=list_item_41, Source=construct_plane_11, Target=rotate_plane_26)  # -> Geometry, Transform
rotate_3d_33 = Rotate3D(Geometry=orient_29.Geometry, Angle=negative_21, Center=rotate_plane_26, Axis=list_item_61)  # -> Geometry, Transform
explode_31 = Explode(Curve=rotate_3d_33.Geometry, Recursive=True)  # -> Segments, Vertices
deconstruct_brep_32 = DeconstructBrep(Brep=rotate_3d_33.Geometry)  # -> Faces, Edges, Vertices
list_item_62 = ListItem(List=explode_31.Segments, Index=Slider(0, range=0..2), Wrap=True)
curve_middle_33 = CurveMiddle(Curve=list_item_62)
plane_normal_22 = PlaneNormal(Origin=curve_middle_33, ZAxis=deconstruct_brep_32.Faces)
align_plane_22 = AlignPlane(Plane=plane_normal_22, Direction=list_item_62)  # -> Plane, Angle
rotate_22 = Rotate(Geometry=align_plane_22.Plane, Angle=pi_15, Plane=align_plane_22.Plane)  # -> Geometry, Transform
rotate_plane_27 = RotatePlane(Plane=rotate_22.Geometry, Angle=pi_21)
orient_30 = Orient(Geometry=list_item_41, Source=construct_plane_11, Target=rotate_plane_27)  # -> Geometry, Transform
rotate_3d_34 = Rotate3D(Geometry=orient_30.Geometry, Angle=negative_11, Center=rotate_plane_27, Axis=list_item_62)  # -> Geometry, Transform
relay = Relay()
merge_4 = Merge(
    Data1=list_item_41,
    Data2=rotate_3d_17.Geometry,
    Data3=rotate_3d_16.Geometry,
    Data4=rotate_3d_19.Geometry,
    Data5=rotate_3d_18.Geometry,
    Data6=rotate_3d_21.Geometry,
    Data7=rotate_3d_20.Geometry,
    Data8=rotate_3d_23.Geometry,
    Data9=rotate_3d_22.Geometry,
    Data10=rotate_3d_25.Geometry,
    Data11=rotate_3d_24.Geometry,
    Data12=rotate_3d_27.Geometry,
    Data13=rotate_3d_26.Geometry,
    Data14=rotate_3d_29.Geometry,
    Data15=rotate_3d_28.Geometry,
    Data16=rotate_3d_31.Geometry,
    Data17=rotate_3d_30.Geometry,
    Data18=rotate_3d_33.Geometry,
    Data19=rotate_3d_32.Geometry,
    Data20=rotate_3d_34.Geometry)
