# Grasshopper definition Wolfram_Intro_001.gh (Grasshopper 1.0.7)

number_slider = Slider(83, range=0..100)
negative = Negative(Value="5")
construct_domain = ConstructDomain(DomainStart=negative, DomainEnd="5")
range = Range(Domain=construct_domain, Steps=number_slider)
pi = Pi(Factor=Slider(7.62, range=0..10))
multiplication = Multiplication(A=pi, B=range)
expression = Expression(x=multiplication, y=multiplication, Expression="sin(x+y)* cos(x-y)")
range_2 = Range(Domain=construct_domain, Steps=Slider(9, range=0..10))
range_3 = Range(Domain=construct_domain, Steps=number_slider)
construct_point = ConstructPoint(XCoordinate=range_3, YCoordinate=expression, ZCoordinate=0)
unit_y = UnitY(Factor=range_2)
move = Move(Geometry=graft(construct_point), Motion=unit_y)  # -> simplify(Geometry), Transform
flip_matrix = FlipMatrix(Data=move.Geometry)
param_viewer = ParamViewer(flip_matrix)
split_tree = SplitTree(Data=flip_matrix, Masks=flatten("{0,2,...}"))  # -> Positive, Negative
unit_z = UnitZ(Factor=Slider(0.701, range=0..1))
point = Point(split_tree.Positive)
point_2 = Point(split_tree.Negative)
move_2 = Move(Geometry=point, Motion=unit_z)  # -> Geometry, Transform
interpolate = Interpolate(Vertices=flip_matrix, Degree=3, Periodic=False, KnotStyle=1)  # -> Curve, Length, Domain
interpolate_2 = Interpolate(Vertices=move_2.Geometry, Degree=3, Periodic=False, KnotStyle=1)  # -> Curve, Length, Domain
merge = Merge(Data1=interpolate.Curve, Data2=interpolate_2.Curve)  # -> flatten(Result)
loft = Loft(Curves=merge, Options={Adjust=False, Closed=False, LoftEnds=0, LoftSimp=0, LoftType=0, Rebuild=10, Refit=0.01})
