# Grasshopper definition Wolfram_Intro_005.gh (Grasshopper 1.0.7)

number_slider = Slider(6, range=3..12)
construct_point = ConstructPoint(XCoordinate=0, YCoordinate=Slider(10, range=0..10), ZCoordinate=0)
polygon = Polygon(Plane=construct_point, Radius=3, Segments=number_slider, FilletRadius=0)  # -> Polygon, Length
vector_xyz = VectorXYZ(XComponent=Slider(1, range=0..1), YComponent=Slider(0.5, range=0..1), ZComponent=Slider(0, range=0..1))  # -> Vector, Length
pi = Pi(Factor=Slider(0.5, range=0..2))
pi_2 = Pi(Factor=Slider(0.91, range=0..2))
series = Series(Start=0, Step=1, Count=number_slider)
explode = Explode(Curve=polygon.Polygon, Recursive=True)  # -> Segments, Vertices
list_item = ListItem(List=explode.Segments, Index=number_slider, Wrap=True)
curve_middle = CurveMiddle(Curve=list_item)
construct_plane = ConstructPlane(Origin=curve_middle, XAxis=vector_xyz.Vector, YAxis=Vector(0, 1, 0))
cool_cluster = Cool_cluster(
    trianglebase=polygon.Polygon,
    planesource=construct_plane,
    trianglerotate=polygon.Polygon,
    triangle=polygon.Polygon,
    index=series,
    rotation=pi)
construct_point_2 = ConstructPoint(XCoordinate=".5", YCoordinate=".5", ZCoordinate=0)
boundary_surfaces = BoundarySurfaces(Edges=cool_cluster)
area = Area(Geometry=cool_cluster)  # -> Area, Centroid
evaluate_surface = EvaluateSurface(Surface=boundary_surfaces, Point=construct_point_2)  # -> Point, Normal, UDirection, VDirection, Frame
rotate_3d = Rotate3D(Geometry=cool_cluster, Angle=pi_2, Center=area.Centroid, Axis=evaluate_surface.Normal)  # -> Geometry, Transform
loft_options = LoftOptions(Closed=Toggle(True), Adjust=False, Rebuild=0, Refit=0, Type=0)
loft = Loft(Curves=flatten(rotate_3d.Geometry), Options=loft_options)

number_slider_2 = Slider(6, range=0..10)
polygon_2 = Polygon(Plane=PlaneXY(0, 0, 0), Radius=3, Segments=6, FilletRadius=0)  # -> Polygon, Length
vector_xyz_2 = VectorXYZ(XComponent=Slider(1, range=0..1), YComponent=Slider(0.5, range=0..1), ZComponent=Slider(0, range=0..1))  # -> Vector, Length
pi_3 = Pi(Factor=Slider(0.63, range=0..2))
pi_4 = Pi(Factor=Slider(0.72, range=0..2))
series_2 = Series(Start=0, Step=1, Count=number_slider_2)
explode_2 = Explode(Curve=polygon_2.Polygon, Recursive=True)  # -> Segments, Vertices
list_item_2 = ListItem(List=explode_2.Segments, Index=number_slider_2, Wrap=True)
curve_middle_2 = CurveMiddle(Curve=list_item_2)
construct_plane_2 = ConstructPlane(Origin=curve_middle_2, XAxis=vector_xyz_2.Vector, YAxis=Vector(0, 1, 0))
align_plane = AlignPlane(Plane=construct_plane_2, Direction=list_item_2)  # -> Plane, Angle
cool_cluster_2 = Cool_cluster(
    trianglebase=polygon_2.Polygon,
    planesource=align_plane.Plane,
    trianglerotate=polygon_2.Polygon,
    triangle=polygon_2.Polygon,
    index=series_2,
    rotation=pi_4)
md_slider = MDSlider(SliderMode=0, slider_value=Point(0.5, 0.5, 0.5), x_domain=Domain(0, 1), y_domain=Domain(0, 1), z_domain=Domain(0, 1))
area_2 = Area(Geometry=cool_cluster_2)  # -> Area, Centroid
boundary_surfaces_2 = BoundarySurfaces(Edges=cool_cluster_2)
evaluate_surface_2 = EvaluateSurface(Surface=boundary_surfaces_2, Point=md_slider)  # -> Point, Normal, UDirection, VDirection, Frame
rotate_3d_2 = Rotate3D(Geometry=cool_cluster_2, Angle=pi_3, Center=area_2.Centroid, Axis=evaluate_surface_2.Normal)  # -> Geometry, Transform
loft_2 = Loft(
    Curves=rotate_3d_2.Geometry,
    Options={Adjust=False, Closed=True, LoftEnds=0, LoftSimp=0, LoftType=0, Rebuild=10, Refit=0.01})

explode_3 = Explode(Curve=polygon_2.Polygon, Recursive=True)  # -> Segments, Vertices
deconstruct_brep = DeconstructBrep(Brep=polygon_2.Polygon)  # -> Faces, Edges, Vertices
list_item_3 = ListItem(List=explode_3.Segments, Index=series_2, Wrap=True)
curve_middle_3 = CurveMiddle(Curve=list_item_3)
plane_normal = PlaneNormal(Origin=curve_middle_3, ZAxis=deconstruct_brep.Faces)
pi_5 = Pi(Factor=1)
align_plane_2 = AlignPlane(Plane=plane_normal, Direction=list_item_3)  # -> Plane, Angle
rotate = Rotate(Geometry=align_plane_2.Plane, Angle=pi_5, Plane=align_plane_2.Plane)  # -> Geometry, Transform
pi_6 = Pi(Factor=".5")
rotate_plane = RotatePlane(Plane=rotate.Geometry, Angle=pi_6)
orient = Orient(Geometry=polygon_2.Polygon, Source=align_plane.Plane, Target=rotate_plane)  # -> Geometry, Transform
negative = Negative(Value=pi_4)
rotate_3d_3 = Rotate3D(Geometry=orient.Geometry, Angle=negative, Center=rotate_plane, Axis=list_item_3)  # -> Geometry, Transform

# ==== cluster Cool_cluster
trianglerotate = ClusterInput()
rotation = ClusterInput()
triangle = ClusterInput()
index = ClusterInput()
trianglebase = ClusterInput()
planesource = ClusterInput()
explode = Explode(Curve=triangle, Recursive=True)  # -> Segments, Vertices
deconstruct_brep = DeconstructBrep(Brep=trianglerotate)  # -> Faces, Edges, Vertices
list_item = ListItem(List=explode.Segments, Index=index, Wrap=True)
curve_middle = CurveMiddle(Curve=list_item)
plane_normal = PlaneNormal(Origin=curve_middle, ZAxis=deconstruct_brep.Faces)
pi = Pi(Factor=1)
align_plane = AlignPlane(Plane=plane_normal, Direction=list_item)  # -> Plane, Angle
rotate = Rotate(Geometry=align_plane.Plane, Angle=pi, Plane=align_plane.Plane)  # -> Geometry, Transform
pi_2 = Pi(Factor=".5")
rotate_plane = RotatePlane(Plane=rotate.Geometry, Angle=pi_2)
orient = Orient(Geometry=trianglebase, Source=planesource, Target=rotate_plane)  # -> Geometry, Transform
negative = Negative(Value=rotation)
rotate_3d = Rotate3D(Geometry=orient.Geometry, Angle=negative, Center=rotate_plane, Axis=list_item)  # -> Geometry, Transform
triangleout = ClusterOutput(rotate_3d.Geometry)
