# Grasshopper definition Wolfram_Intro_006.gh (Grasshopper 1.0.7)

construct_point = ConstructPoint(XCoordinate=0, YCoordinate=0, ZCoordinate=0)
construct_point_2 = ConstructPoint(XCoordinate=0, YCoordinate=0, ZCoordinate=0)
polygon = Polygon(Plane=PlaneXY(0, 0, 0), Radius=Slider(1, range=0..1), Segments="10", FilletRadius=0)  # -> Polygon, Length
polygon_2 = Polygon(Plane=construct_point, Radius=Slider(1, range=0..1), Segments="10", FilletRadius=0)  # -> Polygon, Length
curve = Curve(polygon.Polygon)
# great
# rhombicosidodecahedron
polygon_3 = Polygon(Plane=construct_point_2, Radius=Slider(1, range=0..1), Segments="10", FilletRadius=0)  # -> Polygon, Length
explode = Explode(Curve=polygon.Polygon, Recursive=True)  # -> Segments, Vertices
explode_2 = Explode(Curve=curve, Recursive=True)  # -> Segments, Vertices
explode_3 = Explode(Curve=polygon_2.Polygon, Recursive=True)  # -> Segments, Vertices
explode_4 = Explode(Curve=polygon_3.Polygon, Recursive=True)  # -> Segments, Vertices
curve_middle = CurveMiddle(Curve=explode_3.Segments)
list_item = ListItem(List=explode.Segments, Index=Slider(2, range=0..10), Wrap=True)
curve_middle_2 = CurveMiddle(Curve=explode_4.Segments)
length = Length(Curve=list_item)
end_points = EndPoints(Curve=list_item)  # -> Start, End
vector_2pt = Vector2Pt(PointA=construct_point, PointB=curve_middle, Unitize=False)  # -> Vector, Length
vector_2pt_2 = Vector2Pt(PointA=construct_point_2, PointB=curve_middle_2, Unitize=False)  # -> Vector, Length
number_slider = Slider(2, range=0..10)
circle = Circle(Plane=end_points.Start, Radius=length)
circle_2 = Circle(Plane=end_points.End, Radius=length)
list_item_2 = ListItem(List=explode_2.Vertices, Index=Slider(7, range=0..10), Wrap=True)
number_slider_2 = Slider(2, range=0..10)
construct_plane = ConstructPlane(Origin=curve_middle, XAxis=Vector(1, 0, 0), YAxis=Vector(0, 1, 0))
construct_plane_2 = ConstructPlane(Origin=curve_middle_2, XAxis=Vector(1, 0, 0), YAxis=Vector(0, 1, 0))
curve_curve = CurveCurve(CurveA=circle, CurveB=circle_2)  # -> Points, ParamsA, ParamsB
list_item_3 = ListItem(List=construct_plane, Index=number_slider, Wrap=True)
list_item_4 = ListItem(List=explode_3.Segments, Index=number_slider, Wrap=True)
align_plane = AlignPlane(Plane=construct_plane, Direction=vector_2pt.Vector)  # -> Plane, Angle
dispatch = Dispatch(List=flatten(curve_curve.Points), DispatchPattern=[True, False])  # -> ListA, ListB
list_item_5 = ListItem(List=explode_4.Segments, Index=number_slider_2, Wrap=True)
align_plane_2 = AlignPlane(Plane=construct_plane_2, Direction=vector_2pt_2.Vector)  # -> Plane, Angle
length_2 = Length(Curve=list_item_4)
end_points_2 = EndPoints(Curve=list_item_4)  # -> Start, End
length_3 = Length(Curve=list_item_5)
end_points_3 = EndPoints(Curve=list_item_5)  # -> Start, End
point = Point(dispatch.ListA)
polar_array = PolarArray(Geometry=list_item, Plane=point, Count="6", Angle=6.283185307)  # -> Geometry, Transform
circle_3 = Circle(Plane=end_points_2.Start, Radius=length_2)
circle_4 = Circle(Plane=end_points_2.End, Radius=length_2)
circle_5 = Circle(Plane=end_points_3.Start, Radius=length_3)
circle_6 = Circle(Plane=end_points_3.End, Radius=length_3)
curve_curve_2 = CurveCurve(CurveA=circle_3, CurveB=circle_4)  # -> Points, ParamsA, ParamsB
join_curves = JoinCurves(Curves=polar_array.Geometry, Preserve=False)
curve_2 = Curve(join_curves)
curve_curve_3 = CurveCurve(CurveA=circle_5, CurveB=circle_6)  # -> Points, ParamsA, ParamsB
list_item_6 = ListItem(List=polar_array.Geometry, Index=Slider(3, range=0..10), Wrap=True)
dispatch_2 = Dispatch(List=flatten(curve_curve_2.Points), DispatchPattern=[True, False])  # -> ListA, ListB
end_points_4 = EndPoints(Curve=list_item_6)  # -> Start, End
dispatch_3 = Dispatch(List=flatten(curve_curve_3.Points), DispatchPattern=[True, False])  # -> ListA, ListB
rectangle = Rectangle(Plane=end_points_4.Start, XSize=length, YSize=length, Radius=0)  # -> Rectangle, Length
curve_3 = Curve(rectangle.Rectangle)
explode_5 = Explode(Curve=curve_3, Recursive=True)  # -> Segments, Vertices
list_item_7 = ListItem(List=explode_5.Vertices, Index=Slider(0, range=0..1), Wrap=True)
orient = Orient(Geometry=curve, Source=list_item_2, Target=list_item_7)  # -> Geometry, Transform
explode_6 = Explode(Curve=orient.Geometry, Recursive=True)  # -> Segments, Vertices
list_item_8 = ListItem(List=explode_6.Segments, Index=Slider(1, range=0..1), Wrap=True)
point_2 = Point(dispatch_2.ListA)
point_3 = Point(dispatch_3.ListA)
polar_array_2 = PolarArray(Geometry=list_item_4, Plane=point_2, Count="6", Angle=6.283185307)  # -> Geometry, Transform
polar_array_3 = PolarArray(Geometry=list_item_5, Plane=point_3, Count="6", Angle=6.283185307)  # -> Geometry, Transform
join_curves_2 = JoinCurves(Curves=polar_array_2.Geometry, Preserve=False)
join_curves_3 = JoinCurves(Curves=polar_array_3.Geometry, Preserve=False)
curve_middle_3 = CurveMiddle(Curve=polar_array_2.Geometry)
curve_middle_4 = CurveMiddle(Curve=polar_array_3.Geometry)
explode_7 = Explode(Curve=join_curves_2, Recursive=True)  # -> Segments, Vertices
explode_8 = Explode(Curve=join_curves_3, Recursive=True)  # -> Segments, Vertices
vector_2pt_3 = Vector2Pt(PointA=point_2, PointB=curve_middle_3, Unitize=False)  # -> Vector, Length
vector_2pt_4 = Vector2Pt(PointA=point_3, PointB=curve_middle_4, Unitize=False)  # -> Vector, Length
construct_plane_3 = ConstructPlane(Origin=curve_middle_3, XAxis=Vector(1, 0, 0), YAxis=Vector(0, 1, 0))
list_item_9 = ListItem(List=explode_7.Segments, Index=Slider(3, range=0..6), Wrap=True)
vector_display = VectorDisplay(Anchor=curve_middle_3, Vector=vector_2pt_3.Vector)
construct_plane_4 = ConstructPlane(Origin=curve_middle_4, XAxis=Vector(1, 0, 0), YAxis=Vector(0, 1, 0))
list_item_10 = ListItem(List=explode_8.Segments, Index=Slider(3, range=0..6), Wrap=True)
vector_display_2 = VectorDisplay(Anchor=curve_middle_4, Vector=vector_2pt_4.Vector)
list_item_11 = ListItem(List=polar_array_2.Geometry, Index=Slider(3, range=0..10), Wrap=True)
align_plane_3 = AlignPlane(Plane=construct_plane_3, Direction=vector_2pt_3.Vector)  # -> Plane, Angle
list_item_12 = ListItem(List=polar_array_3.Geometry, Index=Slider(3, range=0..10), Wrap=True)
align_plane_4 = AlignPlane(Plane=construct_plane_4, Direction=vector_2pt_4.Vector)  # -> Plane, Angle
end_points_5 = EndPoints(Curve=list_item_11)  # -> Start, End
end_points_6 = EndPoints(Curve=list_item_12)  # -> Start, End
rectangle_2 = Rectangle(Plane=end_points_5.Start, XSize=length_2, YSize=length_2, Radius=0)  # -> Rectangle, Length
rectangle_3 = Rectangle(Plane=end_points_6.Start, XSize=length_3, YSize=length_3, Radius=0)  # -> Rectangle, Length

curve_4 = Curve(polygon_2.Polygon)
curve_5 = Curve(join_curves_2)
curve_6 = Curve(rectangle_2.Rectangle)

curve_7 = Curve(polygon_3.Polygon)
curve_8 = Curve(join_curves_3)
curve_9 = Curve(rectangle_3.Rectangle)

area = Area(Geometry=rectangle_2.Rectangle)  # -> Area, Centroid
explode_9 = Explode(Curve=rectangle_2.Rectangle, Recursive=True)  # -> Segments, Vertices
area_2 = Area(Geometry=rectangle_3.Rectangle)  # -> Area, Centroid
explode_10 = Explode(Curve=rectangle_3.Rectangle, Recursive=True)  # -> Segments, Vertices
panel = Panel("""1
3""")
list_item_13 = ListItem(List=explode_9.Segments, Index=Slider(2, range=0..10), Wrap=True)
curve_middle_5 = CurveMiddle(Curve=explode_9.Segments)
curve_middle_6 = CurveMiddle(Curve=explode_10.Segments)
list_item_14 = ListItem(List=explode_10.Segments, Index=panel, Wrap=True)
list_item_15 = ListItem(List=construct_plane, Index=Slider(7, range=0..10), Wrap=True)
list_item_16 = ListItem(List=align_plane.Plane, Index=Slider(1, range=0..10), Wrap=True)
curve_middle_7 = CurveMiddle(Curve=list_item_14)
vector_2pt_5 = Vector2Pt(PointA=area.Centroid, PointB=curve_middle_5, Unitize=False)  # -> Vector, Length
list_item_17 = ListItem(List=align_plane_2.Plane, Index=Slider(1, range=0..10), Wrap=True)
vector_2pt_6 = Vector2Pt(PointA=area_2.Centroid, PointB=curve_middle_6, Unitize=False)  # -> Vector, Length
construct_plane_5 = ConstructPlane(Origin=curve_middle_5, XAxis=Vector(1, 0, 0), YAxis=Vector(0, 1, 0))
list_item_18 = ListItem(List=construct_plane_5, Index=Slider(2, range=0..10), Wrap=True)
orient_2 = Orient(Geometry=curve_4, Source=list_item_15, Target=list_item_18)  # -> Geometry, Transform
dispatch_4 = Dispatch(List=flatten(curve_middle_7), DispatchPattern=[True, False])  # -> ListA, ListB
construct_plane_6 = ConstructPlane(Origin=curve_middle_6, XAxis=Vector(1, 0, 0), YAxis=Vector(0, 1, 0))
align_plane_5 = AlignPlane(Plane=construct_plane_5, Direction=vector_2pt_5.Vector)  # -> Plane, Angle
explode_11 = Explode(Curve=orient_2.Geometry, Recursive=True)  # -> Segments, Vertices
vector_display_3 = VectorDisplay(Anchor=curve_middle_5, Vector=vector_2pt_5.Vector)
vector_display_4 = VectorDisplay(Anchor=curve_middle_6, Vector=vector_2pt_6.Vector)
list_item_19 = ListItem(List=explode_11.Segments, Index=Slider(1, range=0..10), Wrap=True)
align_plane_6 = AlignPlane(Plane=construct_plane_6, Direction=vector_2pt_6.Vector)  # -> Plane, Angle
line = Line(StartPoint=dispatch_4.ListA, EndPoint=dispatch_4.ListB)
list_item_20 = ListItem(List=align_plane_3.Plane, Index=Slider(1, range=0..10), Wrap=True)
curve_middle_8 = CurveMiddle(Curve=list_item_9)
curve_middle_9 = CurveMiddle(Curve=list_item_19)
list_item_21 = ListItem(List=align_plane_5.Plane, Index=Slider(2, range=0..10), Wrap=True)
curve_middle_10 = CurveMiddle(Curve=line)
orient_3 = Orient(Geometry=list_item_16, Source=list_item_16, Target=curve_middle_8)  # -> Geometry, Transform
orient_4 = Orient(Geometry=list_item_16, Source=list_item_16, Target=curve_middle_9)  # -> Geometry, Transform
xz_plane = XZPlane(Origin=curve_middle_10)
list_item_22 = ListItem(List=align_plane_4.Plane, Index=Slider(2, range=0..10), Wrap=True)
list_item_23 = ListItem(List=align_plane_4.Plane, Index=Slider(1, range=0..10), Wrap=True)
mirror = Mirror(Geometry=join_curves_3, Plane=xz_plane)  # -> Geometry, Transform
explode_12 = Explode(Curve=mirror.Geometry, Recursive=True)  # -> Segments, Vertices
list_item_24 = ListItem(List=explode_12.Segments, Index=Slider(3, range=0..10), Wrap=True)
curve_middle_11 = CurveMiddle(Curve=list_item_24)
orient_5 = Orient(Geometry=list_item_17, Source=list_item_17, Target=curve_middle_11)  # -> Geometry, Transform
pi = Pi(Factor=1)
pi_2 = Pi(Factor=1)
align_planes = AlignPlanes(Planes=orient_4.Geometry, Master=list_item_16)
align_planes_2 = AlignPlanes(Planes=orient_3.Geometry, Master=list_item_20)
list_item_25 = ListItem(List=align_plane_5.Plane, Index=Slider(2, range=0..10), Wrap=True)
list_item_26 = ListItem(List=align_plane_5.Plane, Index=Slider(2, range=0..10), Wrap=True)
deconstruct_plane = DeconstructPlane(Plane=list_item_22)  # -> Origin, XAxis, YAxis, ZAxis
pi_3 = Pi(Factor=1)
list_item_27 = ListItem(List=align_plane_6.Plane, Index=Slider(0, range=0..10), Wrap=True)
rotate_plane = RotatePlane(Plane=align_planes_2, Angle=pi)
rotate_plane_2 = RotatePlane(Plane=align_planes, Angle=pi_2)
construct_plane_7 = ConstructPlane(Origin=orient_5.Geometry, XAxis=deconstruct_plane.XAxis, YAxis=deconstruct_plane.YAxis)
rotate_plane_3 = RotatePlane(Plane=list_item_23, Angle=pi_3)
curve_10 = Curve(curve_9)
rotate_plane_4 = RotatePlane(Plane=construct_plane_7, Angle=pi_3)
orient_6 = Orient(Geometry=curve_6, Source=list_item_25, Target=rotate_plane)  # -> Geometry, Transform
orient_7 = Orient(Geometry=curve_6, Source=list_item_26, Target=rotate_plane_2)  # -> Geometry, Transform
orient_8 = Orient(Geometry=curve_10, Source=list_item_27, Target=rotate_plane_3)  # -> Geometry, Transform
orient_9 = Orient(Geometry=curve_9, Source=list_item_27, Target=rotate_plane_4)  # -> Geometry, Transform
explode_13 = Explode(Curve=orient_6.Geometry, Recursive=True)  # -> Segments, Vertices
explode_14 = Explode(Curve=orient_8.Geometry, Recursive=True)  # -> Segments, Vertices
panel_2 = Panel("""1
3""")
panel_3 = Panel("""1
3""")
list_item_28 = ListItem(List=explode_13.Segments, Index=panel_2, Wrap=True)
list_item_29 = ListItem(List=explode_14.Segments, Index=panel_3, Wrap=True)
curve_middle_12 = CurveMiddle(Curve=list_item_28)
curve_11 = Curve([orient_2.Geometry, curve_4])
curve_middle_13 = CurveMiddle(Curve=list_item_29)
curve_12 = Curve(curve_7)
curve_13 = Curve(curve_9)
area_3 = Area(Geometry=curve_11)  # -> Area, Centroid
area_4 = Area(Geometry=curve_12)  # -> Area, Centroid
dispatch_5 = Dispatch(List=flatten(curve_middle_12), DispatchPattern=[True, False])  # -> ListA, ListB
area_5 = Area(Geometry=curve_13)  # -> Area, Centroid
dispatch_6 = Dispatch(List=flatten(curve_middle_13), DispatchPattern=[True, False])  # -> ListA, ListB
dispatch_7 = Dispatch(List=flatten(area_3.Centroid), DispatchPattern=[True, False])  # -> ListA, ListB
join_curves_4 = JoinCurves(Curves=polar_array_3.Geometry, Preserve=False)
line_2 = Line(StartPoint=area_5.Centroid, EndPoint=area_4.Centroid)
line_3 = Line(StartPoint=dispatch_5.ListA, EndPoint=dispatch_5.ListB)
line_4 = Line(StartPoint=dispatch_6.ListA, EndPoint=dispatch_6.ListB)
merge = Merge(Data2=curve_4, Data3=curve_5, Data4=curve_6, Data5=orient_2.Geometry, Data6=orient_7.Geometry, Data7=orient_6.Geometry)
unit_z = UnitZ(Factor=1)
line_5 = Line(StartPoint=dispatch_7.ListA, EndPoint=dispatch_7.ListB)
merge_2 = Merge(
    Data1=orient_9.Geometry,
    Data2=mirror.Geometry,
    Data3=curve_7,
    Data4=join_curves_4,
    Data5=curve_9,
    Data6=orient_8.Geometry)
curve_middle_14 = CurveMiddle(Curve=line_3)
curve_middle_15 = CurveMiddle(Curve=line_2)
unit_z_2 = UnitZ(Factor=1)
curve_middle_16 = CurveMiddle(Curve=line_4)
pi_4 = Pi(Factor=1)
curve_middle_17 = CurveMiddle(Curve=line_5)
list_item_30 = ListItem(List=flatten(merge_2), Index=Slider(4, range=0..10), Wrap=True)
pi_5 = Pi(Factor=1)
construct_plane_8 = ConstructPlane(Origin=curve_middle_14, XAxis=line_3, YAxis=Vector(0, 1, 0))
construct_plane_9 = ConstructPlane(Origin=curve_middle_16, XAxis=line_4, YAxis=Vector(0, 1, 0))
curve_14 = Curve(list_item_30)
rotate_3d = Rotate3D(Geometry=flatten(line_5), Angle=pi_4, Center=curve_middle_14, Axis=unit_z)  # -> Geometry, Transform
rotate_3d_2 = Rotate3D(Geometry=flatten(merge), Angle=pi_4, Center=curve_middle_14, Axis=unit_z)  # -> Geometry, Transform
rotate_3d_3 = Rotate3D(Geometry=flatten(merge_2), Angle=pi_5, Center=curve_middle_16, Axis=unit_z_2)  # -> Geometry, Transform
list_item_31 = ListItem(List=flatten(rotate_3d_3.Geometry), Index=["0", "2"], Wrap=True)
dispatch_8 = Dispatch(List=list_item_31, DispatchPattern=[True, False])  # -> ListA, ListB
curve_closest_point = CurveClosestPoint(Point=curve_middle_17, Curve=rotate_3d.Geometry)  # -> Point, Parameter, Distance
merge_3 = Merge(Data1=merge, Data2=rotate_3d_2.Geometry)
area_6 = Area(Geometry=dispatch_8.ListA)  # -> Area, Centroid
area_7 = Area(Geometry=dispatch_8.ListB)  # -> Area, Centroid
unit_x = UnitX(Factor=curve_closest_point.Distance)
series = Series(Start=0, Step="2", Count=Slider(5, range=0..10))
line_6 = Line(StartPoint=area_6.Centroid, EndPoint=area_7.Centroid)
curve_middle_18 = CurveMiddle(Curve=line_6)
yz_plane = YZPlane(Origin=curve_middle_18)
mirror_2 = Mirror(Geometry=curve_14, Plane=yz_plane)  # -> Geometry, Transform
merge_4 = Merge(Data1=merge_2, Data2=rotate_3d_3.Geometry, Data3=mirror_2.Geometry)
curve_closest_point_2 = CurveClosestPoint(Point=curve_middle_15, Curve=line_6)  # -> Point, Parameter, Distance
unit_x_2 = UnitX(Factor=curve_closest_point_2.Distance)
series_2 = Series(Start=0, Step="2", Count=Slider(5, range=0..10))
multiplication = Multiplication(A=unit_x, B=series)
multiplication_2 = Multiplication(A=unit_x_2, B=series_2)
move = Move(Geometry=graft(merge_3), Motion=multiplication)  # -> Geometry, Transform
move_2 = Move(Geometry=graft(merge_4), Motion=multiplication_2)  # -> Geometry, Transform
list_item_32 = ListItem(List=flatten(move_2.Geometry), Index=Slider(11, range=0..100), Wrap=True)
list_item_33 = ListItem(List=flatten(move_2.Geometry), Index=Slider(43, range=0..100), Wrap=True)
explode_15 = Explode(Curve=list_item_32, Recursive=True)  # -> Segments, Vertices
explode_16 = Explode(Curve=list_item_33, Recursive=True)  # -> Segments, Vertices
region_union = RegionUnion(Curves=flatten(move.Geometry))
list_item_34 = ListItem(List=explode_15.Segments, Index=Slider(4, range=0..10), Wrap=True)
list_item_35 = ListItem(List=explode_16.Segments, Index=Slider(4, range=0..10), Wrap=True)
curve_middle_19 = CurveMiddle(Curve=list_item_34)
curve_middle_20 = CurveMiddle(Curve=list_item_35)
construct_plane_10 = ConstructPlane(Origin=curve_middle_19, XAxis=Vector(1, 0, 0), YAxis=Vector(0, 1, 0))
construct_plane_11 = ConstructPlane(Origin=curve_middle_20, XAxis=Vector(1, 0, 0), YAxis=Vector(0, 1, 0))
pi_6 = Pi(Factor=1)
list_item_36 = ListItem(List=construct_plane_2, Index=Slider(7, range=0..10), Wrap=True)
curve_15 = Curve(curve_7)
list_item_37 = ListItem(List=construct_plane_2, Index=number_slider_2, Wrap=True)
curve_16 = Curve(curve_7)
rotate_plane_5 = RotatePlane(Plane=construct_plane_10, Angle=pi_6)
rotate_plane_6 = RotatePlane(Plane=construct_plane_11, Angle=pi_6)
orient_10 = Orient(Geometry=curve_15, Source=list_item_36, Target=rotate_plane_6)  # -> Geometry, Transform
orient_11 = Orient(Geometry=curve_16, Source=list_item_37, Target=rotate_plane_5)  # -> Geometry, Transform
region_union_2 = RegionUnion(Curves=flatten([move_2.Geometry, orient_11.Geometry, orient_10.Geometry]))
