# Grasshopper definition Wolfram_Intro_006_Animation.gh (Grasshopper 1.0.7)
# plug-ins: Kangaroo2 Components

# great
# rhombicosidodecahedron
# ANIMATION
construct_point = ConstructPoint(XCoordinate=0, YCoordinate=0, ZCoordinate=0)

trigger = Trigger(Interval=20, TimerInterval=20, Target=data_recorder)
data_recorder = DataRecorder("1", DataLimit=10000, RecordData=False)
list_length = ListLength(List=data_recorder)
division = Division(A=list_length, B=Slider(59.9, range=0..100))
sine = Sine(Value=division)
absolute = Absolute(Value=sine)
multiplication = Multiplication(A=Slider(0.22, range=0..1), B=absolute)
panel = Panel(multiplication)

trigger_2 = Trigger(Interval=20, TimerInterval=20, Target=data_recorder_2)
data_recorder_2 = DataRecorder("1", DataLimit=10000, RecordData=True)
list_length_2 = ListLength(List=data_recorder_2)
division_2 = Division(A=list_length_2, B=Slider(59.9, range=0..100))
cosine = Cosine(Value=division_2)
absolute_2 = Absolute(Value=cosine)
multiplication_2 = Multiplication(A=Slider(0.22, range=0..1), B=absolute_2)
panel_2 = Panel(multiplication_2)

polygon = Polygon(Plane=construct_point, Radius=Slider(1, range=0..1), Segments="10", FilletRadius=0)  # -> Polygon, Length
number_slider = Slider(2, range=0..10)
explode = Explode(Curve=polygon.Polygon, Recursive=True)  # -> Segments, Vertices
curve_middle = CurveMiddle(Curve=explode.Segments)
list_item = ListItem(List=explode.Segments, Index=number_slider, Wrap=True)
vector_2pt = Vector2Pt(PointA=construct_point, PointB=curve_middle, Unitize=False)  # -> Vector, Length
length = Length(Curve=list_item)
end_points = EndPoints(Curve=list_item)  # -> Start, End
curve_middle_2 = CurveMiddle(Curve=list_item)
construct_plane = ConstructPlane(Origin=curve_middle, XAxis=Vector(1, 0, 0), YAxis=Vector(0, 1, 0))
number_slider_2 = Slider(0.0684, range=0..2)
circle = Circle(Plane=end_points.Start, Radius=length)
circle_2 = Circle(Plane=end_points.End, Radius=length)
align_plane = AlignPlane(Plane=construct_plane, Direction=vector_2pt.Vector)  # -> Plane, Angle
curve_curve = CurveCurve(CurveA=circle, CurveB=circle_2)  # -> Points, ParamsA, ParamsB
pi = Pi(Factor=number_slider_2)
dispatch = Dispatch(List=flatten(curve_curve.Points), DispatchPattern=[True, False])  # -> ListA, ListB
negative = Negative(Value=pi)
point = Point(dispatch.ListA)
polar_array = PolarArray(Geometry=list_item, Plane=point, Count="6", Angle=6.283185307)  # -> Geometry, Transform
rotate_3d = Rotate3D(Geometry=polar_array.Geometry, Angle=negative, Center=curve_middle_2, Axis=list_item)  # -> Geometry, Transform
boundary_surfaces = BoundarySurfaces(Edges=rotate_3d.Geometry)
join_curves = JoinCurves(Curves=rotate_3d.Geometry, Preserve=False)
curve_middle_3 = CurveMiddle(Curve=rotate_3d.Geometry)
area = Area(Geometry=boundary_surfaces)  # -> Area, Centroid
vector_2pt_2 = Vector2Pt(PointA=area.Centroid, PointB=curve_middle_3, Unitize=False)  # -> Vector, Length
construct_plane_2 = ConstructPlane(Origin=curve_middle_3, XAxis=Vector(1, 0, 0), YAxis=vector_2pt_2.Vector)
vector_display = VectorDisplay(Anchor=curve_middle_3, Vector=vector_2pt_2.Vector)
align_plane_2 = AlignPlane(Plane=construct_plane_2, Direction=vector_2pt_2.Vector)  # -> Plane, Angle
list_item_2 = ListItem(List=rotate_3d.Geometry, Index=Slider(3, range=0..10), Wrap=True)
list_item_3 = ListItem(List=align_plane_2.Plane, Index=Slider(3, range=0..10), Wrap=True)
curve_middle_4 = CurveMiddle(Curve=list_item_2)
end_points_2 = EndPoints(Curve=list_item_2)  # -> Start, End
rectangle = Rectangle(Plane=list_item_3, XSize=length, YSize=length, Radius=0)  # -> Rectangle, Length
orient = Orient(Geometry=rectangle.Rectangle, Source=end_points_2.Start, Target=curve_middle_4)  # -> Geometry, Transform
rotate_3d_2 = Rotate3D(Geometry=orient.Geometry, Angle=pi, Center=curve_middle_4, Axis=list_item_2)  # -> Geometry, Transform
md_slider = MDSlider(SliderMode=0, slider_value=Point(0.5, 0.5, 0.5), x_domain=Domain(0, 1), y_domain=Domain(0, 1), z_domain=Domain(0, 1))
boundary_surfaces_2 = BoundarySurfaces(Edges=rotate_3d_2.Geometry)
evaluate_surface = EvaluateSurface(Surface=reparameterize(boundary_surfaces_2), Point=md_slider)  # -> Point, Normal, UDirection, VDirection, Frame
area_2 = Area(Geometry=rotate_3d_2.Geometry)  # -> Area, Centroid
explode_2 = Explode(Curve=rotate_3d_2.Geometry, Recursive=True)  # -> Segments, Vertices
panel_3 = Panel("""0
2""")
construct_plane_3 = ConstructPlane(Origin=evaluate_surface.Point, XAxis=Vector(1, 0, 0), YAxis=evaluate_surface.Normal)
curve_middle_5 = CurveMiddle(Curve=explode_2.Segments)
list_item_4 = ListItem(List=explode_2.Segments, Index=panel_3, Wrap=True)
vector_2pt_3 = Vector2Pt(PointA=area_2.Centroid, PointB=curve_middle_5, Unitize=False)  # -> Vector, Length
curve_middle_6 = CurveMiddle(Curve=list_item_4)
dispatch_2 = Dispatch(List=flatten(curve_middle_6), DispatchPattern=[True, False])  # -> ListA, ListB
construct_plane_4 = ConstructPlane(Origin=curve_middle_5, XAxis=Vector(1, 0, 0), YAxis=Vector(0, 1, 0))
deconstruct_plane = DeconstructPlane(Plane=construct_plane_4)  # -> Origin, XAxis, YAxis, ZAxis
vector_display_2 = VectorDisplay(Anchor=curve_middle_5, Vector=vector_2pt_3.Vector)
line = Line(StartPoint=dispatch_2.ListA, EndPoint=dispatch_2.ListB)
construct_plane_5 = ConstructPlane(Origin=deconstruct_plane.Origin, XAxis=Vector(1, 0, 0), YAxis=vector_2pt_3.Vector)
curve_middle_7 = CurveMiddle(Curve=line)
align_plane_3 = AlignPlane(Plane=construct_plane_5, Direction=vector_2pt_3.Vector)  # -> Plane, Angle
list_item_5 = ListItem(List=align_plane.Plane, Index=Slider(2, range=0..10), Wrap=True)
pi_2 = Pi(Factor="1.5")
list_item_6 = ListItem(List=align_plane_3.Plane, Index=Slider(1, range=0..10), Wrap=True)
negative_2 = Negative(Value=pi)

curve = Curve(polygon.Polygon)
curve_2 = Curve(join_curves)
curve_3 = Curve(rotate_3d_2.Geometry)

mirror = Mirror(Geometry=curve_2, Plane=construct_plane_3)  # -> Geometry, Transform
boundary_surfaces_3 = BoundarySurfaces(Edges=mirror.Geometry)
explode_3 = Explode(Curve=mirror.Geometry, Recursive=True)  # -> Segments, Vertices
area_3 = Area(Geometry=boundary_surfaces_3)  # -> Area, Centroid
list_item_7 = ListItem(List=explode_3.Segments, Index=Slider(3, range=0..10), Wrap=True)
curve_middle_8 = CurveMiddle(Curve=list_item_7)
vector_2pt_4 = Vector2Pt(PointA=area_3.Centroid, PointB=curve_middle_8, Unitize=False)  # -> Vector, Length
orient_2 = Orient(Geometry=list_item_5, Source=list_item_5, Target=curve_middle_8)  # -> Geometry, Transform
vector_display_3 = VectorDisplay(Anchor=area_3.Centroid, Vector=vector_2pt_4.Vector)
construct_plane_6 = ConstructPlane(Origin=orient_2.Geometry, XAxis=list_item_7, YAxis=vector_2pt_4.Vector)
rotate_plane = RotatePlane(Plane=construct_plane_6, Angle=pi_2)
orient_3 = Orient(Geometry=curve_3, Source=list_item_6, Target=rotate_plane)  # -> Geometry, Transform
rotate_3d_3 = Rotate3D(Geometry=orient_3.Geometry, Angle=negative_2, Center=construct_plane_6, Axis=list_item_7)  # -> Geometry, Transform

curve_4 = Curve(mirror.Geometry)
curve_5 = Curve(rotate_3d_3.Geometry)

md_slider_2 = MDSlider(SliderMode=0, slider_value=Point(0.5, 0.5, 0.5), x_domain=Domain(0, 1), y_domain=Domain(0, 1), z_domain=Domain(0, 1))
explode_4 = Explode(Curve=curve_2, Recursive=True)  # -> Segments, Vertices
list_item_8 = ListItem(List=align_plane_2.Plane, Index=Slider(1, range=0..10), Wrap=True)
list_item_9 = ListItem(List=align_plane_3.Plane, Index=Slider(3, range=0..10), Wrap=True)
explode_5 = Explode(Curve=curve_2, Recursive=True)  # -> Segments, Vertices
pi_3 = Pi(Factor=Slider(1.5, range=0..1.5))
rotate_plane_2 = RotatePlane(Plane=list_item_8, Angle=pi_2)
list_item_10 = ListItem(List=explode_4.Segments, Index=Slider(3, range=0..10), Wrap=True)
curve_6 = Curve(curve_3)
rotate_plane_3 = RotatePlane(Plane=rotate_plane_2, Angle=pi_3)
list_item_11 = ListItem(List=explode_5.Segments, Index=Slider(3, range=0..3), Wrap=True)
orient_4 = Orient(Geometry=curve_6, Source=list_item_9, Target=rotate_plane_3)  # -> Geometry, Transform
negative_3 = Negative(Value=negative_2)
curve_middle_9 = CurveMiddle(Curve=list_item_11)
curve_7 = Curve(curve_3)
curve_8 = Curve(curve)
rotate_3d_4 = Rotate3D(Geometry=orient_4.Geometry, Angle=negative_3, Center=rotate_plane_2, Axis=list_item_10)  # -> Geometry, Transform
curve_9 = Curve(rotate_3d_4.Geometry)
boundary_surfaces_4 = BoundarySurfaces(Edges=curve_9)
explode_6 = Explode(Curve=curve_9, Recursive=True)  # -> Segments, Vertices
area_4 = Area(Geometry=boundary_surfaces_4)  # -> Area, Centroid
curve_middle_10 = CurveMiddle(Curve=explode_6.Segments)
evaluate_surface_2 = EvaluateSurface(Surface=boundary_surfaces_4, Point=md_slider_2)  # -> Point, Normal, UDirection, VDirection, Frame
vector_2pt_5 = Vector2Pt(PointA=area_4.Centroid, PointB=curve_middle_10, Unitize=False)  # -> Vector, Length
construct_plane_7 = ConstructPlane(Origin=curve_middle_10, XAxis=vector_2pt_5.Vector, YAxis=Vector(0, 1, 0))
merge = Merge(Data1=curve, Data2=curve_2, Data3=curve_3, Data4=curve_4, Data5=curve_5)
construct_plane_8 = ConstructPlane(Origin=curve_middle_9, XAxis=list_item_11, YAxis=Vector(0, 1, 0))
addition = Addition(A="1", B=number_slider_2)
list_item_12 = ListItem(List=construct_plane_7, Index=Slider(1, range=0..10), Wrap=True)
orient_5 = Orient(Geometry=merge, Source=construct_plane_8, Target=list_item_12)  # -> Geometry, Transform
pi_4 = Pi(Factor=".5")
list_item_13 = ListItem(List=explode_6.Segments, Index=Slider(1, range=0..1), Wrap=True)
pi_5 = Pi(Factor=addition)
curve_middle_11 = CurveMiddle(Curve=list_item_13)
explode_7 = Explode(Curve=orient_4.Geometry, Recursive=True)  # -> Segments, Vertices
rotate_3d_5 = Rotate3D(Geometry=orient_5.Geometry, Angle=pi_4, Center=list_item_12, Axis=evaluate_surface_2.Normal)  # -> Geometry, Transform
curve_10 = Curve(curve_8)
curve_11 = Curve(curve_7)
panel_4 = Panel("""1
3""")
area_5 = Area(Geometry=curve_11)  # -> Area, Centroid
area_6 = Area(Geometry=curve_10)  # -> Area, Centroid
list_item_14 = ListItem(List=explode_7.Segments, Index=panel_4, Wrap=True)
rotate_3d_6 = Rotate3D(Geometry=rotate_3d_5.Geometry, Angle=pi_5, Center=curve_middle_11, Axis=list_item_13)  # -> Geometry, Transform
curve_middle_12 = CurveMiddle(Curve=list_item_14)
line_2 = Line(StartPoint=area_5.Centroid, EndPoint=area_6.Centroid)
join_curves_2 = JoinCurves(Curves=rotate_3d.Geometry, Preserve=False)
dispatch_3 = Dispatch(List=flatten(curve_middle_12), DispatchPattern=[True, False])  # -> ListA, ListB
merge_2 = Merge(Data1=orient_3.Geometry, Data2=mirror.Geometry, Data3=curve, Data4=join_curves_2, Data5=curve_3, Data6=orient_4.Geometry)
list_item_15 = ListItem(List=flatten(rotate_3d_6.Geometry), Index=Slider(7, range=0..10), Wrap=True)
curve_middle_13 = CurveMiddle(Curve=line_2)
curve_12 = Curve(rotate_3d_6.Geometry)
md_slider_3 = MDSlider(SliderMode=0, slider_value=Point(0.5, 0.5, 0.5), x_domain=Domain(0, 1), y_domain=Domain(0, 1), z_domain=Domain(0, 1))
boundary_surfaces_5 = BoundarySurfaces(Edges=list_item_15)
line_3 = Line(StartPoint=dispatch_3.ListA, EndPoint=dispatch_3.ListB)
evaluate_surface_3 = EvaluateSurface(Surface=boundary_surfaces_5, Point=md_slider_3)  # -> Point, Normal, UDirection, VDirection, Frame
unit_z = UnitZ(Factor=1)
curve_middle_14 = CurveMiddle(Curve=line_3)
pi_6 = Pi(Factor=1)
geometry = Geometry([curve_9, curve, curve_2, curve_3, curve_4, curve_5])
rotate_3d_7 = Rotate3D(Geometry=flatten(merge_2), Angle=pi_6, Center=curve_middle_14, Axis=unit_z)  # -> Geometry, Transform
list_item_16 = ListItem(List=flatten(geometry), Index=Slider(2, range=0..10), Wrap=True)
list_item_17 = ListItem(List=flatten(merge_2), Index=Slider(4, range=0..10), Wrap=True)
md_slider_4 = MDSlider(SliderMode=0, slider_value=Point(0.5, 0.5, 0.5), x_domain=Domain(0, 1), y_domain=Domain(0, 1), z_domain=Domain(0, 1))
boundary_surfaces_6 = BoundarySurfaces(Edges=list_item_16)
curve_13 = Curve(list_item_17)
list_item_18 = ListItem(List=flatten(rotate_3d_6.Geometry), Index=["0", "3"], Wrap=True)
explode_8 = Explode(Curve=list_item_16, Recursive=True)  # -> Segments, Vertices
multipipe = MultiPipe(NodeSize=Slider(0.04, range=0..1), EndOffset=1, StrutSize=1, Segment=0, KinkAngle=0.6, CubeFit=0, Caps=0)  # disabled
area_7 = Area(Geometry=boundary_surfaces_6)  # -> Area, Centroid
dispatch_4 = Dispatch(List=list_item_18, DispatchPattern=[True, False])  # -> ListA, ListB
curve_middle_15 = CurveMiddle(Curve=explode_8.Segments)
area_8 = Area(Geometry=dispatch_4.ListB)  # -> Area, Centroid
area_9 = Area(Geometry=dispatch_4.ListA)  # -> Area, Centroid
vector_2pt_6 = Vector2Pt(PointA=area_7.Centroid, PointB=curve_middle_15, Unitize=False)  # -> Vector, Length
number_slider_3 = Slider(3, range=0..3)
line_4 = Line(StartPoint=area_9.Centroid, EndPoint=area_8.Centroid)
curve_14 = Curve(curve_9)
construct_plane_9 = ConstructPlane(Origin=curve_middle_15, XAxis=vector_2pt_6.Vector, YAxis=Vector(0, 1, 0))
curve_middle_16 = CurveMiddle(Curve=line_4)
list_item_19 = ListItem(List=construct_plane_9, Index=Slider(5, range=0..6), Wrap=True)
construct_plane_10 = ConstructPlane(Origin=curve_middle_16, XAxis=evaluate_surface_3.Normal, YAxis=line_4)
mirror_2 = Mirror(Geometry=curve_14, Plane=construct_plane_10)  # -> Geometry, Transform
curve_15 = Curve(mirror_2.Geometry)
geometry_2 = Geometry([curve_12, curve_15])
list_item_20 = ListItem(List=flatten(geometry_2), Index=Slider(6, range=0..10), Wrap=True)
boundary_surfaces_7 = BoundarySurfaces(Edges=list_item_20)
area_10 = Area(Geometry=boundary_surfaces_7)  # -> Area, Centroid
explode_9 = Explode(Curve=list_item_20, Recursive=True)  # -> Segments, Vertices
evaluate_surface_4 = EvaluateSurface(Surface=reparameterize(boundary_surfaces_7), Point=md_slider_4)  # -> Point, Normal, UDirection, VDirection, Frame
curve_middle_17 = CurveMiddle(Curve=explode_9.Segments)
vector_2pt_7 = Vector2Pt(PointA=area_10.Centroid, PointB=curve_middle_17, Unitize=False)  # -> Vector, Length
construct_plane_11 = ConstructPlane(Origin=curve_middle_17, XAxis=vector_2pt_7.Vector, YAxis=Vector(0, 1, 0))
list_item_21 = ListItem(List=explode_9.Segments, Index=number_slider_3, Wrap=True)
list_item_22 = ListItem(List=construct_plane_11, Index=number_slider_3, Wrap=True)
end_points_3 = EndPoints(Curve=list_item_21)  # -> Start, End
curve_middle_18 = CurveMiddle(Curve=list_item_21)
deconstruct_plane_2 = DeconstructPlane(Plane=evaluate_surface_4.Frame)  # -> Origin, XAxis, YAxis, ZAxis
vector_2pt_8 = Vector2Pt(PointA=end_points_3.Start, PointB=end_points_3.End, Unitize=False)  # -> Vector, Length
construct_plane_12 = ConstructPlane(Origin=curve_middle_18, XAxis=deconstruct_plane_2.XAxis, YAxis=vector_2pt_8.Vector)
pi_7 = Pi(Factor=Slider(0.15, range=0..1.99))
orient_6 = Orient(Geometry=geometry, Source=list_item_19, Target=construct_plane_12)  # -> Geometry, Transform
rotate_3d_8 = Rotate3D(Geometry=orient_6.Geometry, Angle=pi_7, Center=construct_plane_12, Axis=list_item_21)  # -> Geometry, Transform
curve_closest_point = CurveClosestPoint(Point=curve_middle_13, Curve=line_4)  # -> Point, Parameter, Distance
merge_3 = Merge(Data1=merge_2, Data2=rotate_3d_7.Geometry, Data3=mirror_2.Geometry)
unit_x = UnitX(Factor=curve_closest_point.Distance)
series = Series(Start=0, Step="2", Count=Slider(5, range=0..10))
multiplication_3 = Multiplication(A=unit_x, B=series)
move = Move(Geometry=graft(merge_3), Motion=multiplication_3)  # -> Geometry, Transform
list_item_23 = ListItem(List=flatten(move.Geometry), Index=Slider(11, range=0..100), Wrap=True)
list_item_24 = ListItem(List=flatten(move.Geometry), Index=Slider(43, range=0..100), Wrap=True)
explode_10 = Explode(Curve=list_item_23, Recursive=True)  # -> Segments, Vertices
explode_11 = Explode(Curve=list_item_24, Recursive=True)  # -> Segments, Vertices
list_item_25 = ListItem(List=explode_10.Segments, Index=Slider(4, range=0..10), Wrap=True)
list_item_26 = ListItem(List=explode_11.Segments, Index=Slider(4, range=0..10), Wrap=True)
curve_middle_19 = CurveMiddle(Curve=list_item_25)
curve_middle_20 = CurveMiddle(Curve=list_item_26)
construct_plane_13 = ConstructPlane(Origin=curve_middle_19, XAxis=Vector(1, 0, 0), YAxis=Vector(0, 1, 0))
construct_plane_14 = ConstructPlane(Origin=curve_middle_20, XAxis=Vector(1, 0, 0), YAxis=Vector(0, 1, 0))
pi_8 = Pi(Factor=1)
list_item_27 = ListItem(List=construct_plane, Index=Slider(7, range=0..10), Wrap=True)
curve_16 = Curve(curve)
list_item_28 = ListItem(List=construct_plane, Index=number_slider, Wrap=True)
curve_17 = Curve(curve)
rotate_plane_4 = RotatePlane(Plane=construct_plane_13, Angle=pi_8)
rotate_plane_5 = RotatePlane(Plane=construct_plane_14, Angle=pi_8)
orient_7 = Orient(Geometry=curve_16, Source=list_item_27, Target=rotate_plane_5)  # -> Geometry, Transform
orient_8 = Orient(Geometry=curve_17, Source=list_item_28, Target=rotate_plane_4)  # -> Geometry, Transform
region_union = RegionUnion(Curves=flatten([move.Geometry, orient_8.Geometry, orient_7.Geometry]))
