# Grasshopper definition Wolfram_Intro_006_LIVE.gh (Grasshopper 1.0.7)

# great
# rhombicosidodecahedron
construct_point = ConstructPoint(XCoordinate=0, YCoordinate=0, ZCoordinate=0)
polygon = Polygon(Plane=construct_point, Radius=Slider(1, range=0..1), Segments="10", FilletRadius=0)  # -> Polygon, Length
explode = Explode(Curve=polygon.Polygon, Recursive=True)  # -> Segments, Vertices
curve_middle = CurveMiddle(Curve=explode.Segments)
vector_2pt = Vector2Pt(PointA=construct_point, PointB=curve_middle, Unitize=False)  # -> Vector, Length
construct_plane = ConstructPlane(Origin=curve_middle, XAxis=Vector(1, 0, 0), YAxis=Vector(0, 1, 0))
vector_display = VectorDisplay(Anchor=construct_point, Vector=vector_2pt.Vector)
align_plane = AlignPlane(Plane=construct_plane, Direction=vector_2pt.Vector)  # -> Plane, Angle
list_item = ListItem(List=explode.Segments, Index=Slider(2, range=0..10), Wrap=True)
length = Length(Curve=list_item)
end_points = EndPoints(Curve=list_item)  # -> Start, End
panel = Panel(length)
circle = Circle(Plane=end_points.End, Radius=length)
circle_2 = Circle(Plane=end_points.Start, Radius=length)
curve_curve = CurveCurve(CurveA=circle_2, CurveB=circle)  # -> Points, ParamsA, ParamsB
dispatch = Dispatch(List=flatten(curve_curve.Points), DispatchPattern=[True, False])  # -> ListA, ListB
point = Point(dispatch.ListA)
polar_array = PolarArray(Geometry=list_item, Plane=point, Count=Slider(6, range=0..10), Angle=6.283185307)  # -> Geometry, Transform
join_curves = JoinCurves(Curves=polar_array.Geometry, Preserve=False)
curve_middle_2 = CurveMiddle(Curve=polar_array.Geometry)
vector_2pt_2 = Vector2Pt(PointA=point, PointB=curve_middle_2, Unitize=False)  # -> Vector, Length
construct_plane_2 = ConstructPlane(Origin=curve_middle_2, XAxis=Vector(1, 0, 0), YAxis=Vector(0, 1, 0))
vector_display_2 = VectorDisplay(Anchor=point, Vector=vector_2pt_2.Vector)
list_item_2 = ListItem(List=polar_array.Geometry, Index=Slider(3, range=0..10), Wrap=True)
align_plane_2 = AlignPlane(Plane=construct_plane_2, Direction=vector_2pt_2.Vector)  # -> Plane, Angle
end_points_2 = EndPoints(Curve=list_item_2)  # -> Start, End
rectangle = Rectangle(Plane=end_points_2.Start, XSize=length, YSize=length, Radius=0)  # -> Rectangle, Length

curve = Curve(polygon.Polygon)
curve_2 = Curve(join_curves)
curve_3 = Curve(rectangle.Rectangle)

area = Area(Geometry=rectangle.Rectangle)  # -> Area, Centroid
explode_2 = Explode(Curve=rectangle.Rectangle, Recursive=True)  # -> Segments, Vertices
panel_2 = Panel("""1
3""")
list_item_3 = ListItem(List=explode_2.Segments, Index=panel_2, Wrap=True)
curve_middle_3 = CurveMiddle(Curve=explode_2.Segments)
curve_middle_4 = CurveMiddle(Curve=list_item_3)
vector_2pt_3 = Vector2Pt(PointA=area.Centroid, PointB=curve_middle_3, Unitize=False)  # -> Vector, Length
dispatch_2 = Dispatch(List=flatten(curve_middle_4), DispatchPattern=[True, False])  # -> ListA, ListB
construct_plane_3 = ConstructPlane(Origin=curve_middle_3, XAxis=Vector(1, 0, 0), YAxis=Vector(0, 1, 0))
align_plane_3 = AlignPlane(Plane=construct_plane_3, Direction=vector_2pt_3.Vector)  # -> Plane, Angle
vector_display_3 = VectorDisplay(Anchor=area.Centroid, Vector=vector_2pt_3.Vector)
line = Line(StartPoint=dispatch_2.ListA, EndPoint=dispatch_2.ListB)
curve_middle_5 = CurveMiddle(Curve=line)
xz_plane = XZPlane(Origin=curve_middle_5)
mirror = Mirror(Geometry=join_curves, Plane=xz_plane)  # -> Geometry, Transform
list_item_4 = ListItem(List=align_plane.Plane, Index=Slider(1, range=0..10), Wrap=True)
explode_3 = Explode(Curve=mirror.Geometry, Recursive=True)  # -> Segments, Vertices
list_item_5 = ListItem(List=explode_3.Segments, Index=Slider(3, range=0..6), Wrap=True)
curve_middle_6 = CurveMiddle(Curve=list_item_5)
orient = Orient(Geometry=list_item_4, Source=list_item_4, Target=curve_middle_6)  # -> Geometry, Transform
list_item_6 = ListItem(List=align_plane_2.Plane, Index=Slider(2, range=0..2), Wrap=True)
deconstruct_plane = DeconstructPlane(Plane=list_item_6)  # -> Origin, XAxis, YAxis, ZAxis
list_item_7 = ListItem(List=align_plane_3.Plane, Index=Slider(0, range=0..10), Wrap=True)
pi = Pi(Factor=1)
construct_plane_4 = ConstructPlane(Origin=orient.Geometry, XAxis=deconstruct_plane.XAxis, YAxis=deconstruct_plane.YAxis)
rotate_plane = RotatePlane(Plane=construct_plane_4, Angle=pi)
orient_2 = Orient(Geometry=curve_3, Source=list_item_7, Target=rotate_plane)  # -> Geometry, Transform
panel_3 = Panel("""1
3""")
unit_z = UnitZ(Factor=1)
pi_2 = Pi(Factor=1)
series = Series(Start=0, Step="2", Count=Slider(5, range=0..10))
pi_3 = Pi(Factor=1)

negative = Negative(Value=Slider(9, range=0..100))
construct_point_2 = ConstructPoint(XCoordinate=0, YCoordinate=negative, ZCoordinate=0)
polygon_2 = Polygon(Plane=construct_point_2, Radius=Slider(1, range=0..1), Segments="10", FilletRadius=0)  # -> Polygon, Length
explode_4 = Explode(Curve=polygon_2.Polygon, Recursive=True)  # -> Segments, Vertices
curve_middle_7 = CurveMiddle(Curve=explode_4.Segments)
vector_2pt_4 = Vector2Pt(PointA=construct_point_2, PointB=curve_middle_7, Unitize=False)  # -> Vector, Length
number_slider = Slider(2, range=0..10)
construct_plane_5 = ConstructPlane(Origin=curve_middle_7, XAxis=Vector(1, 0, 0), YAxis=Vector(0, 1, 0))
list_item_8 = ListItem(List=explode_4.Segments, Index=number_slider, Wrap=True)
align_plane_4 = AlignPlane(Plane=construct_plane_5, Direction=vector_2pt_4.Vector)  # -> Plane, Angle
length_2 = Length(Curve=list_item_8)
end_points_3 = EndPoints(Curve=list_item_8)  # -> Start, End
circle_3 = Circle(Plane=end_points_3.Start, Radius=length_2)
circle_4 = Circle(Plane=end_points_3.End, Radius=length_2)
curve_curve_2 = CurveCurve(CurveA=circle_3, CurveB=circle_4)  # -> Points, ParamsA, ParamsB
dispatch_3 = Dispatch(List=flatten(curve_curve_2.Points), DispatchPattern=[True, False])  # -> ListA, ListB
point_2 = Point(dispatch_3.ListA)
polar_array_2 = PolarArray(Geometry=list_item_8, Plane=point_2, Count="6", Angle=6.283185307)  # -> Geometry, Transform
join_curves_2 = JoinCurves(Curves=polar_array_2.Geometry, Preserve=False)
curve_middle_8 = CurveMiddle(Curve=polar_array_2.Geometry)
vector_2pt_5 = Vector2Pt(PointA=point_2, PointB=curve_middle_8, Unitize=False)  # -> Vector, Length
construct_plane_6 = ConstructPlane(Origin=curve_middle_8, XAxis=Vector(1, 0, 0), YAxis=Vector(0, 1, 0))
vector_display_4 = VectorDisplay(Anchor=curve_middle_8, Vector=vector_2pt_5.Vector)
list_item_9 = ListItem(List=polar_array_2.Geometry, Index=Slider(3, range=0..10), Wrap=True)
align_plane_5 = AlignPlane(Plane=construct_plane_6, Direction=vector_2pt_5.Vector)  # -> Plane, Angle
end_points_4 = EndPoints(Curve=list_item_9)  # -> Start, End
rectangle_2 = Rectangle(Plane=end_points_4.Start, XSize=length_2, YSize=length_2, Radius=0)  # -> Rectangle, Length
area_2 = Area(Geometry=rectangle_2.Rectangle)  # -> Area, Centroid
explode_5 = Explode(Curve=rectangle_2.Rectangle, Recursive=True)  # -> Segments, Vertices
panel_4 = Panel("""1
3""")
curve_middle_9 = CurveMiddle(Curve=explode_5.Segments)
list_item_10 = ListItem(List=explode_5.Segments, Index=panel_4, Wrap=True)
curve_middle_10 = CurveMiddle(Curve=list_item_10)
vector_2pt_6 = Vector2Pt(PointA=area_2.Centroid, PointB=curve_middle_9, Unitize=False)  # -> Vector, Length
dispatch_4 = Dispatch(List=flatten(curve_middle_10), DispatchPattern=[True, False])  # -> ListA, ListB
construct_plane_7 = ConstructPlane(Origin=curve_middle_9, XAxis=Vector(1, 0, 0), YAxis=Vector(0, 1, 0))
vector_display_5 = VectorDisplay(Anchor=curve_middle_9, Vector=vector_2pt_6.Vector)
line_2 = Line(StartPoint=dispatch_4.ListA, EndPoint=dispatch_4.ListB)
align_plane_6 = AlignPlane(Plane=construct_plane_7, Direction=vector_2pt_6.Vector)  # -> Plane, Angle
curve_middle_11 = CurveMiddle(Curve=line_2)
xz_plane_2 = XZPlane(Origin=curve_middle_11)
mirror_2 = Mirror(Geometry=join_curves_2, Plane=xz_plane_2)  # -> Geometry, Transform
list_item_11 = ListItem(List=align_plane_4.Plane, Index=Slider(1, range=0..10), Wrap=True)
explode_6 = Explode(Curve=mirror_2.Geometry, Recursive=True)  # -> Segments, Vertices
list_item_12 = ListItem(List=explode_6.Segments, Index=Slider(1, range=0..10), Wrap=True)
curve_middle_12 = CurveMiddle(Curve=list_item_12)
orient_3 = Orient(Geometry=list_item_11, Source=list_item_11, Target=curve_middle_12)  # -> Geometry, Transform
list_item_13 = ListItem(List=align_plane_5.Plane, Index=Slider(2, range=0..10), Wrap=True)
deconstruct_plane_2 = DeconstructPlane(Plane=list_item_13)  # -> Origin, XAxis, YAxis, ZAxis
pi_4 = Pi(Factor=1)
list_item_14 = ListItem(List=align_plane_6.Plane, Index=Slider(0, range=0..10), Wrap=True)
construct_plane_8 = ConstructPlane(Origin=orient_3.Geometry, XAxis=deconstruct_plane_2.XAxis, YAxis=deconstruct_plane_2.YAxis)
list_item_15 = ListItem(List=align_plane_5.Plane, Index=Slider(1, range=0..10), Wrap=True)
rotate_plane_2 = RotatePlane(Plane=construct_plane_8, Angle=pi_4)
rotate_plane_3 = RotatePlane(Plane=list_item_15, Angle=pi_4)

curve_4 = Curve(polygon_2.Polygon)
curve_5 = Curve(join_curves_2)
curve_6 = Curve(rectangle_2.Rectangle)

curve_7 = Curve(curve_6)
orient_4 = Orient(Geometry=curve_6, Source=list_item_14, Target=rotate_plane_2)  # -> Geometry, Transform
orient_5 = Orient(Geometry=curve_7, Source=list_item_14, Target=rotate_plane_3)  # -> Geometry, Transform

curve_8 = Curve(curve_6)
curve_9 = Curve(curve_4)
explode_7 = Explode(Curve=orient_5.Geometry, Recursive=True)  # -> Segments, Vertices
curve_10 = Curve(curve_9)
curve_11 = Curve(curve_8)
area_3 = Area(Geometry=curve_11)  # -> Area, Centroid
area_4 = Area(Geometry=curve_10)  # -> Area, Centroid
list_item_16 = ListItem(List=explode_7.Segments, Index=panel_3, Wrap=True)
curve_middle_13 = CurveMiddle(Curve=list_item_16)
line_3 = Line(StartPoint=area_3.Centroid, EndPoint=area_4.Centroid)
join_curves_3 = JoinCurves(Curves=polar_array_2.Geometry, Preserve=False)
dispatch_5 = Dispatch(List=flatten(curve_middle_13), DispatchPattern=[True, False])  # -> ListA, ListB
merge = Merge(
    Data1=orient_4.Geometry,
    Data2=mirror_2.Geometry,
    Data3=curve_4,
    Data4=join_curves_3,
    Data5=curve_6,
    Data6=orient_5.Geometry)
curve_middle_14 = CurveMiddle(Curve=line_3)
line_4 = Line(StartPoint=dispatch_5.ListA, EndPoint=dispatch_5.ListB)
curve_middle_15 = CurveMiddle(Curve=line_4)
rotate_3d = Rotate3D(Geometry=flatten(merge), Angle=pi_2, Center=curve_middle_15, Axis=unit_z)  # -> Geometry, Transform
list_item_17 = ListItem(List=flatten(merge), Index=Slider(4, range=0..10), Wrap=True)
curve_12 = Curve(list_item_17)
list_item_18 = ListItem(List=flatten(rotate_3d.Geometry), Index=["0", "2"], Wrap=True)
dispatch_6 = Dispatch(List=list_item_18, DispatchPattern=[True, False])  # -> ListA, ListB
area_5 = Area(Geometry=dispatch_6.ListB)  # -> Area, Centroid
area_6 = Area(Geometry=dispatch_6.ListA)  # -> Area, Centroid
line_5 = Line(StartPoint=area_6.Centroid, EndPoint=area_5.Centroid)
curve_middle_16 = CurveMiddle(Curve=line_5)
yz_plane = YZPlane(Origin=curve_middle_16)
mirror_3 = Mirror(Geometry=curve_12, Plane=yz_plane)  # -> Geometry, Transform
curve_closest_point = CurveClosestPoint(Point=curve_middle_14, Curve=line_5)  # -> Point, Parameter, Distance
merge_2 = Merge(Data1=merge, Data2=rotate_3d.Geometry, Data3=mirror_3.Geometry)
unit_x = UnitX(Factor=curve_closest_point.Distance)
multiplication = Multiplication(A=unit_x, B=series)
move = Move(Geometry=graft(merge_2), Motion=multiplication)  # -> Geometry, Transform
list_item_19 = ListItem(List=flatten(move.Geometry), Index=Slider(11, range=0..100), Wrap=True)
list_item_20 = ListItem(List=flatten(move.Geometry), Index=Slider(43, range=0..100), Wrap=True)
explode_8 = Explode(Curve=list_item_19, Recursive=True)  # -> Segments, Vertices
explode_9 = Explode(Curve=list_item_20, Recursive=True)  # -> Segments, Vertices
list_item_21 = ListItem(List=explode_8.Segments, Index=Slider(4, range=0..10), Wrap=True)
list_item_22 = ListItem(List=explode_9.Segments, Index=Slider(4, range=0..10), Wrap=True)
curve_middle_17 = CurveMiddle(Curve=list_item_21)
curve_middle_18 = CurveMiddle(Curve=list_item_22)
construct_plane_9 = ConstructPlane(Origin=curve_middle_17, XAxis=Vector(1, 0, 0), YAxis=Vector(0, 1, 0))
construct_plane_10 = ConstructPlane(Origin=curve_middle_18, XAxis=Vector(1, 0, 0), YAxis=Vector(0, 1, 0))
list_item_23 = ListItem(List=construct_plane_5, Index=Slider(7, range=0..10), Wrap=True)
curve_13 = Curve(curve_4)
list_item_24 = ListItem(List=construct_plane_5, Index=number_slider, Wrap=True)
curve_14 = Curve(curve_4)
rotate_plane_4 = RotatePlane(Plane=construct_plane_9, Angle=pi_3)
rotate_plane_5 = RotatePlane(Plane=construct_plane_10, Angle=pi_3)
orient_6 = Orient(Geometry=curve_13, Source=list_item_23, Target=rotate_plane_5)  # -> Geometry, Transform
orient_7 = Orient(Geometry=curve_14, Source=list_item_24, Target=rotate_plane_4)  # -> Geometry, Transform
region_union = RegionUnion(Curves=flatten([move.Geometry, orient_7.Geometry, orient_6.Geometry]))
