# Grasshopper definition Wolfram_Intro_006b_Animation.gh (Grasshopper 1.0.7)
# plug-ins: Kangaroo2 Components

trigger = Trigger(Interval=20, TimerInterval=20, Target=data_recorder)
data_recorder = DataRecorder("1", DataLimit=10000, RecordData=True)
list_length = ListLength(List=data_recorder)
division = Division(A=list_length, B=Slider(59.9, range=0..100))
cosine = Cosine(Value=division)
absolute = Absolute(Value=cosine)
multiplication = Multiplication(A=Slider(0.22, range=0..1), B=absolute)
panel = Panel(multiplication)

number_slider = Slider(0.81, range=0..2)
number_slider_2 = Slider(10, range=3..12)
# great
# rhombicosidodecahedron
# ANIMATION
number_slider_3 = Slider(3, range=0..10)
series = Series(Start=0, Step=number_slider_3, Count=number_slider_2)
series_2 = Series(Start=Slider(3, range=3..12), Step=1, Count=number_slider_2)
construct_point = ConstructPoint(XCoordinate=0, YCoordinate=series, ZCoordinate=0)
polygon = Polygon(Plane=construct_point, Radius=Slider(1, range=0..1), Segments=series_2, FilletRadius=0)  # -> Polygon, Length
explode = Explode(Curve=polygon.Polygon, Recursive=True)  # -> Segments, Vertices
curve_middle = CurveMiddle(Curve=explode.Segments)
point = Point(graft(construct_point))
vector_2pt = Vector2Pt(PointA=graft(point), PointB=curve_middle, Unitize=False)  # -> Vector, Length
construct_plane = ConstructPlane(Origin=curve_middle, XAxis=vector_2pt.Vector, YAxis=Vector(0, 1, 0))
vector_display = VectorDisplay(Anchor=point, Vector=vector_2pt.Vector)
number_slider_4 = Slider(0.7, range=0..2)
list_item = ListItem(List=flatten(explode.Segments), Index=Slider(0, range=0..100), Wrap=True)
list_item_2 = ListItem(List=flatten(construct_plane), Index=Slider(0, range=0..100), Wrap=True)
list_item_3 = ListItem(List=polygon.Polygon, Index=Slider(1, range=0..10), Wrap=True)
list_item_4 = ListItem(List=flatten(construct_plane), Index=Slider(4, range=0..10), Wrap=True)
orient = Orient(Geometry=list_item_3, Source=list_item_4, Target=list_item_2)  # -> Geometry, Transform
md_slider = MDSlider(SliderMode=0, slider_value=Point(0.5, 0.5, 0.5), x_domain=Domain(0, 1), y_domain=Domain(0, 1), z_domain=Domain(0, 1))
list_item_5 = ListItem(List=flatten(construct_plane), Index=Slider(9, range=0..10), Wrap=True)
list_item_6 = ListItem(List=polygon.Polygon, Index=Slider(2, range=0..10), Wrap=True)

trigger_2 = Trigger(Interval=20, TimerInterval=20, Target=data_recorder_2)
data_recorder_2 = DataRecorder("1", DataLimit=10000, RecordData=True)
list_length_2 = ListLength(List=data_recorder_2)
division_2 = Division(A=list_length_2, B=Slider(27.6, range=0..100))
sine = Sine(Value=division_2)
absolute_2 = Absolute(Value=sine)
multiplication_2 = Multiplication(A=Slider(0.36, range=0..1), B=absolute_2)

addition = Addition(A=".5", B=multiplication_2)

panel_2 = Panel(addition)

pi = Pi(Factor=panel_2)
rotate_3d = Rotate3D(Geometry=orient.Geometry, Angle=pi, Center=list_item_2, Axis=list_item)  # -> Geometry, Transform
boundary_surfaces = BoundarySurfaces(Edges=rotate_3d.Geometry)
explode_2 = Explode(Curve=rotate_3d.Geometry, Recursive=True)  # -> Segments, Vertices
area = Area(Geometry=boundary_surfaces)  # -> Area, Centroid
curve_middle_2 = CurveMiddle(Curve=explode_2.Segments)
evaluate_surface = EvaluateSurface(Surface=reparameterize(boundary_surfaces), Point=md_slider)  # -> Point, Normal, UDirection, VDirection, Frame
vector_2pt_2 = Vector2Pt(PointA=graft(area.Centroid), PointB=curve_middle_2, Unitize=False)  # -> Vector, Length
vector_display_2 = VectorDisplay(Anchor=area.Centroid, Vector=vector_2pt_2.Vector)
construct_plane_2 = ConstructPlane(Origin=curve_middle_2, XAxis=vector_2pt_2.Vector, YAxis=Vector(0, 1, 0))
list_item_7 = ListItem(List=flatten(construct_plane_2), Index=Slider(15, range=0..100), Wrap=True)
list_item_8 = ListItem(List=flatten(explode_2.Segments), Index=Slider(3, range=0..100), Wrap=True)
pi_2 = Pi(Factor=panel_2)
adjust_plane = AdjustPlane(Plane=list_item_7, Normal=evaluate_surface.Normal)
orient_2 = Orient(Geometry=list_item_6, Source=list_item_5, Target=adjust_plane)  # -> Geometry, Transform
rotate_3d_2 = Rotate3D(Geometry=orient_2.Geometry, Angle=pi_2, Center=adjust_plane, Axis=list_item_8)  # -> Geometry, Transform
merge = Merge(Data1=[rotate_3d_2.Geometry, rotate_3d.Geometry, explode.Segments])
multipipe = MultiPipe(Curves=merge, NodeSize=Slider(0.11, range=0..1), EndOffset=1, StrutSize=1, Segment=0, KinkAngle=0.6, CubeFit=0, Caps=0)
